# Grasshopper definition tensegrity_geometries_AFlamant_2020.gh (Grasshopper 1.0.7)
# plug-ins: Kangaroo2 Components, LunchBox, TT Toolbox

# ----
# INFO
# This script allows to create the geometry of a cube of tensegrity
panel = Panel("Cube tensegrity script")

# ----
# INFO
# This script allows to create the geometry of ring tensegrity.
# 
# The geometry actually derive from node on cable tensegrity.
panel_2 = Panel("Signet ring script")

base_center_point = Point(Point(0, 0, 0))
# INFO
# Non planar tensegrity creation script
# This script allows to create the geometry of non-planar tensegrity structure.
# 
# These structure are based on the quadruplex.
# 
# As the algorithm to create several layers is quite complex, it's not implemented yet
list = ValueList({"XY plane": 0, "YZ plane": 1, "XZ plane": 2}, selected="XY plane")
ppick = PlanePicker_2(G=list, O=base_center_point)
construction_plane = Plane(ppick)

# ---- group: Construction plane
base_center_point_2 = Point(Point(0, 0, 0))
# INFO
# planar tensegrity creation script
# This script allows to create the geometry of planar tensegrity structure.
# 
# These structure are based on the quadruplex.
list_2 = ValueList({"XY plane": 0, "YZ plane": 1, "XZ plane": 2}, selected="XY plane")
ppick_2 = PlanePicker_2(G=list_2, O=base_center_point_2)
construction_plane_2 = Plane(ppick_2)

# ---- group: Base dimension
base_size_parameter = ValueList({"Outter circle diameter": 0, "Cables length": 1, "Inner circle diameter": 2}, selected="Inner circle diameter")
reference_base_outter_circle_diameter_m = Slider(10, range=1..10)
reference_base_s_cables_length_m = Slider(10, range=1..10)
reference_base_inner_circle_diameter_m = Slider(5, range=2..5)

# ----
# layer height
number_of_cells_in_x_direction = Slider(4, range=1..4)
# X=2     Y=2
number_of_cells_in_y_direction = Slider(8, range=1..8)
# X=4     Y=2
layer_height = Slider(6, range=5..8)
# 1 layer
number_of_layers = Slider(1, range=1..3)

# ----
# layer height
number_of_cells_in_x_direction_2 = Slider(4, range=1..5)
# X=2     Y=2
number_of_cells_in_y_direction_2 = Slider(8, range=1..8)
srf = Surface(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)
# X=4     Y=2
layer_height_2 = Slider(3, range=0.5..10)

base_size_parameter_2 = ValueList({"Outter circle radius": 0, "Cables length": 1, "Inner circle radius": 2}, selected="Inner circle radius")
reference_base_outter_circle_radius_m = Slider(5, range=3..5)
reference_base_s_cables_length_m_2 = Slider(10, range=1..10)
reference_base_inner_circle_radius_m = Slider(5, range=1..8)

# ----
# Center circle radius
# Outer circles radius
# Ring thickness
# theta
list_3 = ValueList({"XY plane": 0, "YZ plane": 1, "XZ plane": 2}, selected="XY plane")
outer_circles_diameter = Slider(25, range=20..25)
pt = Point(Point(0, 0, 0))
center_circle_diameter = Slider(35, range=25..35)
ring_thickness = Slider(10, range=5..10)
# e = ring thickness
# e = 0
e = Slider(2, range=0..2)
theta = Slider(20, range=0..20)
number_of_division = Slider(25, range=10..25)
ppick_3 = PlanePicker_2(G=list_3, O=pt)

list_4 = ValueList({"XY plane": 0, "YZ plane": 1, "XZ plane": 2}, selected="XY plane")
Y = Slider(30, range=5..30)
# X = 10     Y=15     Z=5
# X = 10     Y=10     Z=10
x_div = Slider(4, range=2..4)
# X div = 3     Y div = 3     Z div = 3
# X div = 6     Y div = 3     Z div = 3
# X div = 3     Y div = 6     Z div = 3
# X div = 3     Y div = 3     Z div = 6
z_div = Slider(3, range=2..3)
pt_2 = Point(Point(0, 0, 0))
# X = 10     Y=10     Z=5
Z = Slider(10, range=5..10)
y_div = Slider(5, range=2..5)
X = Slider(20, range=5..20)
# X = 15     Y=10     Z=5
ppick_4 = PlanePicker_2(G=list_4, O=pt_2)

rotation_type = ValueList({"Alterned": 0, "Continuous": 1}, selected="Alterned")
# Node on cable
# Alterned rotation
# Regular rotation
relative_rotation = Slider(45, range=0..180)

# ----
# Geometric parameters
# Node on node
assembly_type = ValueList({"Node on node": 0, "Node on cable": 1}, selected="Node on node")
# INFO
# Tensegrity along curve script
# This script allows to create the geometry of a tensegrity structure along path
crv = Curve(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)
# Assembly
# Curve
crv_2 = Curve(<curve referenced from the Rhino model>)
# 5 cells
# 3 cells
number_of_cells = Slider(6, range=3..50)
# Triangle
# Pentagon
number_of_base_edge = Slider(4, range=3..6)

base_size_parameter_3 = ValueList({"Outter circle diameter": 0, "Cables length": 1, "Inner circle diameter": 2}, selected="Outter circle diameter")
reference_base_inner_circle_diameter_m_2 = Slider(5.2, range=1..10)
reference_base_outter_circle_diameter_m_2 = Slider(12.5, range=1..20)
reference_base_s_cables_length_m_3 = Slider(10, range=1..10)

# ---- group: Construction plane
base_center_point_3 = Point(Point(0, 0, 0))
# <-- Double click to go to planar assembly script
# <-- Double click to go to non planar assembly script
# <-- Double click to go to signet ring tensegrity script
# <-- Double click to go to tensegrity cube script
# INFO
# Linear tensegrity creation script
# This script allows to create the geometry of linear tensegrity structure.
# <-- Double click to go to summary
list_5 = ValueList({"Z direction": 0, "X direction": 1, "Y direction": 2}, selected="Y direction")
ppick_5 = PlanePicker(G=list_5, O=base_center_point_3)

# ---- group: Height parameters
length_parameter = ValueList({"Cell Height": 0, "Assembly length": 1, "Regular Cell length": 2}, selected="Assembly length")
cell_height_m = Slider(13.7, range=1..20)
# Regular cell
total_length_m = Slider(100, range=20..100)

# ---- group: Select assembly type
# Node on node
assembly_type_2 = ValueList({"Node on Node": 0, "Node on Cables": 1}, selected="Node on Node")

# ---- group: Base dimension
base_size_parameter_4 = ValueList({"Outter circle diameter": 0, "Cables length": 1, "Inner circle diameter": 2}, selected="Outter circle diameter")
reference_base_outter_circle_diameter_m_3 = Slider(12.5, range=1..15)
reference_base_s_cables_length_m_4 = Slider(8, range=1..10)
reference_base_inner_circle_diameter_m_3 = Slider(7, range=1..10)

# ---- group: Relative rotation beetween bases
relative_rotation_2 = ValueList({"Alterned": 0, "Regular": 1}, selected="Alterned")
# Alterned rotation
# Regular rotation
relative_rotation_3 = Slider(45, range=0..45)

# ----
# Geometric parameters
struts_type = ValueList({"Linear struts": 0, "Sinusoidal struts": 1}, selected="Linear struts")
# Linear profile
# 4 cells
number_of_cells_2 = Slider(6, range=1..6)
# Triangle
reference_polygon = Slider(7, range=3..7)

# ---- group: Profile type
cells_position_on_graph = Range(Domain=Domain(0, 1), Steps=expr("20*x", number_of_cells_2))
linear_profile = ValueList({"Linear": 0, "Custom": 1}, selected="Linear")
assembly_profile = GraphMapper(
    cells_position_on_graph,
    x0=0,
    x1=1,
    y0=1,
    y1=2.5,
    container_name="Gaussian",
    factor=0.05645161867,
    mean=0.5,
    sdev=0.02424243093)

# ----
pt_3 = Point(Point(54.05174955, 61.36643775, 0))  # disabled
number_slider = Slider(20, range=0..30)  # disabled
number_slider_2 = Slider(5, range=0..10)  # disabled
number_slider_3 = Slider(3, range=3..6)  # disabled
cir = Circle(Plane=pt_3, Radius=number_slider)  # disabled
eval = EvaluateCurve(Curve=reparameterize(cir), Parameter=0)  # -> Point, Tangent, Angle; disabled
xz = XZPlane(Origin=eval.Point)  # disabled
polygon = Polygon(Plane=xz, Radius=number_slider_2, Segments=number_slider_3, FilletRadius=0)  # -> Polygon, Length; disabled
explode = Explode(Curve=polygon.Polygon, Recursive=True)  # -> Segments, Vertices; disabled
X_2 = UnitX(Factor=1)  # disabled
item = ListItem(List=explode.Segments, Index=0, Wrap=True)  # disabled
number_slider_4 = Slider(16, range=3..50)  # disabled
panel_3 = Panel("360")  # disabled
angle = Angle(VectorA=X_2, VectorB=item)  # -> Angle, Reflex; disabled
rotate = Rotate(Geometry=polygon.Polygon, Angle=expr("-x", angle.Angle), Plane=xz)  # -> Geometry, Transform; disabled
range = Range(Domain=panel_3, Steps=number_slider_4)  # disabled
panel_4 = Panel("360")  # disabled
number_slider_5 = Slider(2, range=1..4)  # disabled
rotate_2 = Rotate(Geometry=rotate.Geometry, Angle=degrees(range), Plane=pt_3)  # -> Geometry, Transform; disabled
multiplication = Multiplication(A=number_slider_5, B=panel_4)  # disabled
pcen = PolygonCenter(Polyline=rotate_2.Geometry)  # -> CenterV, CenterE, CenterA; disabled
range_2 = Range(Domain=multiplication, Steps=number_slider_4)  # disabled
pl_origin = PlaneOrigin(Base=rotate_2.Geometry, Origin=pcen.CenterE)  # disabled
rotate_3 = Rotate(Geometry=rotate_2.Geometry, Angle=degrees(range_2), Plane=pl_origin)  # -> Geometry, Transform; disabled
crv_3 = Curve(rotate_3.Geometry)  # disabled
explode_2 = Explode(Curve=crv_3, Recursive=True)  # -> simplify(Segments), Vertices; disabled
cull_i = CullIndex(List=explode_2.Vertices, Indices=-1, Wrap=True)  # -> simplify(List); disabled
viewer = ParamViewer(cull_i)  # disabled
lng = ListLength(List=viewer)  # disabled
series = Series(Start=0, Step=1, Count=lng)  # disabled
crv_4 = Curve(explode_2.Segments)  # disabled
number_slider_6 = Slider(3, range=0..3)  # disabled
shift = ShiftList(List=cull_i, Shift=graft(series), Wrap=True)  # disabled
toggle = BooleanToggle(True)  # disabled
toggle_2 = BooleanToggle(False)  # disabled
toggle_3 = BooleanToggle(False)  # disabled
toggle_4 = BooleanToggle(False)  # disabled
flip = FlipMatrix(Data=crv_4)  # disabled
flip_2 = FlipMatrix(Data=shift)  # disabled
flip_3 = FlipMatrix(Data=cull_i)  # disabled
loft_opt = LoftOptions(Closed=toggle, Adjust=toggle_2, Rebuild=toggle_3, Refit=toggle_4, Type=number_slider_6)  # disabled
pline = PolyLine(Vertices=flip_2, Closed=False)  # disabled
pline_2 = PolyLine(Vertices=flip_3, Closed=False)  # disabled
loft = Loft(Curves=flip, Options=loft_opt)  # disabled
explode_3 = Explode(Curve=pline, Recursive=True)  # -> simplify(Segments), Vertices; disabled
explode_4 = Explode(Curve=pline_2, Recursive=True)  # -> simplify(Segments), Vertices; disabled
number_slider_7 = Slider(100, range=0..255)  # disabled
number_slider_8 = Slider(20, range=0..100)  # disabled
number_slider_9 = Slider(1, range=1..10)  # disabled
number_slider_10 = Slider(10, range=0..10)  # disabled
number_slider_11 = Slider(0, range=0..100)  # disabled
item_2 = ListItem(List=flatten(explode_3.Vertices), Index=0, Wrap=True)  # disabled
flip_4 = FlipMatrix(Data=explode_3.Segments)  # disabled
flip_5 = FlipMatrix(Data=explode_4.Segments)  # disabled
int = Integer([0, 255, 0])  # disabled
int_2 = Integer([0, 0, 255])  # disabled
int_3 = Integer([255, 0, 0])  # disabled
anchor = Anchor(Point=item_2, Strength=10000)  # disabled
pow = Power(A=number_slider_10, B=number_slider_9)  # disabled
line = Line(flip_4)  # disabled
line_2 = Line(explode_2.Segments)  # disabled
join = JoinCurves(Curves=line_2, Preserve=False)  # disabled
path_mapper = PathMapper(line_2, source="{A}(i)", target="{A;i}")  # disabled
line_3 = Line(flip_5)  # disabled
rgb = ColourRGB(Alpha=number_slider_7, Red=graft(int_3), Green=graft(int), Blue=graft(int_2))  # -> simplify(Colour); disabled
length_line = LengthLine(Line=flatten(line_2), Length=number_slider_11, Strength=10)  # disabled
length_line_2 = LengthLine(Line=flatten(line), Length=number_slider_8, Strength=pow)  # disabled
length_line_3 = LengthLine(Line=flatten(line_3), Length=number_slider_11, Strength=10)  # disabled
pcen_2 = PolygonCenter(Polyline=join)  # -> CenterV, simplify(CenterE), CenterA; disabled
eval_2 = EvaluateCurve(Curve=reparameterize(path_mapper), Parameter=[0, 0.5, 1])  # -> Point, Tangent, Angle; disabled
preview = CustomPreview(Geometry=loft, Material=rgb)  # disabled
pt_4 = Point(simplify(pcen_2.CenterV))  # disabled
viewer_2 = ParamViewer(eval_2.Point)  # disabled
path_mapper_2 = PathMapper(pt_4, source="{A}", target="{A;1}")  # disabled
path_mapper_3 = PathMapper(length_line_3, source="{A}", target="{2}")  # disabled
path_mapper_4 = PathMapper(pt_4, source="{A}", target="{A;2}")  # disabled
path_mapper_5 = PathMapper(pt_4, source="{A}", target="{A;0}")  # disabled
path_mapper_6 = PathMapper(pt_4, source="{A}", target="{A;3}")  # disabled
path_mapper_7 = PathMapper(length_line_2, source="{A}", target="{0}")  # disabled
path_mapper_8 = PathMapper(length_line, source="{A}", target="{1}")  # disabled
swatch = ColourSwatch(SwatchColor=RGB(0, 0, 0))  # disabled
pt_5 = Point(simplify([path_mapper_5, path_mapper_2, path_mapper_4, path_mapper_6]))  # disabled
replace = ReplaceItems(List=eval_2.Point, Item=pt_5, Indices=1, Wrap=False)  # -> simplify(List); disabled
number_slider_12 = Slider(2, range=0..10)  # disabled
button = Button()  # disabled
toggle_5 = BooleanToggle(False)  # disabled
button_2 = Button()  # disabled
toggle_6 = BooleanToggle(False)  # disabled
nurbs = NurbsCurve(Vertices=replace, Degree=number_slider_12, Periodic=False)  # -> Curve, Length, Domain; disabled
solver = Solver(
    GoalObjects=[path_mapper_7, path_mapper_8, path_mapper_3, anchor],
    Reset=button,
    Threshold=1e-15,
    Tolerance=0.01,
    On=toggle_5)  # -> I, V, O; disabled
bouncysolver = BouncySolver(
    GoalObjects=[path_mapper_7, path_mapper_8, path_mapper_3],
    Reset=button_2,
    Threshold=1e-15,
    Tolerance=0.01,
    Damping=0.99,
    Iterations=10,
    On=toggle_6)  # -> I, V, O; disabled
trim = TrimTree(Tree=nurbs.Curve, Depth=1)  # disabled
boundary = BoundarySurfaces(Edges=trim)  # disabled
line_4 = Line(solver.O)  # disabled
panel_5 = Panel("{1}")  # disabled
panel_6 = Panel("{0}")  # disabled
panel_7 = Panel("{2}")  # disabled
branch = TreeBranch(Tree=line_4, Path=panel_7, MaintainPaths=True)  # disabled
branch_2 = TreeBranch(Tree=line_4, Path=panel_5, MaintainPaths=True)  # disabled
branch_3 = TreeBranch(Tree=line_4, Path=panel_6, MaintainPaths=True)  # disabled
len = Length(Curve=branch)  # disabled
len_2 = Length(Curve=branch_2)  # disabled
len_3 = Length(Curve=branch_3)  # disabled
avr = Average(Input=len_3)  # disabled
avr_2 = Average(Input=len_2)  # disabled
avr_3 = Average(Input=len)  # disabled

# ----
# Ring from prismatic cells
# NOT SUPER STABLE
# -> Rotation needs to be very specific
# -> Signet probably work better
pt_6 = Point(Point(20.09449152, 9.650742595, 0))  # disabled
xy = XYPlane(Origin=pt_6)  # disabled
# Tachi algorithm
# Not finished
# There are bugs
platocube = PlatonicCube(Plane=xy, Radius=10, Truncation=0)  # disabled
platotetra = PlatonicTetrahedron(Plane=xy, Radius=10, Truncation=0)  # disabled
platoicosa = PlatonicIcosahedron(Plane=xy, Radius=10, Truncation=0.38198)  # disabled
platoocta = PlatonicOctahedron(Plane=xy, Radius=10, Truncation=0)  # disabled
smesh = SimpleMesh(Brep=platocube)  # disabled
smesh_2 = SimpleMesh(Brep=platotetra)  # disabled
smesh_3 = SimpleMesh(Brep=platoicosa)  # disabled
smesh_4 = SimpleMesh(Brep=platoocta)  # disabled
number_slider_13 = Slider(4, range=0..4)  # disabled
number_slider_14 = Slider(5, range=0..10)  # disabled
number_slider_15 = Slider(0.9, range=0..10)  # disabled
number_slider_16 = Slider(33, range=10..100)  # disabled
number_slider_17 = Slider(45, range=0..90)  # disabled
item_3 = ListItem(List=[smesh, smesh_2, smesh_3, smesh_4], Index=number_slider_13, Wrap=True)  # disabled
swatch_2 = ColourSwatch(SwatchColor=RGBA(28, 194, 255, 107))  # disabled
medges = MeshEdges(Mesh=item_3)  # -> NakedEdges, InteriorEdges, NonManifoldEdges; disabled
python = GhPythonScript(M=item_3, A=number_slider_17)  # -> Struts, Cables, S1, S2; inputs M: Mesh; disabled
# ---------- python: Python ----------
"""Convert valid mesh to tensegrity structure
    Inputs:
        M: Inputs
        A: Rotation angle
    Outputs:
        Str: Struts lines
        Cbl: Cables lines"""

from ghpythonlib.componentbase import executingcomponent as component
import Grasshopper as gh, GhPython
import System
import Rhino
import rhinoscriptsyntax as rs

from Rhino.Geometry import Mesh, Line
from Rhino.Geometry.Mesh import TopologyVertices
from Rhino.Geometry.Transform import Rotation as rot
from math import radians

class MeshToTensegrityComponent(component):
    def __init__(self):
        component.__init__(self)
        
    def RunScript(self, M, A):
        if M is None : return
        if A is None : A = 45
        M.RebuildNormals()
        
        #Elements enumeration
        vertices = [M.Vertices[i] for i in range(M.Vertices.Count)]
        lines = [M.TopologyEdges.EdgeLine(i) for i in range(M.TopologyEdges.Count)]
        faces = M.Faces
        normals = [M.FaceNormals[i] for i in range(M.FaceNormals.Count)]
        
        #Elements creation
        midpoints = [line.PointAt(.5) for line in lines]
        struts = [line for line in lines]
        
        faces_edges = [[Line(vertices[face.A], vertices[face.B]),
                        Line(vertices[face.B], vertices[face.C]),
                        Line(vertices[face.C], vertices[face.A])] 
                        if face.IsTriangle
                        else
                        [Line(vertices[face.A], vertices[face.B]),
                        Line(vertices[face.B], vertices[face.C]),
                        Line(vertices[face.C], vertices[face.D]),
                        Line(vertices[face.D], vertices[face.A])]
                        if face.IsQuad
                        else None
                        for face in faces]

        vertices_edges = [M.TopologyVertices.ConnectedEdges(i) for i in range(M.TopologyVertices.Count)]
        vertices_edges = [list(vertex_edges) for vertex_edges in vertices_edges]
        orders = []
        for i,vertex_edges in enumerate(vertices_edges):
            connections = []
            for edges_index in vertex_edges:
                if self.almost_equal_points(lines[edges_index].From,M.TopologyVertices[i]): 
                    connections.append(True)
                elif self.almost_equal_points(lines[edges_index].To, M.TopologyVertices[i]): 
                    connections.append(False)
                else: 
                    connections.append(None)
            orders.append(connections)
        
        faces_vertices = [[vertices[face.A], 
                           vertices[face.B],
                           vertices[face.C]]
                           if face.IsTriangle
                           else
                           [vertices[face.A], 
                           vertices[face.B],
                           vertices[face.C],
                           vertices[face.D]]
                           if face.IsQuad
                           else None
                           for face in faces]
                           
        faces_edges_index = []
        for face_edges in faces_edges:
            indexes = []
            for edge in face_edges:
                for i, strut in enumerate(struts):
                    if self.almost_equal_lines(edge, strut) == 1:
                        indexes.append(i)
                        break
                    elif self.almost_equal_lines(edge, strut) == -1:
                        #struts[i] = Line(strut.To,strut.From)
                        indexes.append(i)
                        break
            faces_edges_index.append(indexes)
        
        axes = [[] for strut in struts]
        for i,strut in enumerate(struts):
            print(i)
            for j,face_edges in enumerate(faces_edges):
                locals_axes = []
                for edge in face_edges:
                    if self.almost_equal_lines(strut,edge) :
                        axes[i].append(normals[j])
                        print("ok")
        axes = [axis[0] + axis[1] for axis in axes]
        
        transforms = [rot(radians(A), axis, center) for axis, center in zip(axes, midpoints)]
        for strut, transform in zip(struts, transforms):
            strut.Transform(transform)
            
        for face_edges, face_edges_index in zip(faces_edges, faces_edges_index):
            for edge, index in zip(face_edges, face_edges_index):
                edge.Transform(transforms[index])
        
        
        cables = []
        surf1 = []
        surf2 = []
        
        for face_edges in faces_edges:
            
            cables_end = []
            for edge1, edge2 in zip(face_edges, self.shift(face_edges,1)):
                cables_end.append(Line(edge1.To, edge2.To))
            
            cables += cables_end
            surf2.append(cables_end)
        print(len(vertices_edges))
        for vertex_edges,order in zip(vertices_edges, orders):
            cables_start = []
            for start_index, start_state, end_index, end_state in zip(vertex_edges, order, self.shift(vertex_edges,1), self.shift(order,1)):
                if start_state:
                    start_point = struts[start_index].From
                else:
                    start_point = struts[start_index].To
                
                if end_state:
                    end_point = struts[end_index].From
                else:
                    end_point = struts[end_index].To
                    
                cables_start.append(Line(start_point, end_point))
            cables += cables_start
            surf1.append(cables_start)
                
        surf1 = self.list_to_tree(surf1)
        surf2 = self.list_to_tree(surf2)
        
        return struts, cables, surf1, surf2
        
        
    
    @staticmethod
    def list_to_tree(nestedList):
        """ Convert a nested python iterable to a datatree """
        
        dt = gh.DataTree[object]()
        for i,l in enumerate(nestedList):
            dt.AddRange(l,gh.Kernel.Data.GH_Path(i))
            
        return dt
    
    @staticmethod
    def almost_equal_lines(L1, L2):
        
        d1 = [abs(L1.ToX-L2.ToX), abs(L1.ToY-L2.ToY),abs(L1.ToZ-L2.ToZ),
              abs(L1.FromX-L2.FromX), abs(L1.FromY-L2.FromY), abs(L1.FromZ-L2.FromZ)]
        d2 = [abs(L1.ToX-L2.FromX), abs(L1.ToY-L2.FromY),abs(L1.ToZ-L2.FromZ),
              abs(L1.FromX-L2.ToX), abs(L1.FromY-L2.ToY), abs(L1.FromZ-L2.ToZ)]
        
        if max(d1) < 1e-6:
            return 1
        elif max(d2) < 1e-6:
            return -1
        else:
            return 0
    
    @staticmethod
    def almost_equal_points(Pt1, Pt2):
        delta = [abs(Pt2.X - Pt1.X), abs(Pt2.Y-Pt1.Y), abs(Pt2.Z-Pt1.Z)]
        
        if max(delta) < 1e-6:
            return True
        else:
            return False
    
    @staticmethod
    def shift(list0, i):
        list1 = [list0[i+j] for j in range(len(list0)-i)]
        list2 = [list0[j] for j in range(i)]
        return list1+list2
# ---------- end python ----------
preview_2 = CustomPreview(Geometry=[item_3, medges.InteriorEdges], Material=swatch_2)  # disabled

# ----
# STEP 1: Choose parameters
# Signet ring
activate_script = BooleanToggle(True)

# ----
# STEP 1: Choose parameters
# Assembly along curve
activate_script_2 = BooleanToggle(True)

# ----
# 2 layers
number_slider_18 = Slider(3, range=0..3)

# ----
# STEP 1: Choose parameters
# Non-planar assembly
activate_script_3 = BooleanToggle(True)

# ----
# STEP 1: Choose parameters
# Planar assembly
activate_script_4 = BooleanToggle(True)

# ----
# STEP 1: Choose parameters
# Cube assembly
activate_script_5 = BooleanToggle(True)

# ----
# Pentagon
number_slider_19 = Slider(3, range=0..3)
# X=2     Y=1
subtraction = Subtraction(A=6, B=number_slider_18)
# 2 cells
number_slider_20 = Slider(70, range=40..70)
# Cell height
# Assembly length
# Node on cable
number_slider_21 = Slider(1, range=0..1)
# Custom profile
series_2 = Series(Start=0, Step=1, Count=expr("x+1", number_of_cells_2))

# ----
# <-- Double click to go to summary
reference_base_outter_circle_radius_m_2 = Number(reference_base_outter_circle_radius_m)
reference_base_inner_circle_radius_m_2 = Number(reference_base_inner_circle_radius_m)
reference_base_s_cables_length_m_5 = Number(reference_base_s_cables_length_m_2)
number_of_cells_in_x_direction_3 = Integer(number_of_cells_in_x_direction_2)
number_of_cells_in_y_direction_3 = Integer(number_of_cells_in_y_direction_2)
surface_de_projection = Surface(srf)
base_size_parameter_5 = Integer(base_size_parameter_2)
construction_plane_3 = Plane(construction_plane)
# X=2     Y=1
level_height = Number(layer_height_2)
run = Boolean(activate_script_3)
entwine = Entwine(
    Branch00=construction_plane_3,
    Branch01=surface_de_projection,
    Branch02=base_size_parameter_5,
    Branch03=reference_base_outter_circle_radius_m_2,
    Branch04=reference_base_s_cables_length_m_5,
    Branch05=reference_base_inner_circle_radius_m_2,
    Branch06=number_of_cells_in_x_direction_3,
    Branch07=number_of_cells_in_y_direction_3,
    Branch08=level_height,
    FlattenInputs=True)
filter = StreamFilter(Gate=run, Stream1=entwine)
bang = ExplodeTree(Data=filter)  # -> Branch0, Branch1, Branch2, Branch3, Branch4, Branch5, Branch6, Branch7, Branch8
reference_base_outter_circle_radius_m_3 = Number(expr("x/2.", bang.Branch3))
reference_base_inner_circle_radius_m_3 = Number(expr("x/2.", bang.Branch5))
reference_base_s_cables_length_m_6 = Number(expr("x/2.", bang.Branch4))
number_of_cells_in_x_direction_4 = Integer(bang.Branch6)
number_of_cells_in_y_direction_4 = Integer(bang.Branch7)
surface_de_projection_2 = Surface(bang.Branch1)
base_size_parameter_6 = Integer(bang.Branch2)
construction_plane_4 = Plane(bang.Branch0)
level_height_2 = Number(bang.Branch8)

# ----
# <-- Double click to go to Linear assembly script
# <-- Double click to go to tensegrity along curve script
# Linear assembly
activate_script_6 = BooleanToggle(True)

# ----
# <-- Double click to go to summary
entwine_2 = Entwine(
    Branch00=ppick_3,
    Branch01=center_circle_diameter,
    Branch02=outer_circles_diameter,
    Branch03=ring_thickness,
    Branch04=e,
    Branch05=number_of_division,
    Branch06=theta,
    FlattenInputs=True)
filter_2 = StreamFilter(Gate=activate_script, Stream1=entwine_2)
bang_2 = ExplodeTree(Data=filter_2)  # -> Branch0, Branch1, Branch2, Branch3, Branch4, Branch5, Branch6

panel_8 = Panel(assembly_profile)
subtraction_2 = Subtraction(A=7, B=number_slider_19)
addition = Addition(A=series_2, B=number_slider_20)
item_4 = ListItem(List=assembly_profile, Index=addition, Wrap=True)

# ----
# <-- Double click to go to summary
entwine_3 = Entwine(
    Branch00=crv_2,
    Branch01=assembly_type,
    Branch02=rotation_type,
    Branch03=relative_rotation,
    Branch04=number_of_cells,
    Branch05=number_of_base_edge,
    Branch06=base_size_parameter_3,
    Branch07=reference_base_outter_circle_diameter_m_2,
    Branch08=reference_base_s_cables_length_m_3,
    Branch09=reference_base_inner_circle_diameter_m_2,
    FlattenInputs=True)
filter_3 = StreamFilter(Gate=activate_script_2, Stream1=entwine_3)
bang_3 = ExplodeTree(Data=filter_3)  # -> Branch0, Branch1, Branch2, Branch3, Branch4, Branch5, Branch6, Branch7, Branch8, Branch9

# ----
# <-- Double click to go to summary
entwine_4 = Entwine(Branch00=ppick_4, Branch01=X, Branch02=Y, Branch03=Z, Branch04=x_div, Branch05=y_div, Branch06=z_div, FlattenInputs=True)
filter_4 = StreamFilter(Gate=activate_script_5, Stream1=entwine_4)
bang_4 = ExplodeTree(Data=filter_4)  # -> Branch0, Branch1, Branch2, Branch3, Branch4, Branch5, Branch6

construction_plane_trigger_trigger = StreamFilter(Gate=activate_script_4, Stream1=construction_plane_2)
base_size_parameterr_trigger = StreamFilter(Gate=activate_script_4, Stream1=base_size_parameter)
reference_base_outter_circle_radius_trig = StreamFilter(Gate=activate_script_4, Stream1=reference_base_outter_circle_diameter_m)  # "Reference base outter circle radius trigger"
reference_base_s_cables_length_trigger = StreamFilter(Gate=activate_script_4, Stream1=reference_base_s_cables_length_m)
reference_base_inner_circle_radius_trigg = StreamFilter(Gate=activate_script_4, Stream1=reference_base_inner_circle_diameter_m)  # "Reference base inner circle radius trigger"
number_of_cells_in_x_direction_trigger = StreamFilter(Gate=activate_script_4, Stream1=number_of_cells_in_x_direction)
number_of_cells_in_y_direction_trigger = StreamFilter(Gate=activate_script_4, Stream1=number_of_cells_in_y_direction)
level_height_trigger = StreamFilter(Gate=activate_script_4, Stream1=subtraction)
number_of_layers_trigger = StreamFilter(Gate=activate_script_4, Stream1=number_of_layers)

# ----
# <-- Double click to go to summary
reference_base_outter_circle_radius_m_4 = Number(expr("x/2", reference_base_outter_circle_radius_trig))
reference_base_inner_circle_radius_m_4 = Number(expr("x/2", reference_base_inner_circle_radius_trigg))
reference_base_s_cables_length_m_7 = Number(reference_base_s_cables_length_trigger)
number_of_cells_in_x_direction_5 = Integer(number_of_cells_in_x_direction_trigger)
number_of_cells_in_y_direction_5 = Integer(number_of_cells_in_y_direction_trigger)
base_size_parameter_7 = Integer(base_size_parameterr_trigger)
construction_plane_5 = Plane(construction_plane_trigger_trigger)
number_of_layers_2 = Integer(number_of_layers_trigger)
level_height_3 = Number(level_height_trigger)

num = Number(expr("x/2", bang_2.Branch1))
num_2 = Number(expr("x/2", bang_2.Branch2))
int_4 = Integer(bang_2.Branch5)
pln = Plane(bang_2.Branch0)
num_3 = Number(bang_2.Branch3)
num_4 = Number(bang_2.Branch4)
num_5 = Number(bang_2.Branch6)

# ---- group: General trigger
plane_trigger = StreamFilter(Gate=activate_script_6, Stream1=ppick_5)
cell_height_trigger = StreamFilter(Gate=activate_script_6, Stream1=cell_height_m)
base_size_type_trigger = StreamFilter(Gate=activate_script_6, Stream1=base_size_parameter_4)
base_edge_length_trigger = StreamFilter(Gate=activate_script_6, Stream1=reference_base_inner_circle_diameter_m_3)
rotation_type_trigger = StreamFilter(Gate=activate_script_6, Stream1=relative_rotation_2)
angletrigger = StreamFilter(Gate=activate_script_6, Stream1=relative_rotation_3)
struts_type_trigger = StreamFilter(Gate=activate_script_6, Stream1=struts_type)
profile_type_trigger = StreamFilter(Gate=activate_script_6, Stream1=linear_profile)
number_of_cells_trigger = StreamFilter(Gate=activate_script_6, Stream1=number_of_cells_2)
reference_polygon_trigger = StreamFilter(Gate=activate_script_6, Stream1=subtraction_2)

# ----
height_type_trigger = StreamFilter(Gate=activate_script_6, Stream1=length_parameter)

# ----
# STEP 1: Choose parameters
total_height_trigger = StreamFilter(Gate=activate_script_6, Stream1=total_length_m)
assembly_type_trigger = StreamFilter(Gate=activate_script_6, Stream1=assembly_type_2)
base_outter_circle_radius_trigger = StreamFilter(Gate=activate_script_6, Stream1=reference_base_outter_circle_diameter_m_3)
base_edge_length_trigger_2 = StreamFilter(Gate=activate_script_6, Stream1=reference_base_s_cables_length_m_4)
profile_scale_trigger = StreamFilter(Gate=activate_script_6, Stream1=item_4)

# ----
# Canvas template provided by :
# Summary
# Colors
# <-- Nodes color
# <-- Cables color
# <-- Struts color
nodes_color = ColourSwatch(SwatchColor=RGB(56, 186, 0))
cables_color = ColourSwatch(SwatchColor=RGB(0, 73, 163))
struts_color = ColourSwatch(SwatchColor=RGB(255, 0, 0))

reference_base_outter_circle_radius = Number(expr("x/2", bang_3.Branch7))
reference_base_inner_circle_radius = Number(expr("x/2", bang_3.Branch9))
reference_base_s_cables_length = Number(bang_3.Branch8)
number_of_base_edges = Integer(bang_3.Branch5)
base_size_parameter_8 = Integer(bang_3.Branch6)
reference_curve = Curve(bang_3.Branch0)
number_of_cells_3 = Integer(bang_3.Branch4)
assembly_type_3 = Integer(bang_3.Branch1)
rotation_type_2 = Integer(bang_3.Branch2)
angle_2 = Number(bang_3.Branch3)

# ---- group: Parameters
base_outter_circle_radius = Number(expr("x/2.", base_outter_circle_radius_trigger))
base_edge_length = Number(expr("x/2.", base_edge_length_trigger))
reference_polygon_edges = Integer(reference_polygon_trigger)
construction_plane_6 = Plane(plane_trigger)
base_edge_length_2 = Number(base_edge_length_trigger_2)
number_of_cells_4 = Integer(number_of_cells_trigger)
assembly_type_4 = Integer(assembly_type_trigger)
base_size_type = Integer(base_size_type_trigger)
rotation_type_3 = Integer(rotation_type_trigger)
profile_scale = Number(profile_scale_trigger)
height_type = Integer(height_type_trigger)
total_height = Number(total_height_trigger)
profile_type = Integer(profile_type_trigger)
struts_type_2 = Integer(struts_type_trigger)
cell_heigh = Number(cell_height_trigger)
angle_3 = Number(angletrigger)

# ----
pln_2 = Plane(bang_4.Branch0)
num_6 = Number(bang_4.Branch1)
num_7 = Number(bang_4.Branch2)
num_8 = Number(bang_4.Branch3)
int_5 = Integer(bang_4.Branch4)
int_6 = Integer(bang_4.Branch5)
int_7 = Integer(bang_4.Branch6)

end = EndPoints(Curve=python.Struts)  # -> Start, End; disabled

reference_base_outter_circle_radius_2 = Number(reference_base_outter_circle_radius)
reference_base_inner_circle_radius_2 = Number(reference_base_inner_circle_radius)
reference_base_s_cables_length_2 = Number(reference_base_s_cables_length)
number_of_base_edges_2 = Integer(number_of_base_edges)
base_size_parameter_9 = Integer(base_size_parameter_8)
# STEP 2: Create bases
reference_curve_2 = Curve(reference_curve)
number_of_cells_5 = Integer(number_of_cells_3)
assembly_type_5 = Integer(assembly_type_3)
rotation_type_4 = Integer(rotation_type_2)
angle_4 = Number(angle_2)

pln_3 = Plane(pln)
num_9 = Number(num)
num_10 = Number(num_2)
num_11 = Number(num_3)
num_12 = Number(num_4)
num_13 = Number(num_5)
int_8 = Integer(int_4)

num_14 = Number(num_6)
num_15 = Number(num_7)
num_16 = Number(num_8)
int_9 = Integer(int_5)
int_10 = Integer(int_6)
int_11 = Integer(int_7)
pln_4 = Plane(pln_2)

# ----
# STEP 4: Visual
line_5 = Line(python.Cables)  # disabled
pt_7 = Point([end.Start, end.End])  # disabled
line_6 = Line(python.Struts)  # disabled
swatch_3 = ColourSwatch(SwatchColor=RGB(255, 0, 0))  # disabled
swatch_4 = ColourSwatch(SwatchColor=RGB(3, 173, 0))  # disabled
swatch_5 = ColourSwatch(SwatchColor=RGB(0, 64, 255))  # disabled
preview_3 = CustomPreview(Geometry=line_5, Material=cables_color)  # disabled
preview_4 = CustomPreview(Geometry=line_6, Material=struts_color)  # disabled
preview_5 = CustomPreview(Geometry=pt_7, Material=nodes_color)  # disabled

# ----
# Description: The dimension used to create polygon is the outer circle radius.
# So to have the good dimension according to the input, a conversion is made using simple trigonometry and a stream filter.
reference_base_outter_circle_radius_3 = Number(reference_base_outter_circle_radius_2)
reference_base_inner_circle_radius_3 = Number(reference_base_inner_circle_radius_2)
reference_base_s_cables_length_3 = Number(reference_base_s_cables_length_2)
number_of_base_edges_3 = Integer(number_of_base_edges_2)
base_size_parameter_10 = Integer(base_size_parameter_9)
expression = Expression(L=reference_base_s_cables_length_3, N=number_of_base_edges_3, Expression="L/(2.*sin(pi/N))")
expression_2 = Expression(R=reference_base_inner_circle_radius_3, N=number_of_base_edges_3, Expression="R/cos(pi/N)")
base_dimension_type_switch = StreamFilter(Gate=base_size_parameter_10, Stream0=reference_base_outter_circle_radius_3, Stream1=expression, Stream2=expression_2)
outer_radius = Number(base_dimension_type_switch)

# ----
# Description: Using the X, Y and Z direction of the construction plane, 3 main lines are created.
# 
# Then, using the dimension of the cube and the number of division in each direction, we create a 3D grid by displacing the main lines.
# 
# There are twice as many lines as needed.
pln_5 = Plane(pln_4)
num_17 = Number(num_14)
num_18 = Number(num_15)
num_19 = Number(num_16)
int_12 = Integer(int_9)
int_13 = Integer(int_10)
int_14 = Integer(int_11)
# STEP 2: Create struts
deplane = DeconstructPlane(Plane=pln_5)  # -> Origin, XAxis, YAxis, ZAxis
range_3 = Range(Domain=num_17, Steps=expr("2*x", int_12))
range_4 = Range(Domain=num_18, Steps=expr("2*x", int_13))
range_5 = Range(Domain=num_19, Steps=expr("2*x", int_14))
line_7 = LineSDL(Start=deplane.Origin, Direction=deplane.XAxis, Length=num_17)
line_8 = LineSDL(Start=deplane.Origin, Direction=deplane.YAxis, Length=num_18)
line_9 = LineSDL(Start=deplane.Origin, Direction=deplane.ZAxis, Length=num_19)
vec = Vector(deplane.XAxis)
vec_2 = Vector(deplane.YAxis)
vec_3 = Vector(deplane.ZAxis)
multiplication_2 = Multiplication(A=vec, B=range_3)
multiplication_3 = Multiplication(A=vec_2, B=range_4)
multiplication_4 = Multiplication(A=vec_3, B=range_5)
cull_i_2 = CullIndex(List=multiplication_2, Indices=[0, -1], Wrap=True)
cull_i_3 = CullIndex(List=multiplication_3, Indices=[0, -1], Wrap=True)
cull_i_4 = CullIndex(List=multiplication_4, Indices=[0, -1], Wrap=True)
vec_4 = Vector(cull_i_2)
vec_5 = Vector(cull_i_3)
vec_6 = Vector(cull_i_4)
move = Move(Geometry=line_7, Motion=vec_5)  # -> Geometry, Transform
move_2 = Move(Geometry=line_8, Motion=vec_4)  # -> Geometry, Transform
move_3 = Move(Geometry=line_9, Motion=vec_4)  # -> Geometry, Transform
move_4 = Move(Geometry=move.Geometry, Motion=graft(vec_6))  # -> simplify(Geometry), Transform
move_5 = Move(Geometry=move_2.Geometry, Motion=graft(vec_6))  # -> simplify(Geometry), Transform
move_6 = Move(Geometry=move_3.Geometry, Motion=graft(vec_5))  # -> simplify(Geometry), Transform

# ----
# Description: The 3 rings are created.
# They allows tho create two "cylinder". The central ring is common to the two cylinder.
num_20 = Number(num_10)
# STEP 2: Create reference circles
pln_6 = Plane(pln_3)
num_21 = Number(num_9)
num_22 = Number(num_11)
cir_2 = Circle(Plane=pln_6, Radius=num_21)
deplane_2 = DeconstructPlane(Plane=pln_6)  # -> Origin, XAxis, YAxis, ZAxis
multiplication_5 = Multiplication(A=deplane_2.ZAxis, B=num_22)
move_7 = Move(Geometry=pln_6, Motion=expr("-x/2.", multiplication_5))  # -> Geometry, Transform
move_8 = Move(Geometry=pln_6, Motion=expr("x/2.", multiplication_5))  # -> Geometry, Transform
cir_3 = Circle(Plane=move_7.Geometry, Radius=num_20)
cir_4 = Circle(Plane=move_8.Geometry, Radius=num_20)

reference_base_outter_circle_radius_m_5 = Number(reference_base_outter_circle_radius_m_3)
reference_base_inner_circle_radius_m_5 = Number(reference_base_inner_circle_radius_m_3)
reference_base_s_cables_length_m_8 = Number(reference_base_s_cables_length_m_6)
number_of_cells_in_x_direction_6 = Integer(number_of_cells_in_x_direction_4)
number_of_cells_in_y_direction_6 = Integer(number_of_cells_in_y_direction_4)
base_size_parameter_11 = Integer(base_size_parameter_6)
construction_plane_7 = Plane(construction_plane_4)
level_height_4 = Number(level_height_2)

# ----
# INFO
# SCRIPT DATA
# Tensegrity creation script
# 
# by Alexandre Flamant
# Script data
# This script allows to create geometry of tensegrity structure.
# 
# Different typology are available.
# Update log:
# - 14 March 2020
update_file_info = Button()
data = Data(update_file_info)
c_script = CSharpScript(x=data)  # -> out, A, B, C, D, E
# ---------- c_script: C# ----------
    List < IGH_DocumentObject> objectsRecursive = new List<IGH_DocumentObject>();
    objectsRecursive.AddRange(clusterObjectsRecursive(GrasshopperDocument));


    B = GrasshopperDocument.Author.Name + " " + GrasshopperDocument.Author.Email;
    D = GrasshopperDocument.Properties.DateTag;
    if(GrasshopperDocument.IsFilePathDefined){
      C = GrasshopperDocument.FilePath;
      System.IO.FileInfo info = new System.IO.FileInfo(GrasshopperDocument.FilePath);
      if(info.LastWriteTime != null){
        E = info.LastWriteTime;
      } else {
        E = "";
      }
    } else {
      C = "Unsaved Document";
      E = "";
    }
    A = objectsRecursive;
# ---------- c_script: C# additional code ----------
  List<IGH_DocumentObject> clusterObjectsRecursive(GH_Document doc){
    List<IGH_DocumentObject> objList = new List<IGH_DocumentObject>();
    objList.AddRange(doc.Objects);
    foreach(IGH_DocumentObject obj in doc.Objects){
      Grasshopper.Kernel.Special.GH_Cluster cluster = obj as Grasshopper.Kernel.Special.GH_Cluster;
      try{
        objList.AddRange(clusterObjectsRecursive(cluster.Document("")));
      } catch {

      }
    }
    return objList;
  }
# ---------- end c_script ----------
cluster = Cluster_2(T=c_script.A, N=c_script.B, fn=c_script.C, dc=c_script.D, dm=c_script.E)
# Warning
# It's worth noticing that "curved" assembly are quite imprevisible because of their multi-parametric nature (physically and mathematically speaking).
# 
# Using Kangaroo, I noticed that, with low curvature and the same angles used for corresponding prismatic cell, acceptable equilibrium is achieved (meaning low deformation using kangaroo solver and extending struts by 10% to 20%)
file_info = Panel(cluster)

# ----
# Description: The curve is divided in N segement, one for each cell.
# 
# Using the points where the division occur and the tangent at the said points, the script create a list of planes.
# 
# The planes are the aligned to prevent error is rotation angles.
number_of_cells_6 = Integer(number_of_cells_5)
reference_curve_3 = Curve(reference_curve_2)
divide = DivideCurve(Curve=reference_curve_3, Count=number_of_cells_6, Kinks=False)  # -> Points, Tangents, Parameters
create_perpendicular_planes = PlaneNormal(Origin=divide.Points, ZAxis=divide.Tangents)
reference_plane_for_alignement = ListItem(List=create_perpendicular_planes, Index=0, Wrap=True)
align_the_planes = AlignPlanes(Planes=create_perpendicular_planes, Master=reference_plane_for_alignement)
construction_planes = Plane(align_the_planes)

crv_5 = Curve(cir_2)
crv_6 = Curve(cir_3)
crv_7 = Curve(cir_4)
pln_7 = Plane(move_7.Geometry)

# ----
# Description: The second rings are rotated to make struts of the two cylinder have opposite directions ->
crv_8 = Curve(crv_6)
int_15 = Integer(int_8)
crv_9 = Curve(crv_7)
num_23 = Number(num_13)
pln_8 = Plane(pln_7)
division = Division(A=6.283185307, B=int_15)
rotate_4 = Rotate(Geometry=crv_8, Angle=expr("-x", division), Plane=pln_8)  # -> Geometry, Transform
rotate_5 = Rotate(Geometry=crv_9, Angle=expr("-x/2", division), Plane=pln_8)  # -> Geometry, Transform
rotate_6 = Rotate(Geometry=rotate_4.Geometry, Angle=expr("-x", degrees(num_23)), Plane=pln_8)  # -> Geometry, Transform
rotate_7 = Rotate(Geometry=rotate_5.Geometry, Angle=expr("-x", degrees(num_23)), Plane=pln_8)  # -> Geometry, Transform

# ----
# Description: The script allow to choose wich script is used to create bases using "node on node assembly" or "node on cable assembly".
# 
# Stream gate is used to separate data "direction".
number_of_base_edges_4 = Integer(number_of_base_edges_2)
construction_planes_2 = Plane(construction_planes)
number_of_cells_7 = Integer(number_of_cells_5)
assembly_type_6 = Integer(assembly_type_5)
outer_radius_2 = Number(outer_radius)
angle_5 = Number(angle_4)

line_10 = Line(move_4.Geometry)
line_11 = Line(move_5.Geometry)
line_12 = Line(move_6.Geometry)

# ----
# Description: As the lines are intersecting each other, which shouldn't be the case, we need to cull one in two line.
# 
# This is the reason we created twice as many lines as needed.
line_13 = Line(line_10)
line_14 = Line(line_12)
line_15 = Line(line_11)
viewer_3 = ParamViewer(line_15)
viewer_4 = ParamViewer(line_14)
viewer_5 = ParamViewer(line_13)
cull = CullPattern(List=viewer_5, CullPattern=[False, True])
cull_2 = CullPattern(List=viewer_3, CullPattern=[True, False])
cull_3 = CullPattern(List=viewer_4, CullPattern=[False, True])
branch_4 = TreeBranch(Tree=line_13, Path=cull, MaintainPaths=True)
branch_5 = TreeBranch(Tree=line_15, Path=cull_2, MaintainPaths=True)
branch_6 = TreeBranch(Tree=line_14, Path=cull_3, MaintainPaths=True)
cull_4 = CullPattern(List=branch_4, CullPattern=[True, False])
cull_5 = CullPattern(List=branch_5, CullPattern=[False, True])
cull_6 = CullPattern(List=branch_6, CullPattern=[True, False])

gate = StreamGate(Stream=construction_planes_2, Gate=assembly_type_6)  # -> Target0, Target1
gate_2 = StreamGate(Stream=outer_radius_2, Gate=assembly_type_6)  # -> Target0, Target1
gate_3 = StreamGate(Stream=number_of_base_edges_4, Gate=assembly_type_6)  # -> Target0, Target1
gate_4 = StreamGate(Stream=angle_5, Gate=assembly_type_6)  # -> Target0, Target1
gate_5 = StreamGate(Stream=number_of_cells_7, Gate=assembly_type_6)  # -> Target0, Target1

crv_10 = Curve(rotate_6.Geometry)
crv_11 = Curve(rotate_7.Geometry)

# ---- group: Number of cells
number_of_base_edges_5 = Integer(gate_3.Target0)
number_of_base_edges_6 = Integer(gate_3.Target1)
construction_planes_3 = Plane(gate.Target0)
construction_planes_4 = Plane(gate.Target1)
number_of_cells_8 = Integer(gate_5.Target0)
outer_radius_3 = Number(gate_2.Target0)
outer_radius_4 = Number(gate_2.Target1)
angle_6 = Number(gate_4.Target0)
angle_7 = Number(gate_4.Target1)
int_16 = Integer(gate_5.Target1)

# ----
crv_12 = Curve(crv_11)
crv_13 = Curve(crv_10)
crv_14 = Curve(crv_5)

line_16 = Line(cull_4)
line_17 = Line(cull_5)
line_18 = Line(cull_6)

# ----
# STEP 3 : Create struts and cables
num_24 = Number(num_4)
pln_9 = Plane(pln)
crv_15 = Curve(crv_14)
crv_16 = Curve(crv_13)
crv_17 = Curve(crv_12)
int_17 = Integer(int_4)

line_19 = Line(line_16)
line_20 = Line(line_17)
line_21 = Line(line_18)

# ----
# Description: The ring are divided to match the number of division choosed in the input.
# As the central ring is common. It is divided twice as much.
# 
# The points where the division occur in the central ring are dispatched in two list, one for each secondary circles.
# 
# Then these points are moved to create the "zigzag" effect, of withd e choosed in input,  in place of the central circle.
# 
# Enventually, theses points are linked to the ones of the other circles to create the struts.
num_25 = Number(num_24)
pln_10 = Plane(pln_9)
crv_18 = Curve(crv_15)
crv_19 = Curve(crv_16)
crv_20 = Curve(crv_17)
int_18 = Integer(int_17)
divide_2 = DivideCurve(Curve=crv_18, Count=expr("2*x", int_18), Kinks=False)  # -> Points, Tangents, Parameters
deplane_3 = DeconstructPlane(Plane=pln_10)  # -> Origin, XAxis, YAxis, ZAxis
divide_3 = DivideCurve(Curve=crv_19, Count=int_18, Kinks=False)  # -> Points, Tangents, Parameters
divide_4 = DivideCurve(Curve=crv_20, Count=int_18, Kinks=False)  # -> Points, Tangents, Parameters
dispatch = Dispatch(List=divide_2.Points, DispatchPattern=[True, False])  # -> ListA, ListB
multiplication_6 = Multiplication(A=deplane_3.ZAxis, B=num_25)
move_9 = Move(Geometry=dispatch.ListA, Motion=expr("x/2.", multiplication_6))  # -> simplify(graft(Geometry)), Transform
move_10 = Move(Geometry=dispatch.ListB, Motion=expr("-x/2.", multiplication_6))  # -> simplify(graft(Geometry)), Transform
ln = Line(StartPoint=flatten(move_9.Geometry), EndPoint=divide_3.Points)
ln_2 = Line(StartPoint=flatten(move_10.Geometry), EndPoint=divide_4.Points)

# ---- group: Rotation value
# Description: The script allows to determine rotation of each base.
# If the assembly is regular, the rotations will be a serie starting from 0° with an increment of rotation determined in the parameter. The serie contain as many rotation angles as there are bases.
# 
# If the assembly is alterned, the rotation will alternatively be 0° or the given rotation angle. The serie contain as many rotation angles as there are bases.
rotation_type_5 = Integer(rotation_type_4)
num_26 = Number([angle_6, angle_7])
pln_11 = Plane([gate.Target0, construction_planes_4])
lng_2 = ListLength(List=pln_11)
gate_6 = StreamGate(Stream=lng_2, Gate=rotation_type_5)  # -> Target0, Target1
repeat = RepeatData(Data=flatten(["0", num_26]), Length=gate_6.Target0)
series_3 = Series(Start=0, Step=num_26, Count=gate_6.Target1)
filter_5 = StreamFilter(Gate=rotation_type_5, Stream0=repeat, Stream1=series_3)
num_27 = Number(filter_5)

# ----
end_2 = EndPoints(Curve=line)  # -> Start, End; disabled

# ----
# STEP 4: Visual
line_22 = Line([line_3, line_2])  # disabled
line_23 = Line(line)  # disabled
pt_8 = Point([end_2.Start, end_2.End])  # disabled
swatch_6 = ColourSwatch(SwatchColor=RGB(255, 0, 0))  # disabled
swatch_7 = ColourSwatch(SwatchColor=RGB(3, 173, 0))  # disabled
swatch_8 = ColourSwatch(SwatchColor=RGB(0, 64, 255))  # disabled
preview_6 = CustomPreview(Geometry=line_22, Material=cables_color)  # disabled
preview_7 = CustomPreview(Geometry=line_23, Material=struts_color)  # disabled
preview_8 = CustomPreview(Geometry=pt_8, Material=nodes_color)  # disabled

# ----
# Description: The bases are created using polygons. it is created on construction planes along the curve.
# 
# For the nodes on cables assembly, the polygons have twice as many edges.
num_28 = Number(num_27)
pln_12 = Plane(construction_planes_4)
num_29 = Number(outer_radius_4)
int_19 = Integer(number_of_base_edges_6)
polygon_2 = Polygon(Plane=pln_12, Radius=num_29, Segments=expr("2*x", int_19), FilletRadius=0)  # -> Polygon, Length
rotate_8 = Rotate(Geometry=polygon_2.Polygon, Angle=degrees(num_28), Plane=pln_12)  # -> Geometry, Transform
crv_21 = Curve(rotate_8.Geometry)

pt_9 = Point(flatten([move_9.Geometry, move_10.Geometry]))
line_24 = Line(ln)
line_25 = Line(ln_2)
pt_10 = Point(divide_3.Points)
pt_11 = Point(divide_4.Points)

# ----
# Description: The bases are created using polygons. it is created on construction planes along the curve.
num_30 = Number(outer_radius_3)
num_31 = Number(num_27)
pln_13 = Plane(construction_planes_3)
int_20 = Integer(number_of_base_edges_5)
polygon_3 = Polygon(Plane=pln_13, Radius=num_30, Segments=int_20, FilletRadius=0)  # -> Polygon, Length
rotate_9 = Rotate(Geometry=polygon_3.Polygon, Angle=degrees(num_31), Plane=pln_13)  # -> Geometry, Transform
crv_22 = Curve(simplify(rotate_9.Geometry))

# ---- group: Inside cables creation
# Description: The inside cables connect start and end of struts.
# We get start and end of each struts then shift the end points list.
# Then we connect the original start points list and the shifted end points list.
line_26 = Line(line_24)
line_27 = Line(line_25)
end_3 = EndPoints(Curve=line_27)  # -> Start, End
end_4 = EndPoints(Curve=line_26)  # -> Start, End
shift_2 = ShiftList(List=end_3.End, Shift=1, Wrap=True)
shift_3 = ShiftList(List=end_4.End, Shift=1, Wrap=True)
ln_3 = Line(StartPoint=end_4.Start, EndPoint=shift_3)
ln_4 = Line(StartPoint=end_3.Start, EndPoint=shift_2)

# ---- group: Outside cables creation
# Description: This parte create the discretization of the circles.
# 
# To be efficient and visually easy to read, the lines are obtained by creating polylines and then exploding them.
pt_12 = Point(pt_9)
pt_13 = Point(pt_10)
pt_14 = Point(pt_11)
pline_3 = PolyLine(Vertices=pt_13, Closed=True)
pline_4 = PolyLine(Vertices=pt_14, Closed=True)
pline_5 = PolyLine(Vertices=flatten(pt_12), Closed=True)
explode_5 = Explode(Curve=flatten(pline_5), Recursive=True)  # -> Segments, Vertices
explode_6 = Explode(Curve=pline_3, Recursive=True)  # -> Segments, Vertices
explode_7 = Explode(Curve=pline_4, Recursive=True)  # -> Segments, Vertices

# ---- group: Inside cables creation
line_28 = Line(ln_3)
line_29 = Line(ln_4)

# ---- group: Outside cables creation
line_30 = Line(explode_5.Segments)
line_31 = Line(explode_6.Segments)
line_32 = Line(explode_7.Segments)

# ----
pt_15 = Point(pt_9)
pt_16 = Point(pt_10)
pt_17 = Point(pt_11)
line_33 = Line(line_24)
line_34 = Line(line_25)
line_35 = Line(line_28)
line_36 = Line(line_29)
line_37 = Line(line_30)
line_38 = Line(line_31)
line_39 = Line(line_32)

# ----
# STEP 3: Create struts and cables
int_21 = Integer(assembly_type_3)
crv_23 = Curve(simplify([crv_21, crv_22]))
int_22 = Integer(rotation_type_2)

# ---- group: Shifting of the edges
# Description: To create the struts, shifting of list is needed to "make" diagonals.
# 
# If the assembly is regular, the shifting will be a serie starting at 0 with an increment of 1. The serie contains as many elements as there are bases.
# 
# If the assembly is alterned, the shifting will be a list of 0 and one to create this kind of zigzag effect.
int_23 = Integer(int_22)
crv_24 = Curve(simplify(crv_23))
lng_3 = ListLength(List=crv_24)
gate_7 = StreamGate(Stream=lng_3, Gate=int_23)  # -> Target0, Target1
repeat_2 = RepeatData(Data=[0, 1], Length=gate_7.Target0)
series_4 = Series(Start=0, Step=1, Count=gate_7.Target1)
filter_6 = StreamFilter(Gate=int_23, Stream0=repeat_2, Stream1=series_4)
int_24 = Integer(filter_6)

# ----
# Description: Color swatch are available to add custom color but the custom preview components are linked to global colors (see top of script) with an hidden wire.
pt_18 = Point([pt_15, pt_16, pt_17])
# STEP 4: Visual
line_40 = Line([line_35, line_36, line_37, line_38, line_39])
line_41 = Line([line_33, line_34])
swatch_9 = ColourSwatch(SwatchColor=RGB(255, 0, 0))
swatch_10 = ColourSwatch(SwatchColor=RGB(3, 173, 0))
swatch_11 = ColourSwatch(SwatchColor=RGB(0, 64, 255))
preview_9 = CustomPreview(Geometry=line_40, Material=cables_color)
preview_10 = CustomPreview(Geometry=line_41, Material=struts_color)
preview_11 = CustomPreview(Geometry=pt_18, Material=nodes_color)

# ---- group: Node on node
# Description: If the assembly is node on node, this script is used.
# 
# The bases are ordered in trees. By getting the points of the bases, we get a tree containing N_cells branch. Each branch contains the vertices of the bases.
# 
# This tree is similar to a matrix N_cells x N_edges by flipping the matrix we get a tree similar to a matrix N_edges x N_cells.
# 
# As the bases are aligned, the points are too. So the new branch are not bases anymore but all the points at at a certain position in bases.
# 
# We use theses point to create a polyline then exploding it thus getting individual cables. This technique is both effective and visually simple.
# 
# The same thing is done for the struts but the list of bases points are shifted prior to the flipping to create the "diagonals".
int_25 = Integer(int_24)
crv_25 = Curve(simplify(crv_23))
explode_8 = Explode(Curve=crv_25, Recursive=True)  # -> Segments, Vertices
cull_i_5 = CullIndex(List=explode_8.Vertices, Indices=-1, Wrap=True)  # -> simplify(List)
shift_4 = ShiftList(List=cull_i_5, Shift=graft(int_25), Wrap=True)  # -> simplify(List)
flip_6 = FlipMatrix(Data=cull_i_5)
flip_7 = FlipMatrix(Data=shift_4)
pline_6 = PolyLine(Vertices=flip_6, Closed=False)
pline_7 = PolyLine(Vertices=flip_7, Closed=False)
explode_9 = Explode(Curve=pline_6, Recursive=True)  # -> Segments, Vertices
explode_10 = Explode(Curve=pline_7, Recursive=True)  # -> Segments, Vertices

# ---- group: Node on cable
# Description: If the assembly is node on node, this script is used.
# 
# The bases are ordered in trees. By getting the points of the bases, we get a tree containing N_cells branch. Each branch contains the vertices of the bases.
# 
# This tree is similar to a matrix N_cells x N_edges by flipping the matrix we get a tree similar to a matrix N_edges x N_cells.
# 
# As the bases are aligned, the points are too. So the new branch are not bases anymore but all the points at at a certain position in bases.
# 
# We use theses point to create a polyline then exploding it thus getting individual cables. This technique is both effective and visually simple.
# 
# The same thing is done for the struts but the list of bases points are shifted prior to the flipping to create the "diagonals".
# 
# One in two branches, one in two lines is culled. For the other branch, the other line is culled. This leads to a shifting in cells. This shifting effect is the node on cable effect.
crv_26 = Curve(crv_23)
int_26 = Integer(int_24)
lng_4 = ListLength(List=crv_26)
explode_11 = Explode(Curve=crv_26, Recursive=True)  # -> Segments, Vertices
cull_i_6 = CullIndex(List=explode_11.Vertices, Indices=-1, Wrap=True)  # -> simplify(List)
cull_i_7 = CullIndex(List=explode_11.Vertices, Indices=-1, Wrap=True)  # -> simplify(List)
shift_5 = ShiftList(List=cull_i_7, Shift=expr("2*x", graft(int_26)), Wrap=True)  # -> simplify(List)
repeat_3 = RepeatData(Data=[0, 1], Length=expr("x-1", lng_4))
flip_8 = FlipMatrix(Data=cull_i_6)
flip_9 = FlipMatrix(Data=shift_5)
pline_8 = PolyLine(Vertices=flip_8, Closed=False)
pline_9 = PolyLine(Vertices=flip_9, Closed=False)
explode_12 = Explode(Curve=pline_8, Recursive=True)  # -> Segments, Vertices
explode_13 = Explode(Curve=pline_9, Recursive=True)  # -> Segments, Vertices
flip_10 = FlipMatrix(Data=explode_12.Segments)  # -> simplify(Data)
flip_11 = FlipMatrix(Data=explode_13.Segments)  # -> simplify(Data)
shift_6 = ShiftList(List=flip_10, Shift=graft(repeat_3), Wrap=True)  # -> simplify(List)
shift_7 = ShiftList(List=flip_11, Shift=graft(repeat_3), Wrap=True)  # -> simplify(List)
cull_7 = CullPattern(List=shift_6, CullPattern=[False, True])  # -> simplify(List)
viewer_6 = ParamViewer(cull_7)
cull_8 = CullPattern(List=shift_7, CullPattern=[False, True])  # -> simplify(List)
crv_27 = Curve(simplify(graft(crv_26)))
item_5 = ListItem(List=viewer_6, Index=-1, Wrap=True)
branch_7 = TreeBranch(Tree=cull_7, Path="{0}", MaintainPaths=True)
branch_8 = TreeBranch(Tree=cull_7, Path=item_5, MaintainPaths=True)
viewer_7 = ParamViewer(crv_27)
end_5 = EndPoints(Curve=branch_7)  # -> Start, End
end_6 = EndPoints(Curve=branch_8)  # -> Start, End
cull_i_8 = CullIndex(List=viewer_7, Indices=[0, -1], Wrap=True)
pline_10 = PolyLine(Vertices=end_5.Start, Closed=True)
pline_11 = PolyLine(Vertices=end_6.End, Closed=True)
branch_9 = TreeBranch(Tree=crv_27, Path=cull_i_8, MaintainPaths=True)  # -> flatten(Branch)
crv_28 = Curve(flatten([pline_10, branch_9, pline_11]))
explode_14 = Explode(Curve=graft(crv_28), Recursive=True)  # -> simplify(Segments), Vertices
cull_i_9 = CullIndex(List=explode_14.Vertices, Indices=-1, Wrap=True)

# ---- group: Node on node
line_42 = Line(simplify(explode_8.Segments))
line_43 = Line(simplify(explode_9.Segments))
line_44 = Line(simplify(explode_10.Segments))
pt_19 = Point(cull_i_5)

# ---- group: Node on cable
line_45 = Line(cull_7)
pt_20 = Point(cull_i_9)
line_46 = Line(cull_8)
line_47 = Line(explode_14.Segments)

# ----
# Description: The final geometry is determing in function of the assembly type.
# This is done using stream filter
int_27 = Integer(int_21)
line_48 = Line(line_44)
line_49 = Line(line_46)
line_50 = Line(line_43)
line_51 = Line(line_45)
pt_21 = Point(pt_19)
line_52 = Line(line_42)
line_53 = Line(line_47)
pt_22 = Point(cull_i_9)
filter_7 = StreamFilter(Gate=int_27, Stream0=line_48, Stream1=line_49)
filter_8 = StreamFilter(Gate=int_27, Stream0=line_50, Stream1=line_51)
filter_9 = StreamFilter(Gate=int_27, Stream0=line_52, Stream1=line_53)
filter_10 = StreamFilter(Gate=int_27, Stream0=pt_21, Stream1=pt_22)

line_54 = Line(filter_8)
pt_23 = Point(filter_10)
line_55 = Line(filter_7)
line_56 = Line(filter_9)

# ----
# STEP 3: Visual
# Description: Color swatch are available to add custom color but the custom preview components are linked to global colors (see top of script) with an hidden wire.
line_57 = Line(line_55)
line_58 = Line([line_54, line_56])
pt_24 = Point(pt_23)
swatch_12 = ColourSwatch(SwatchColor=RGB(255, 0, 0))
swatch_13 = ColourSwatch(SwatchColor=RGB(0, 64, 255))
swatch_14 = ColourSwatch(SwatchColor=RGB(3, 173, 0))
preview_12 = CustomPreview(Geometry=line_57, Material=struts_color)
preview_13 = CustomPreview(Geometry=line_58, Material=cables_color)
preview_14 = CustomPreview(Geometry=pt_24, Material=nodes_color)

number_slider_22 = Slider(0, range=0..100)

reference_base_outter_circle_radius_m_6 = Number(reference_base_outter_circle_radius_m_4)
reference_base_inner_circle_radius_m_6 = Number(reference_base_inner_circle_radius_m_4)
reference_base_s_cables_length_m_9 = Number(reference_base_s_cables_length_m_7)
number_of_cells_in_x_direction_7 = Integer(number_of_cells_in_x_direction_5)
number_of_cells_in_y_direction_7 = Integer(number_of_cells_in_y_direction_5)
base_size_parameter_12 = Integer(base_size_parameter_7)
# STEP 1: Create bases
construction_plane_8 = Plane(construction_plane_5)
level_height_5 = Number(level_height_3)

# ---- group: Bottom bases
# Description: Bottom bases are made with a simple grid defined by the number of cells in x and y direction and the lenght of the side of a cell.
# 
# In function of the type of dimension given, a transformation is made.
reference_base_outter_circle_radius_m_7 = Number(reference_base_outter_circle_radius_m_6)
reference_base_inner_circle_radius_m_7 = Number(reference_base_inner_circle_radius_m_6)
reference_base_s_cables_length_m_10 = Number(reference_base_s_cables_length_m_9)
number_of_cells_in_x_direction_8 = Integer(number_of_cells_in_x_direction_7)
number_of_cells_in_y_direction_8 = Integer(number_of_cells_in_y_direction_7)
base_size_parameter_13 = Integer(base_size_parameter_12)
construction_plane_9 = Plane(construction_plane_8)

# ----
expression_3 = Expression(Rext=reference_base_outter_circle_radius_m_7, N="4", Expression="2. * Rext * sin(pi/N)")
expression_4 = Expression(Rint=reference_base_inner_circle_radius_m_7, N="4", Expression="2. * Rint * tan(pi/N)")

# ---- group: Bottom bases (continued)
filter_11 = StreamFilter(Gate=base_size_parameter_13, Stream0=expression_3, Stream1=reference_base_s_cables_length_m_10, Stream2=expression_4)
sqgrid = Square(
    Plane=construction_plane_9,
    Size=filter_11,
    ExtentX=number_of_cells_in_x_direction_8,
    ExtentY=number_of_cells_in_y_direction_8)  # -> simplify(Cells), Points
bottom_bases = Curve(sqgrid.Cells)

# ---- group: Top bases
# Description: The top bases are made by rotated each bottom bases around their centers and normals  by an angle of 45°.
# 
# Then they are scaled about their center by a factor of (2.)^(-.5).
construction_plane_10 = Plane(construction_plane_8)
bottom_bases_2 = Curve(bottom_bases)
centre_de_rotation = PolygonCenter(Polyline=bottom_bases_2)  # -> CenterV, CenterE, CenterA
deplane_4 = DeconstructPlane(Plane=construction_plane_10)  # -> Origin, XAxis, YAxis, ZAxis
pl = ConstructPlane(Origin=centre_de_rotation.CenterE, XAxis=deplane_4.XAxis, YAxis=deplane_4.YAxis)
rotate_top_bases = Rotate(Geometry=bottom_bases_2, Angle=0.7853981634, Plane=pl)  # -> Geometry, Transform
scale_top_bases = Scale(Geometry=rotate_top_bases.Geometry, Center=centre_de_rotation.CenterE, Factor=0.7071067812)  # -> simplify(Geometry), Transform
top_bases = Curve(scale_top_bases.Geometry)

# ---- group: Move top bases
# Description: Top base are move in the direction of the normal axis by a distance of the defined layer height
construction_plane_11 = Plane(construction_plane_8)
level_height_6 = Number(level_height_5)
crv_29 = Curve(top_bases)
find_the_normal_of_the_plane = DeconstructPlane(Plane=construction_plane_11)  # -> Origin, XAxis, YAxis, ZAxis
displacement_vector = Multiplication(A=find_the_normal_of_the_plane.ZAxis, B=level_height_6)
move_the_top_bases = Move(Geometry=crv_29, Motion=displacement_vector)  # -> Geometry, Transform

# ----
top_bases_2 = Curve(move_the_top_bases.Geometry)

bottom_bases_3 = Curve(bottom_bases)
top_bases_3 = Curve(top_bases_2)

# ----
# STEP 2: Create struts and cables
bottom_bases_4 = Curve(bottom_bases_3)
top_bases_4 = Curve(top_bases_3)

# ---- group: Create cables
# Description: The cables are made by linking top and bottom bases points one by one
bottom_bases_5 = Curve(bottom_bases_4)
top_bases_5 = Curve(top_bases_4)
explode_bottom_bases = Explode(Curve=bottom_bases_5, Recursive=True)  # -> Segments, Vertices
explode_top_bases = Explode(Curve=top_bases_5, Recursive=True)  # -> Segments, Vertices
remove_duplicated_points = CullIndex(List=explode_bottom_bases.Vertices, Indices=-1, Wrap=True)
remove_duplicated_points_2 = CullIndex(List=explode_top_bases.Vertices, Indices=-1, Wrap=True)
create_cables = Line(StartPoint=remove_duplicated_points, EndPoint=remove_duplicated_points_2)
cables = Line(create_cables)

# ---- group: Create struts
# Description: The struts are made by shifting point order of the bottom bases and then link the points of the bottom bases to the top bases points.
bottom_bases_6 = Curve(bottom_bases_4)
top_bases_6 = Curve(top_bases_4)
explode_bottom_bases_2 = Explode(Curve=bottom_bases_6, Recursive=True)  # -> Segments, Vertices
explode_top_bases_2 = Explode(Curve=top_bases_6, Recursive=True)  # -> Segments, Vertices
remove_duplicated_points_3 = CullIndex(List=explode_bottom_bases_2.Vertices, Indices=-1, Wrap=True)
remove_duplicated_points_4 = CullIndex(List=explode_top_bases_2.Vertices, Indices=-1, Wrap=True)
shift_the_order_of_the_points_of_the_bot = ShiftList(List=remove_duplicated_points_3, Shift=-1, Wrap=True)  # "Shift the order of the points of the bottom bases"
create_struts = Line(StartPoint=shift_the_order_of_the_points_of_the_bot, EndPoint=remove_duplicated_points_4)
struts = Line(create_struts)
# ----
# STEP 3: Create layers
cables_2 = Line(cables)
struts_2 = Line(struts)

construction_plane_12 = Plane(construction_plane_5)
number_of_layers_3 = Integer(number_of_layers_2)
bottom_bases_7 = Curve(bottom_bases_3)
top_bases_7 = Curve(top_bases_3)
level_height_7 = Number(level_height_3)
cables_3 = Line(cables_2)
struts_3 = Line(struts_2)

# ----
# STEP 2: Create bases
reference_polygon_edges_2 = Integer(reference_polygon_edges)
base_outter_circle_radius_2 = Number(base_outter_circle_radius)
construction_plane_13 = Plane(construction_plane_6)
base_edge_length_3 = Number(base_edge_length_2)
number_of_cells_9 = Integer(number_of_cells_4)
base_size_type_2 = Integer(base_size_type)
rotation_type_6 = Integer(rotation_type_3)
profile_scales = Number(profile_scale)
height_type_2 = Integer(height_type)
total_height_2 = Number(total_height)
profile_type_2 = Integer(profile_type)
cell_heigh_2 = Number(cell_heigh)
angle_8 = Number(angle_3)

# ---- group: Construction plane charactreristics
construction_plane_14 = Plane(construction_plane_13)
deplane_5 = DeconstructPlane(Plane=construction_plane_14)  # -> Origin, XAxis, YAxis, ZAxis
construction_plane_normal = Vector(deplane_5.ZAxis)
origin_of_assembly = Point(deplane_5.Origin)

# ----
base_edge_length_4 = Number(base_edge_length)

# ---- group: Bottom bases
reference_base_outter_circle_radius_m_8 = Number(reference_base_outter_circle_radius_m_5)
reference_base_inner_circle_radius_m_8 = Number(reference_base_inner_circle_radius_m_5)
reference_base_s_cables_length_m_11 = Number(reference_base_s_cables_length_m_8)
number_of_cells_in_x_direction_9 = Integer(number_of_cells_in_x_direction_6)
number_of_cells_in_y_direction_9 = Integer(number_of_cells_in_y_direction_6)
base_size_parameter_14 = Integer(base_size_parameter_11)
# STEP 1: Create bases
construction_plane_15 = Plane(construction_plane_7)

# ----
expression_5 = Expression(Rext=reference_base_outter_circle_radius_m_8, N="4", Expression="2. * Rext * sin(pi/N)")
expression_6 = Expression(Rint=reference_base_inner_circle_radius_m_8, N="4", Expression="2. * Rint * tan(pi/N)")

# ---- group: Bottom bases (continued)
filter_12 = StreamFilter(Gate=base_size_parameter_14, Stream0=expression_5, Stream1=reference_base_s_cables_length_m_11, Stream2=expression_6)
sqgrid_2 = Square(
    Plane=construction_plane_15,
    Size=filter_12,
    ExtentX=number_of_cells_in_x_direction_9,
    ExtentY=number_of_cells_in_y_direction_9)  # -> simplify(Cells), Points
bottom_bases_8 = Curve(sqgrid_2.Cells)

# ---- group: Top bases
# Description: The top bases are made by rotated each bottom bases around their centers and normals  by an angle of 45°.
# 
# Then they are scaled about their center by a factor of (2.)^(-.5).
construction_plane_16 = Plane(construction_plane_7)
bottom_bases_9 = Curve(bottom_bases_8)
centre_de_rotation_2 = PolygonCenter(Polyline=bottom_bases_9)  # -> CenterV, CenterE, CenterA
deplane_6 = DeconstructPlane(Plane=construction_plane_16)  # -> Origin, XAxis, YAxis, ZAxis
pl_2 = ConstructPlane(Origin=centre_de_rotation_2.CenterE, XAxis=deplane_6.XAxis, YAxis=deplane_6.YAxis)
rotate_top_bases_2 = Rotate(Geometry=bottom_bases_9, Angle=0.7853981634, Plane=pl_2)  # -> Geometry, Transform
scale_top_bases_2 = Scale(Geometry=rotate_top_bases_2.Geometry, Center=centre_de_rotation_2.CenterE, Factor=0.7071067812)  # -> simplify(Geometry), Transform
top_bases_8 = Curve(scale_top_bases_2.Geometry)

# ---- group: Move top bases
# Description: Top base are move in the direction of the normal axis by a distance of the defined layer height
construction_plane_17 = Plane(construction_plane_7)
level_height_8 = Number(level_height_4)
crv_30 = Curve(top_bases_8)
find_the_normal_of_the_plane_2 = DeconstructPlane(Plane=construction_plane_17)  # -> Origin, XAxis, YAxis, ZAxis
displacement_vector_2 = Multiplication(A=find_the_normal_of_the_plane_2.ZAxis, B=level_height_8)
move_the_top_bases_2 = Move(Geometry=crv_30, Motion=displacement_vector_2)  # -> Geometry, Transform
top_bases_9 = Curve(move_the_top_bases_2.Geometry)

# ---- group: Displacement vector creation
# Description: The normal vector to the construction plane is multiply by scales.
# 
# The scales are items of an arithmetic sequence.
# 
# If assembly is defined by total height then the sequence difference is the total height divided by the number of cells
# If assembly is defined by cells heigth then the sequence difference is the cells height.
construction_plane_normal_2 = Vector(construction_plane_normal)
reference_polygon_edges_3 = Integer(reference_polygon_edges_2)
number_of_cells_10 = Integer(number_of_cells_9)
height_type_3 = Integer(height_type_2)
total_height_3 = Number(total_height_2)
cell_heigh_3 = Number(cell_heigh_2)
angle_9 = Number(angle_8)
rad = Radians(Degrees=angle_9)
cells_height_with_total_height = Division(A=total_height_3, B=number_of_cells_10)
series_for_bases_displacements = Series(Start=0, Step=1, Count=expr("x+1", number_of_cells_10))

# ---- group: Bases displacement
# Description: Reference base is created with polygon tools. The radius of the polygon is choosed in function of the type of dimension.
# 
# If the option is set to cables length, the length of the polygon's edges are used to find the radius of the outer circle of the polygon.
# 
# If the outer radius option is set, it is directely used.
reference_polygon_edges_4 = Integer(reference_polygon_edges_2)
base_outcircle_radius = Number(base_outter_circle_radius_2)
construction_plane_18 = Plane(construction_plane_13)
base_edge_length_5 = Number(base_edge_length_3)
base_size_type_3 = Integer(base_size_type_2)
inner_radius = Number(base_edge_length_4)

# ----
expression_7 = Expression(L=base_edge_length_5, N=reference_polygon_edges_4, Expression="L/(2.*sin(pi/N))")
expression_8 = Expression(R=inner_radius, N=reference_polygon_edges_4, Expression="R/cos(pi/N)")

line_59 = Line(line_19)
line_60 = Line(line_20)
line_61 = Line(line_21)

# ----
# STEP 3: Create cables
line_62 = Line(line_59)
line_63 = Line(line_60)
line_64 = Line(line_61)
flip_12 = FlipMatrix(Data=line_62)
flip_13 = FlipMatrix(Data=line_63)
flip_14 = FlipMatrix(Data=line_64)
end_7 = EndPoints(Curve=flip_12)  # -> Start, End
end_8 = EndPoints(Curve=flip_13)  # -> Start, End
end_9 = EndPoints(Curve=flip_14)  # -> Start, End
pline_12 = PolyLine(Vertices=end_7.Start, Closed=False)
pline_13 = PolyLine(Vertices=end_7.End, Closed=False)
pline_14 = PolyLine(Vertices=end_8.Start, Closed=False)
pline_15 = PolyLine(Vertices=end_8.End, Closed=False)
pline_16 = PolyLine(Vertices=end_9.Start, Closed=False)
pline_17 = PolyLine(Vertices=end_9.End, Closed=False)
explode_15 = Explode(Curve=pline_12, Recursive=True)  # -> Segments, Vertices
explode_16 = Explode(Curve=pline_13, Recursive=True)  # -> Segments, Vertices
explode_17 = Explode(Curve=pline_14, Recursive=True)  # -> Segments, Vertices
explode_18 = Explode(Curve=pline_15, Recursive=True)  # -> Segments, Vertices
explode_19 = Explode(Curve=pline_16, Recursive=True)  # -> Segments, Vertices
explode_20 = Explode(Curve=pline_17, Recursive=True)  # -> Segments, Vertices

line_65 = Line(line_59)
line_66 = Line(line_60)
line_67 = Line(line_61)
end_10 = EndPoints(Curve=line_65)  # -> Start, End
end_11 = EndPoints(Curve=line_66)  # -> Start, End
end_12 = EndPoints(Curve=line_67)  # -> Start, End
pline_18 = PolyLine(Vertices=end_10.Start, Closed=False)
pline_19 = PolyLine(Vertices=end_10.End, Closed=False)
pline_20 = PolyLine(Vertices=end_11.Start, Closed=False)
pline_21 = PolyLine(Vertices=end_11.End, Closed=False)
pline_22 = PolyLine(Vertices=end_12.Start, Closed=False)
pline_23 = PolyLine(Vertices=end_12.End, Closed=False)
explode_21 = Explode(Curve=pline_18, Recursive=True)  # -> Segments, Vertices
explode_22 = Explode(Curve=pline_19, Recursive=True)  # -> Segments, Vertices
explode_23 = Explode(Curve=pline_20, Recursive=True)  # -> Segments, Vertices
explode_24 = Explode(Curve=pline_21, Recursive=True)  # -> Segments, Vertices
explode_25 = Explode(Curve=pline_22, Recursive=True)  # -> Segments, Vertices
explode_26 = Explode(Curve=pline_23, Recursive=True)  # -> Segments, Vertices

line_68 = Line(line_59)
line_69 = Line(line_60)
item_6 = ListItem(List=line_68, Index=[0, -1], Wrap=True)
item_7 = ListItem(List=line_69, Index=[0, -1], Wrap=True)
flip_15 = FlipMatrix(Data=item_6)
flip_16 = FlipMatrix(Data=item_7)
bang_5 = ExplodeTree(Data=flip_15)  # -> Branch0, Branch1
bang_6 = ExplodeTree(Data=flip_16)  # -> Branch0, Branch1
end_13 = EndPoints(Curve=bang_5.Branch0)  # -> Start, End
end_14 = EndPoints(Curve=bang_5.Branch1)  # -> Start, End
end_15 = EndPoints(Curve=bang_6.Branch0)  # -> Start, End
end_16 = EndPoints(Curve=bang_6.Branch1)  # -> Start, End
weave = Weave(Pattern=[0, 1], Stream0=end_15.Start, Stream1=end_13.Start, NullGaps=False)
weave_2 = Weave(Pattern=[0, 1], Stream0=end_15.End, Stream1=end_14.Start, NullGaps=False)
weave_3 = Weave(Pattern=[0, 1], Stream0=end_16.Start, Stream1=end_13.End, NullGaps=False)
weave_4 = Weave(Pattern=[0, 1], Stream0=end_16.End, Stream1=end_14.End, NullGaps=False)
pline_24 = PolyLine(Vertices=weave, Closed=False)
pline_25 = PolyLine(Vertices=weave_2, Closed=False)
pline_26 = PolyLine(Vertices=weave_3, Closed=False)
pline_27 = PolyLine(Vertices=weave_4, Closed=False)
explode_27 = Explode(Curve=pline_24, Recursive=True)  # -> Segments, Vertices
explode_28 = Explode(Curve=pline_25, Recursive=True)  # -> Segments, Vertices
explode_29 = Explode(Curve=pline_26, Recursive=True)  # -> Segments, Vertices
explode_30 = Explode(Curve=pline_27, Recursive=True)  # -> Segments, Vertices

line_70 = Line(explode_15.Segments)
line_71 = Line(explode_16.Segments)
line_72 = Line(explode_17.Segments)
line_73 = Line(explode_18.Segments)
line_74 = Line(explode_19.Segments)
line_75 = Line(explode_20.Segments)

line_76 = Line(explode_21.Segments)
line_77 = Line(explode_22.Segments)
line_78 = Line(explode_24.Segments)
line_79 = Line(explode_25.Segments)
line_80 = Line(explode_26.Segments)
line_81 = Line(explode_23.Segments)

line_82 = Line(explode_29.Segments)
line_83 = Line(explode_30.Segments)
line_84 = Line(explode_27.Segments)
line_85 = Line(explode_28.Segments)

line_86 = Line(line_59)
line_87 = Line(line_60)
line_88 = Line(line_61)

line_89 = Line(flatten([line_70, line_71, line_72, line_73, line_74, line_75]))
line_90 = Line(flatten([line_76, line_77, line_81, line_78, line_79, line_80]))
line_91 = Line(flatten([line_84, line_85, line_82, line_83]))
end_17 = EndPoints(Curve=flatten([line_86, line_87, line_88]))  # -> graft(Start), graft(End)

# ---- group: Bases displacement (continued)
base_dimension_type_switch_2 = StreamFilter(Gate=base_size_type_3, Stream0=base_outcircle_radius, Stream1=expression_7, Stream2=expression_8)
reference_base_polygon = Polygon(Plane=construction_plane_18, Radius=base_dimension_type_switch_2, Segments=reference_polygon_edges_4, FilletRadius=0)  # -> Polygon, Length
explode_31 = Explode(Curve=reference_base_polygon.Polygon, Recursive=True)  # -> Segments, Vertices
item_8 = ListItem(List=explode_31.Segments, Index=0, Wrap=True)
angle_10 = Angle(VectorA=item_8, VectorB=Vector(0, 1, 0), Plane=construction_plane_18)  # -> Angle, Reflex
angle_11 = Angle(VectorA=item_8, VectorB=Vector(0, 0, 1), Plane=construction_plane_18)  # -> Angle, Reflex
angle_12 = Angle(VectorA=item_8, VectorB=Vector(1, 0, 0), Plane=construction_plane_18)  # -> Angle, Reflex
combine = CombineData(Input0=angle_12.Angle, Input1=angle_10.Angle, Input2=angle_11.Angle)  # -> Result, Index
rotate_10 = Rotate(Geometry=reference_base_polygon.Polygon, Angle=combine.Result, Plane=construction_plane_18)  # -> Geometry, Transform
radius = Number(base_dimension_type_switch_2)

# ----
expression_9 = Expression(
    R=base_dimension_type_switch_2,
    A=rad,
    N=reference_polygon_edges_3,
    Expression="sqrt(abs((2*R*sin(pi/N))^2-(2*R^2*(1-cos(A)))))")

# ---- group: Displacement vector creation (continued)
cell_height_switch = StreamFilter(Gate=height_type_3, Stream0=cell_heigh_3, Stream1=cells_height_with_total_height, Stream2=expression_9)
discplaement_vector_scale_factor = Multiplication(A=cell_height_switch, B=series_for_bases_displacements)
scaling_plane_normal = Multiplication(A=construction_plane_normal_2, B=discplaement_vector_scale_factor)
displacements_vectors = Vector(scaling_plane_normal)

# ---- group: Bases displacement (continued)
displacements_vectors_2 = Vector(displacements_vectors)
displace_bases = Move(Geometry=reference_base_polygon.Polygon, Motion=displacements_vectors_2)  # -> Geometry, Transform
reference_bases = Curve(displace_bases.Geometry)

# ----
transform = Transform(rotate_10.Transform)

# ---- group: Rotate the bases
# Description: Bases are rotated within the construction plane.
# The rotation angles are determined via the type of assembly.
# 
# If the assembly is regular the angles are an arithmetic sequence with the relative rotation angle as difference.
# If the assembly is alterned the angles are alternatively 0° and the relative rotation angle.
construction_plane_19 = Plane(construction_plane_13)
reference_bases_2 = Curve(reference_bases)
number_of_cells_11 = Integer(number_of_cells_9)
rotation_type_7 = Integer(rotation_type_6)
angle_13 = Number(angle_8)
series_for_bases_rotations = Series(Start=0, Step=1, Count=expr("x+1", number_of_cells_11))
alterned_angle_list = GhPythonScript(A=angle_13, N=series_for_bases_rotations)  # -> A
# ---------- alterned_angle_list: Python ----------
"""Create rotation list for alterned assembly
    Inputs:
        A: The angle of relative rotation in degrees
        N: List containing cells number starting from0
    Outputs:
        A: List of rotations angle made of the angle of relative rotation and 0."""

from ghpythonlib.componentbase import executingcomponent as component
import Grasshopper, GhPython
import System
import Rhino
import rhinoscriptsyntax as rs

class MyComponent(component):
    
    def RunScript(self, Angle, N):
        if Angle is None: Angle == 0.
        if N is None: return None
        if N%2: return Angle
        else: return 0.
# ---------- end alterned_angle_list ----------
rotation_addition = Multiplication(A=angle_13, B=series_for_bases_rotations)
rotation_type_switch = StreamFilter(Gate=rotation_type_7, Stream0=alterned_angle_list, Stream1=rotation_addition)
rotate_bases = Rotate(Geometry=reference_bases_2, Angle=degrees(rotation_type_switch), Plane=construction_plane_19)  # -> Geometry, Transform
rotated_bases = Curve(rotate_bases.Geometry)
angles = Number(rotation_type_switch)

# ---- group: Scaling the bases
# Description: Bases are scaled around their centroid.
# 
# If the profile type is set to linear bases are not scaled.
# If the profile type is set to custom scales are determinded using the graph tool in the control panel
rotated_bases_2 = Curve(rotated_bases)
profile_scale_2 = Number(profile_scales)
profile_type_3 = Integer(profile_type_2)
bases_centers = PolygonCenter(Polyline=rotated_bases_2)  # -> CenterV, CenterE, CenterA
scale_bases = Scale(Geometry=rotated_bases_2, Center=bases_centers.CenterA, Factor=profile_scale_2)  # -> Geometry, Transform
profile_type_switch = StreamFilter(Gate=profile_type_3, Stream0=rotated_bases_2, Stream1=scale_bases.Geometry)
scaled_bases = Curve(profile_type_switch)

# ----
displacements_vectors_3 = Vector(displacements_vectors)
bases = Curve(scaled_bases)

transform_2 = Transform(transform)
angles_2 = Number(rotation_type_switch)
radius_2 = Number(radius)

# ----
# STEP 3: Create struts and cables
bases_2 = Curve(bases)
number_of_cells_12 = Integer(number_of_cells_4)
rotation_type_8 = Integer(rotation_type_3)

# ---- group: Create cables and struts
number_of_cells_13 = Integer(number_of_cells_12)
rotation_type_9 = Integer(rotation_type_8)
bases_3 = Curve(bases_2)
explode_bases = Explode(Curve=bases_3, Recursive=True)  # -> Segments, simplify(Vertices)
cull_i_10 = CullIndex(List=explode_bases.Vertices, Indices=-1, Wrap=True)
series_5 = Series(Start=0, Step=1, Count=expr("x+1", number_of_cells_13))
repeat_4 = RepeatData(Data=[0, 1], Length=expr("X+1", number_of_cells_13))  # -> simplify(graft(Data))
filter_13 = StreamFilter(Gate=rotation_type_9, Stream0=repeat_4, Stream1=series_5)
shift_8 = ShiftList(List=cull_i_10, Shift=graft(filter_13), Wrap=True)
flip_17 = FlipMatrix(Data=cull_i_10)
flip_18 = FlipMatrix(Data=shift_8)
pline_28 = PolyLine(Vertices=flip_17, Closed=False)
pline_29 = PolyLine(Vertices=flip_18, Closed=False)
explode_32 = Explode(Curve=pline_28, Recursive=True)  # -> Segments, Vertices
explode_33 = Explode(Curve=pline_29, Recursive=True)  # -> Segments, Vertices
flip_19 = FlipMatrix(Data=explode_32.Segments)  # -> simplify(Data)
flip_20 = FlipMatrix(Data=explode_33.Segments)  # -> simplify(Data)
bases_cables = Line(explode_bases.Segments)
nodes = Point(cull_i_10)
cables_4 = Line(flip_19)
struts_4 = Line(flip_20)

# ----
bases_cables_2 = Line(bases_cables)
nodes_2 = Point(nodes)
cables_5 = Line(cables_4)
struts_5 = Line(struts_4)

# ----
# STEP 4: Node on cable assembly creation
# This script allows to modify the
# rotation angles of the last base.
# As is the number of cells is pair,
# it will not be aligned correctly.
reference_polygon_edges_5 = Integer(reference_polygon_edges)
displacements_vectors_4 = Vector(displacements_vectors_3)
construction_plane_20 = Plane(construction_plane_6)
assembly_type_7 = Integer(assembly_type_4)
bases_cables_3 = Line(bases_cables_2)
profile_scale_3 = Number(profile_scale)
profile_type_4 = Integer(profile_type)
nodes_3 = Point(nodes_2)
angles_3 = Number(angles_2)
cables_6 = Line(cables_5)
struts_6 = Line(struts_5)
radius_3 = Number(radius_2)

# ---- group: Node on cables calculation
# Description
# The switch is set to avoid useless calcultation
angles_switch = StreamFilter(Gate=assembly_type_7, Stream1=angles_3)
displacements_vectors_switch = StreamFilter(Gate=assembly_type_7, Stream1=displacements_vectors_4)
cables_switch = StreamFilter(Gate=assembly_type_7, Stream1=cables_6)
construction_plane_switch = StreamFilter(Gate=assembly_type_7, Stream1=construction_plane_20)
struts_switch = StreamFilter(Gate=assembly_type_7, Stream1=struts_6)
radius_switch = StreamFilter(Gate=assembly_type_7, Stream1=radius_3)
reference_polygon_edges_switch = StreamFilter(Gate=assembly_type_7, Stream1=reference_polygon_edges_5)
reference_polygon_edges_switch_2 = StreamFilter(Gate=assembly_type_7, Stream1=profile_type_4)
reference_polygon_edges_switch_3 = StreamFilter(Gate=assembly_type_7, Stream1=profile_scale_3)
reference_polygon_edges_6 = Integer(reference_polygon_edges_switch)
displacements_vectors_5 = Vector(displacements_vectors_switch)
construction_plane_21 = Plane(construction_plane_switch)
profile_scale_4 = Number(reference_polygon_edges_switch_3)
profile_type_5 = Integer(reference_polygon_edges_switch_2)
angles_4 = Number(angles_switch)
cables_7 = Line(cables_switch)
struts_7 = Line(struts_switch)
radius_4 = Number(radius_switch)

# ---- group: Node on cable bases creation
# Description: If assembly is node on cable. Bases are recreated the first and last base have the same number of edges while the other have twice as much.
# 
# Then all the bases are rotated accorded to the type of relative rotation (regular or alterned.
reference_polygon_edges_7 = Integer(reference_polygon_edges_6)
displacements_vectors_6 = Vector(displacements_vectors_5)
construction_plane_22 = Plane(construction_plane_21)
angles_5 = Number(angles_4)
radius_5 = Number(radius_4)
polygon_4 = Polygon(Plane=construction_plane_22, Radius=radius_5, Segments=expr("2*x", reference_polygon_edges_7), FilletRadius=0)  # -> Polygon, Length
polygon_5 = Polygon(Plane=construction_plane_22, Radius=radius_5, Segments=reference_polygon_edges_7, FilletRadius=0)  # -> Polygon, Length
item_9 = ListItem(List=displacements_vectors_6, Index=[0, -1], Wrap=True)
move_11 = Move(Geometry=polygon_4.Polygon, Motion=displacements_vectors_6)  # -> Geometry, Transform
move_12 = Move(Geometry=polygon_5.Polygon, Motion=item_9)  # -> Geometry, Transform
lng_5 = ListLength(List=move_11.Geometry)  # -> expr("x-1", Length)
replace_2 = ReplaceItems(List=move_11.Geometry, Item=move_12.Geometry, Indices=flatten(["0", lng_5]), Wrap=False)
define_rotation_angle = GhPythonScript(A=angles_5, N=reference_polygon_edges_7)  # -> A; inputs A: list
# ---------- define_rotation_angle: Python ----------
"""Modify the last rotation angle if the
number of base is not pair as the last
base won't be aligned.
    Inputs:
        A: initial rotation angles
        N: Number of side of the reference polygon
    Outputs:
        A: Corrected rotation angles"""

from ghpythonlib.componentbase import executingcomponent as component
import Grasshopper, GhPython
import System
import Rhino
import rhinoscriptsyntax as rs
from  math import pi, degrees

class MyComponent(component):
    
    def RunScript(self, angles,n):
        if len(angles) == 0 or n is None: return None
        if len(angles)%2 : angles[-1] = angles[-1] + degrees(pi/n)
        return angles
# ---------- end define_rotation_angle ----------
rotate_bases_2 = Rotate(Geometry=replace_2, Angle=degrees(define_rotation_angle), Plane=construction_plane_22)  # -> Geometry, Transform
rotated_bases_3 = Curve(rotate_bases_2.Geometry)

# ---- group: struts and cables creation
# Description: Node on node lines are reused. One in two cells, cables and struts are duplicated and rotated with an angle of pi/#Bases Edges to align with the new bases.
# 
# The initials struts and cables are then combined with the new ones.
# Using param viewer
# allows to select braches
# Devides cells lines in twos to
# rotate one of two cells lines
reference_polygon_edges_8 = Integer(reference_polygon_edges_6)
construction_plane_23 = Plane(construction_plane_21)
struts_8 = Line(struts_7)
cables_8 = Line(cables_7)
viewer_8 = ParamViewer(cables_8)
viewer_9 = ParamViewer(struts_8)
cull_9 = CullPattern(List=viewer_8, CullPattern=[True, False])
cull_10 = CullPattern(List=viewer_8, CullPattern=[False, True])
cull_11 = CullPattern(List=viewer_9, CullPattern=[True, False])
cull_12 = CullPattern(List=viewer_9, CullPattern=[False, True])
expression_10 = Expression(N=reference_polygon_edges_8, Expression="pi/N")
branch_10 = TreeBranch(Tree=cables_8, Path=cull_9, MaintainPaths=True)
branch_11 = TreeBranch(Tree=cables_8, Path=cull_10, MaintainPaths=True)
branch_12 = TreeBranch(Tree=struts_8, Path=cull_11, MaintainPaths=True)
branch_13 = TreeBranch(Tree=struts_8, Path=cull_12, MaintainPaths=True)
rotate_11 = Rotate(Geometry=branch_11, Angle=expression_10, Plane=construction_plane_23)  # -> simplify(Geometry), Transform
rotate_12 = Rotate(Geometry=branch_13, Angle=expression_10, Plane=construction_plane_23)  # -> simplify(Geometry), Transform

cables_9 = Line([branch_10, rotate_11.Geometry])
struts_9 = Line([branch_12, rotate_12.Geometry])

# ---- group: Scaling the bases
rotated_bases_4 = Curve(rotated_bases_3)
profile_scale_5 = Number(profile_scale_4)
profile_type_6 = Integer(profile_type_5)
bases_centers_2 = PolygonCenter(Polyline=rotated_bases_4)  # -> CenterV, CenterE, CenterA
scale_bases_2 = Scale(Geometry=rotated_bases_4, Center=bases_centers_2.CenterA, Factor=profile_scale_5)  # -> Geometry, Transform
profile_type_switch_2 = StreamFilter(Gate=profile_type_6, Stream0=rotated_bases_4, Stream1=scale_bases_2.Geometry)
scaled_bases_2 = Curve(profile_type_switch_2)
explode_34 = Explode(Curve=scaled_bases_2, Recursive=True)  # -> Segments, Vertices

nodes_4 = Point(explode_34.Vertices)
bases_cables_4 = Line(explode_34.Segments)

# ---- group: Final output switcher
# Description: Output is choose wheter the assembly is node on cable or node on node.
assembly_type_8 = Integer(assembly_type_7)
bases_cables_5 = Line(bases_cables_3)
bases_cables_6 = Line(bases_cables_4)
nodes_5 = Point(nodes_3)
nodes_6 = Point(nodes_4)
cables_10 = Line(cables_6)
cables_11 = Line(cables_9)
struts_10 = Line(struts_6)
struts_11 = Line(struts_9)

# ---- group: Final output switcher / Assembly type switcher
nodes_switch = StreamFilter(Gate=assembly_type_8, Stream0=nodes_5, Stream1=nodes_6)
bases_cables_switch = StreamFilter(Gate=assembly_type_8, Stream0=bases_cables_5, Stream1=bases_cables_6)
cables_switch_2 = StreamFilter(Gate=assembly_type_8, Stream0=cables_10, Stream1=cables_11)
struts_switch_2 = StreamFilter(Gate=assembly_type_8, Stream0=struts_10, Stream1=struts_11)

# ---- group: Final output switcher
base_cables = Line(bases_cables_switch)
nodes_7 = Point(nodes_switch)
cables_12 = Line(cables_switch_2)
struts_12 = Line(struts_switch_2)

# ----
angle_14 = Number(expr("-x/2", angle_3))
transform_3 = Transform(transform_2)
transform_4 = Transform(Geometry=nodes_7, Transform=transform_3)
transform_5 = Transform(Geometry=base_cables, Transform=transform_3)
transform_6 = Transform(Geometry=cables_12, Transform=transform_3)
transform_7 = Transform(Geometry=struts_12, Transform=transform_3)
rotate_13 = Rotate(Geometry=transform_4, Angle=degrees(number_slider_22), Plane=construction_plane_20)  # -> Geometry, Transform
rotate_14 = Rotate(Geometry=transform_5, Angle=degrees(number_slider_22), Plane=construction_plane_20)  # -> Geometry, Transform
rotate_15 = Rotate(Geometry=transform_6, Angle=degrees(number_slider_22), Plane=construction_plane_20)  # -> Geometry, Transform
rotate_16 = Rotate(Geometry=transform_7, Angle=degrees(number_slider_22), Plane=construction_plane_20)  # -> Geometry, Transform

base_cables_2 = Line(rotate_14.Geometry)
nodes_8 = Point(rotate_13.Geometry)
cables_13 = Line(rotate_15.Geometry)
struts_13 = Line(rotate_16.Geometry)

line_92 = Line(line_61)
line_93 = Line(simplify(line_59))
line_94 = Line(simplify(line_60))
flip_21 = FlipMatrix(Data=line_92)
item_10 = ListItem(List=line_92, Index=[0, -1], Wrap=True)
viewer_10 = ParamViewer(line_93)
viewer_11 = ParamViewer(line_94)
item_11 = ListItem(List=flip_21, Index=[0, -1], Wrap=True)
item_12 = ListItem(List=viewer_10, Index=[0, -1], Wrap=True)
item_13 = ListItem(List=viewer_11, Index=[0, -1], Wrap=True)
lng_6 = ListLength(List=viewer_10)
flip_22 = FlipMatrix(Data=item_10)
flip_23 = FlipMatrix(Data=item_11)
equals = Equality(FirstNumber=1, SecondNumber=lng_6)  # -> Equality, Inequality
branch_14 = TreeBranch(Tree=line_93, Path=item_12, MaintainPaths=True)
branch_15 = TreeBranch(Tree=line_94, Path=item_13, MaintainPaths=True)
filter_14 = StreamFilter(Gate=equals.Inequality, Stream0=line_93, Stream1=branch_14)
bang_7 = ExplodeTree(Data=flip_22)  # -> Branch0, Branch1
bang_8 = ExplodeTree(Data=flip_23)  # -> Branch0, Branch1
bang_9 = ExplodeTree(Data=filter_14)  # -> Branch0, Branch1
bang_10 = ExplodeTree(Data=branch_15)  # -> Branch0, Branch1
end_18 = EndPoints(Curve=bang_7.Branch0)  # -> Start, End
end_19 = EndPoints(Curve=bang_7.Branch1)  # -> Start, End
end_20 = EndPoints(Curve=bang_8.Branch0)  # -> Start, End
end_21 = EndPoints(Curve=bang_8.Branch1)  # -> Start, End
end_22 = EndPoints(Curve=bang_9.Branch0)  # -> Start, End
end_23 = EndPoints(Curve=bang_10.Branch0)  # -> Start, End
end_24 = EndPoints(Curve=bang_10.Branch1)  # -> Start, End
weave_5 = Weave(Pattern=[0, 1], Stream0=end_22.Start, Stream1=end_18.Start, NullGaps=False)
weave_6 = Weave(Pattern=[0, 1], Stream0=end_22.End, Stream1=end_19.Start, NullGaps=False)
weave_7 = Weave(Pattern=[0, 1], Stream0=end_20.Start, Stream1=end_23.Start, NullGaps=False)
weave_8 = Weave(Pattern=[0, 1], Stream0=end_21.Start, Stream1=end_23.End, NullGaps=False)
weave_9 = Weave(Pattern=[0, 1], Stream0=end_20.End, Stream1=end_24.Start, NullGaps=False)
weave_10 = Weave(Pattern=[0, 1], Stream0=end_21.End, Stream1=end_24.End, NullGaps=False)
pline_30 = PolyLine(Vertices=weave_5, Closed=False)
pline_31 = PolyLine(Vertices=weave_6, Closed=False)
pline_32 = PolyLine(Vertices=weave_7, Closed=False)
pline_33 = PolyLine(Vertices=weave_8, Closed=False)
pline_34 = PolyLine(Vertices=weave_9, Closed=False)
pline_35 = PolyLine(Vertices=weave_10, Closed=False)
explode_35 = Explode(Curve=pline_30, Recursive=True)  # -> Segments, Vertices
explode_36 = Explode(Curve=pline_31, Recursive=True)  # -> Segments, Vertices
explode_37 = Explode(Curve=pline_32, Recursive=True)  # -> Segments, Vertices
explode_38 = Explode(Curve=pline_33, Recursive=True)  # -> Segments, Vertices
explode_39 = Explode(Curve=pline_34, Recursive=True)  # -> Segments, Vertices
explode_40 = Explode(Curve=pline_35, Recursive=True)  # -> Segments, Vertices

combine_2 = CombineData(Input0=bang_9.Branch1, Input1=bang_9.Branch0)  # -> Result, Index

end_25 = EndPoints(Curve=combine_2.Result)  # -> Start, End
weave_11 = Weave(Pattern=[0, 1], Stream0=end_25.Start, Stream1=end_18.End, NullGaps=False)
weave_12 = Weave(Pattern=[0, 1], Stream0=end_25.End, Stream1=end_19.End, NullGaps=False)
pline_36 = PolyLine(Vertices=weave_11, Closed=False)
pline_37 = PolyLine(Vertices=weave_12, Closed=False)
explode_41 = Explode(Curve=pline_36, Recursive=True)  # -> Segments, Vertices
explode_42 = Explode(Curve=pline_37, Recursive=True)  # -> Segments, Vertices

line_95 = Line(explode_41.Segments)
line_96 = Line(explode_35.Segments)
line_97 = Line(explode_36.Segments)
line_98 = Line(explode_42.Segments)
line_99 = Line(explode_37.Segments)
line_100 = Line(explode_39.Segments)
line_101 = Line(explode_40.Segments)
line_102 = Line(explode_38.Segments)

line_103 = Line(flatten([line_95, line_98, line_100, line_101]))
line_104 = Line(flatten([line_96, line_97, line_99, line_102]))

line_105 = Line(flatten([line_86, line_87, line_88]))
line_106 = Line(flatten([line_89, line_90, line_91, line_103, line_104]))
pt_25 = Point([end_17.Start, end_17.End])

# ----
# STEP 4: Visual
# Description: Color swatch are available to add custom color but the custom preview components are linked to global colors (see top of script) with an hidden wire.
line_107 = Line(line_106)
line_108 = Line(line_105)
pt_26 = Point(pt_25)
swatch_15 = ColourSwatch(SwatchColor=RGB(255, 0, 0))
swatch_16 = ColourSwatch(SwatchColor=RGB(3, 173, 0))
swatch_17 = ColourSwatch(SwatchColor=RGB(0, 64, 255))
preview_15 = CustomPreview(Geometry=line_107, Material=cables_color)
preview_16 = CustomPreview(Geometry=line_108, Material=struts_color)
preview_17 = CustomPreview(Geometry=pt_26, Material=nodes_color)

# ---- group: Projection on surface
# Description: The surface and the grids are aligned about their center using 3d bounding box.
# 
# Then the surface is translated with respect to the normal of the construction plane to create the top surface.
# 
# Once all the surfaces are created, they are displaced beneath the grid to ensure proper projection.
# 
# Finally, the point of the grid are projected, cell by cell, onto their respective surface, top and bottom. Then the cells are recreated. This way we ensure geometry will be discrete as if we directly projected line onto plane it would loose its linearity.
construction_plane_24 = Plane(construction_plane_7)
bottom_bases_10 = Curve(bottom_bases_8)
level_height_9 = Number(level_height_4)
top_bases_10 = Curve(top_bases_9)
srf_2 = Surface(surface_de_projection_2)
planes_properties = DeconstructPlane(Plane=construction_plane_24)  # -> Origin, XAxis, YAxis, ZAxis
bbox = BoundingBox(Content=flatten([bottom_bases_10, top_bases_10]), Plane=PlaneXY(0, 0, 0), UnionBox=True)  # -> Box, Box_2
bbox_2 = BoundingBox(Content=flatten(srf_2), Plane=PlaneXY(0, 0, 0), UnionBox=True)  # -> Box, Box_2
volume = Volume(Geometry=bbox.Box)  # -> Volume, Centroid
volume_2 = Volume(Geometry=bbox_2.Box)  # -> Volume, Centroid
subtraction_3 = Subtraction(A=volume.Centroid, B=volume_2.Centroid)
centered_surface = Move(Geometry=srf_2, Motion=subtraction_3)  # -> Geometry, Transform
height_displacement_vector = Multiplication(A=level_height_9, B=planes_properties.ZAxis)
multiplication_7 = Multiplication(A=planes_properties.ZAxis, B=-100)
move_plane_beneath_grids = Move(Geometry=centered_surface.Geometry, Motion=multiplication_7)  # -> Geometry, Transform
top_base = Move(Geometry=move_plane_beneath_grids.Geometry, Motion=height_displacement_vector)  # -> Geometry, Transform
explode_43 = Explode(Curve=bottom_bases_10, Recursive=True)  # -> Segments, Vertices
explode_44 = Explode(Curve=top_bases_10, Recursive=True)  # -> Segments, Vertices
multiplication_8 = Multiplication(A=planes_properties.ZAxis, B=-1)
project_bottom_grid_on_surface = ProjectPoint(Point=explode_43.Vertices, Direction=multiplication_8, Geometry=move_plane_beneath_grids.Geometry)  # -> simplify(Point), Index
project_top_grid_onsurface = ProjectPoint(Point=explode_44.Vertices, Direction=multiplication_8, Geometry=top_base.Geometry)  # -> simplify(Point), Index
pline_38 = PolyLine(Vertices=project_bottom_grid_on_surface.Point, Closed=False)
pline_39 = PolyLine(Vertices=project_top_grid_onsurface.Point, Closed=False)
trim_2 = TrimTree(Tree=pline_38, Depth=1)
trim_3 = TrimTree(Tree=pline_39, Depth=1)
path_mapper_9 = PathMapper(pline_38, source=["{A;B}", "{A}"], target=["{A}", "{A}"])
path_mapper_10 = PathMapper(pline_39, source=["{A;B}", "{A}"], target=["{A}", "{A}"])
deplane_7 = DeconstructPlane(Plane=construction_plane_24)  # -> Origin, XAxis, YAxis, ZAxis

# ----
combine_3 = CombineData(Input0=path_mapper_9, Input1=trim_2)  # -> Result, Index
combine_4 = CombineData(Input0=path_mapper_10, Input1=trim_3)  # -> Result, Index

# ---- group: Projection on surface (continued)
bbox_3 = BoundingBox(Content=flatten([combine_3.Result, combine_4.Result]), Plane=construction_plane_24, UnionBox=True)  # -> Box, Box_2
box_corners = BoxCorners(Box=bbox_3.Box_2)  # -> CornerA, CornerB, CornerC, CornerD, CornerE, CornerF, CornerG, CornerH
subtraction_4 = Subtraction(A=box_corners.CornerA, B=deplane_7.Origin)
move_13 = Move(Geometry=combine_3.Result, Motion=expr("-x", subtraction_4))  # -> Geometry, Transform
move_14 = Move(Geometry=combine_4.Result, Motion=expr("-x", subtraction_4))  # -> Geometry, Transform

bottom_bases_11 = Curve(move_13.Geometry)
top_bases_11 = Curve(move_14.Geometry)

# ----
bottom_bases_12 = Curve(bottom_bases_11)
top_bases_12 = Curve(top_bases_11)

# ---- group: Layers creation method switcher
# Description
# Description: This code blocks allow to chose wich method use to create the layers.
# 
# Wheter the number of layer is odd or pair change the algoritm of creation.
construction_plane_25 = Plane(construction_plane_12)
number_of_layers_4 = Integer(number_of_layers_3)
number_of_layers_5 = Integer(number_of_layers_3)
bottom_bases_13 = Curve(bottom_bases_7)
level_height_10 = Number(level_height_7)
top_bases_13 = Curve(top_bases_7)
cables_14 = Line(cables_3)
struts_14 = Line(struts_3)
odd_boolean = Modulus(A=number_of_layers_4, B=2)

construction_plane_switcher = StreamGate(Stream=construction_plane_25, Gate=odd_boolean)  # -> Target0, Target1
number_of_layers_switcher = StreamGate(Stream=number_of_layers_5, Gate=odd_boolean)  # -> Target0, Target1
cables_switcher = StreamGate(Stream=cables_14, Gate=odd_boolean)  # -> Target0, Target1
struts_switcher = StreamGate(Stream=struts_14, Gate=odd_boolean)  # -> Target0, Target1
bottom_bases_switcher = StreamGate(Stream=bottom_bases_13, Gate=odd_boolean)  # -> Target0, Target1
top_bases_switcher = StreamGate(Stream=top_bases_13, Gate=odd_boolean)  # -> Target0, Target1
level_height_switcher = StreamGate(Stream=level_height_10, Gate=odd_boolean)  # -> Target0, Target1

construction_plane_26 = Plane(construction_plane_switcher.Target0)
construction_plane_27 = Plane(construction_plane_switcher.Target1)
number_of_layers_6 = Integer(number_of_layers_switcher.Target0)
number_of_layers_7 = Integer(number_of_layers_switcher.Target1)
level_height_11 = Number(level_height_switcher.Target0)
level_height_12 = Number(level_height_switcher.Target1)

bottom_bases_14 = Curve(bottom_bases_switcher.Target0)
top_bases_14 = Curve(top_bases_switcher.Target0)
cables_15 = Line(cables_switcher.Target0)
struts_15 = Line(struts_switcher.Target0)

bottom_bases_15 = Curve(bottom_bases_switcher.Target1)
top_bases_15 = Curve(top_bases_switcher.Target1)
cables_16 = Line(cables_switcher.Target1)
struts_16 = Line(struts_switcher.Target1)

# ---- group: Pair number of layers
# Description: If the number of layers is pair:
# 1. Create the symetry of the bottom bases, cables and struts about the top base plane.
# 2. Copy the obtained two layers assembly on top of each other as necessary
construction_plane_28 = Plane(construction_plane_26)
number_of_layers_8 = Integer(number_of_layers_6)
bottom_bases_16 = Curve(bottom_bases_14)
level_height_13 = Number(level_height_11)
top_bases_16 = Curve(top_bases_14)
cables_17 = Line(cables_15)
struts_17 = Line(struts_15)
select_a_plane = ListItem(List=top_bases_16, Index=0, Wrap=True)
symmetry_of_the_cables = Mirror(Geometry=cables_17, Plane=select_a_plane)  # -> Geometry, Transform
symmetry_of_the_struts = Mirror(Geometry=struts_17, Plane=select_a_plane)  # -> Geometry, Transform
symmetry_of_the_bottom_bases = Mirror(Geometry=bottom_bases_16, Plane=select_a_plane)  # -> Geometry, Transform
series_6 = Series(Start=0, Step=expr("2*x", level_height_13), Count=expr("x/2", number_of_layers_8))
deplane_8 = DeconstructPlane(Plane=construction_plane_28)  # -> Origin, XAxis, YAxis, ZAxis
mirrored_bottom_bases = Curve(symmetry_of_the_bottom_bases.Geometry)
mirrored_cables = Line(symmetry_of_the_cables.Geometry)
mirrored_struts = Line(symmetry_of_the_struts.Geometry)
bottom_bases_17 = Curve(bottom_bases_16)
top_bases_17 = Curve(top_bases_16)
cables_18 = Line(cables_17)
struts_18 = Line(struts_17)
multiplication_9 = Multiplication(A=series_6, B=deplane_8.ZAxis)  # -> graft(Result)
lasts_layers_cables = Move(Geometry=flatten([mirrored_cables, cables_18]), Motion=multiplication_9)  # -> Geometry, Transform
lasts_layers_struts = Move(Geometry=flatten([mirrored_struts, struts_18]), Motion=multiplication_9)  # -> Geometry, Transform
lasts_layers_bottom_bases = Move(Geometry=flatten([mirrored_bottom_bases, bottom_bases_17]), Motion=multiplication_9)  # -> Geometry, Transform
lasts_layers_top_bases = Move(Geometry=flatten(top_bases_17), Motion=multiplication_9)  # -> Geometry, Transform

bottom_bases_18 = Curve(lasts_layers_bottom_bases.Geometry)
top_bases_18 = Curve(lasts_layers_top_bases.Geometry)
cables_19 = Line(lasts_layers_cables.Geometry)
struts_19 = Line(lasts_layers_struts.Geometry)

# ----
bottom_bases_19 = Curve(bottom_bases_12)
top_bases_19 = Curve(top_bases_12)

# ---- group: Create cables
# Description: The cables are made by linking top and bottom bases points one by one
bottom_bases_20 = Curve(bottom_bases_19)
top_bases_20 = Curve(top_bases_19)
explode_bottom_bases_3 = Explode(Curve=bottom_bases_20, Recursive=True)  # -> Segments, Vertices
explode_top_bases_3 = Explode(Curve=top_bases_20, Recursive=True)  # -> Segments, Vertices
remove_duplicated_points_5 = CullIndex(List=explode_bottom_bases_3.Vertices, Indices=-1, Wrap=True)
remove_duplicated_points_6 = CullIndex(List=explode_top_bases_3.Vertices, Indices=-1, Wrap=True)
create_cables_2 = Line(StartPoint=remove_duplicated_points_5, EndPoint=remove_duplicated_points_6)
cables_20 = Line(create_cables_2)

# ---- group: Create struts
# Description: The struts are made by shifting point order of the bottom bases and then link the points of the bottom bases to the top bases points.
bottom_bases_21 = Curve(bottom_bases_19)
top_bases_21 = Curve(top_bases_19)
explode_bottom_bases_4 = Explode(Curve=bottom_bases_21, Recursive=True)  # -> Segments, Vertices
explode_top_bases_4 = Explode(Curve=top_bases_21, Recursive=True)  # -> Segments, Vertices
remove_duplicated_points_7 = CullIndex(List=explode_bottom_bases_4.Vertices, Indices=-1, Wrap=True)
remove_duplicated_points_8 = CullIndex(List=explode_top_bases_4.Vertices, Indices=-1, Wrap=True)
shift_the_order_of_the_points_of_the_bot_2 = ShiftList(List=remove_duplicated_points_7, Shift=-1, Wrap=True)  # "Shift the order of the points of the bottom bases"
create_struts_2 = Line(StartPoint=shift_the_order_of_the_points_of_the_bot_2, EndPoint=remove_duplicated_points_8)

# ---- group: Remove duplicated lines
# Description: As cells used to create grids are overlapping, there are duplicated lines which needs to be culled.
# 
# The easiest way to do this is check for equality.
bottom_bases_22 = Curve(bottom_bases_19)
top_bases_22 = Curve(top_bases_19)
explode_45 = Explode(Curve=bottom_bases_22, Recursive=True)  # -> Segments, Vertices
explode_46 = Explode(Curve=top_bases_22, Recursive=True)  # -> Segments, Vertices
remove_duplicates_bottom_bases_cables = RemoveDuplicateLines(InputLines=flatten(explode_45.Segments), Tolerance=1e-06)  # -> OutputLines, FirstLineIndexes
remove_duplicates_bottom_bases_cables_2 = RemoveDuplicateLines(InputLines=flatten(explode_46.Segments), Tolerance=1e-06)  # -> OutputLines, FirstLineIndexes
clean = CleanTree(RemoveNulls=True, RemoveInvalid=True, RemoveEmpty=False, Tree=remove_duplicates_bottom_bases_cables.OutputLines)
clean_2 = CleanTree(RemoveNulls=True, RemoveInvalid=True, RemoveEmpty=False, Tree=remove_duplicates_bottom_bases_cables_2.OutputLines)

# ----
end_26 = EndPoints(Curve=create_struts_2)  # -> Start, End

# ---- group: Create struts
struts_20 = Line(create_struts_2)
pt_27 = Point([end_26.Start, end_26.End])

# ---- group: Remove duplicated lines
struts_21 = Line(clean)
struts_22 = Line(clean_2)

# ----
bottom_bases_cables = Line(struts_21)
top_bases_cables = Line(struts_22)
cables_21 = Line(cables_20)
pt_28 = Point(pt_27)
struts_23 = Line(struts_20)

# ----
# Description: Color swatch are available to add custom color but the custom preview components are linked to global colors (see top of script) with an hidden wire.
line_109 = Line([cables_21, bottom_bases_cables, top_bases_cables])
line_110 = Line(struts_23)
pt_29 = Point(pt_28)
swatch_18 = ColourSwatch(SwatchColor=RGB(0, 64, 255))
swatch_19 = ColourSwatch(SwatchColor=RGB(255, 0, 0))
swatch_20 = ColourSwatch(SwatchColor=RGB(3, 173, 0))
preview_18 = CustomPreview(Geometry=line_109, Material=cables_color)
preview_19 = CustomPreview(Geometry=line_110, Material=struts_color)
preview_20 = CustomPreview(Geometry=pt_29, Material=nodes_color)

# ---- group: Odd number of layers
# Description: If the number of layers is odd:
# 1. Create the symetry of the bottom bases, cables and struts about the top base plane.
# 2. Copy the obtained two layers assembly on top of each other as necessary.
# 3. Copy top bases, struts and cables on top the the assembly the create the last layer.
construction_plane_29 = Plane(construction_plane_27)
number_of_layers_9 = Integer(number_of_layers_7)
bottom_bases_23 = Curve(bottom_bases_15)
level_height_14 = Number(level_height_12)
top_bases_23 = Curve(top_bases_15)
cables_22 = Line(cables_16)
struts_24 = Line(struts_16)
select_a_plane_2 = ListItem(List=top_bases_23, Index=0, Wrap=True)
symmetry_of_the_cables_2 = Mirror(Geometry=cables_22, Plane=select_a_plane_2)  # -> Geometry, Transform
symmetry_of_the_struts_2 = Mirror(Geometry=struts_24, Plane=select_a_plane_2)  # -> Geometry, Transform
symmetry_of_the_bottom_bases_2 = Mirror(Geometry=bottom_bases_23, Plane=select_a_plane_2)  # -> Geometry, Transform
mirrored_bottom_bases_2 = Curve(symmetry_of_the_bottom_bases_2.Geometry)
mirrored_cables_2 = Line(symmetry_of_the_cables_2.Geometry)
mirrored_struts_2 = Line(symmetry_of_the_struts_2.Geometry)
bottom_bases_24 = Curve(bottom_bases_23)
top_bases_24 = Curve(top_bases_23)
cables_23 = Line(cables_22)
struts_25 = Line(struts_24)

# ---- group: Odd number of layers / Trigger for unique layer
deplane_9 = DeconstructPlane(Plane=construction_plane_29)  # -> Origin, XAxis, YAxis, ZAxis
series_7 = Series(Start=0, Step=expr("2*x", level_height_14), Count=expr("(x-1)/2", number_of_layers_9))
int_28 = Integer(expr("x-1", number_of_layers_9))
expression_11 = Expression(x=number_of_layers_9, Expression="if(x=1,True,False)")
multiplication_10 = Multiplication(A=series_7, B=deplane_9.ZAxis)  # -> graft(Result)
multiplication_11 = Multiplication(A=int_28, B=level_height_14, C=deplane_9.ZAxis)

# ---- group: Odd number of layers (continued)
last_cables_move = Move(Geometry=flatten(cables_23), Motion=multiplication_11)  # -> Geometry, Transform
last_struts_move = Move(Geometry=flatten(struts_25), Motion=multiplication_11)  # -> Geometry, Transform
last_top_bases_move = Move(Geometry=reverse(top_bases_24), Motion=multiplication_11)  # -> Geometry, Transform
cables_move = Move(Geometry=flatten([mirrored_cables_2, cables_23]), Motion=multiplication_10)  # -> Geometry, Transform
struts_move = Move(Geometry=flatten([mirrored_struts_2, struts_25]), Motion=multiplication_10)  # -> Geometry, Transform
bottom_bases_move = Move(Geometry=flatten([mirrored_bottom_bases_2, bottom_bases_24]), Motion=multiplication_10)  # -> Geometry, Transform
top_bases_move = Move(Geometry=flatten(top_bases_24), Motion=multiplication_10)  # -> Geometry, Transform

bottom_bases_25 = Curve(flatten(bottom_bases_move.Geometry))
top_bases_25 = Curve(flatten([top_bases_move.Geometry, last_top_bases_move.Geometry]))
cables_24 = Line(flatten([cables_move.Geometry, last_cables_move.Geometry]))
struts_26 = Line(flatten([struts_move.Geometry, last_struts_move.Geometry]))

bottom_bases_26 = Curve(bottom_bases_23)
top_bases_26 = Curve(top_bases_23)
cables_25 = Line(cables_22)
struts_27 = Line(struts_24)

filter_15 = StreamFilter(Gate=expression_11, Stream0=cables_24, Stream1=cables_25)
filter_16 = StreamFilter(Gate=expression_11, Stream0=struts_26, Stream1=struts_27)
filter_17 = StreamFilter(Gate=expression_11, Stream0=bottom_bases_25, Stream1=bottom_bases_26)
filter_18 = StreamFilter(Gate=expression_11, Stream0=top_bases_25, Stream1=top_bases_26)

bottom_bases_27 = Curve(filter_17)
top_bases_27 = Curve(filter_18)
cables_26 = Line(filter_15)
struts_28 = Line(filter_16)

# ----
bottom_bases_28 = Curve([bottom_bases_18, bottom_bases_27])
top_bases_28 = Curve([top_bases_18, top_bases_27])
cables_27 = Line([cables_19, cables_26])
struts_29 = Line([struts_19, struts_28])

bottom_bases_29 = Curve(bottom_bases_28)
top_bases_29 = Curve(top_bases_28)
cables_28 = Line(cables_27)
struts_30 = Line(struts_29)

# ---- group: Clean data
# Description: This code blocks allow to chose wich method use to create the layers.
# 
# Wheter the number of layer is odd or pair change the algoritm of creation.
bottom_bases_30 = Curve(bottom_bases_29)
top_bases_30 = Curve(top_bases_29)
# STEP 4: Clean duplicated data
cables_29 = Line(cables_28)
struts_31 = Line(struts_30)
explode_47 = Explode(Curve=bottom_bases_30, Recursive=True)  # -> flatten(Segments), flatten(Vertices)
explode_48 = Explode(Curve=top_bases_30, Recursive=True)  # -> flatten(Segments), flatten(Vertices)
remove_duplicates_bottom_bases_points = RemoveDuplicatePoints(InputPoints=explode_47.Vertices, Tolerance=1e-06)  # -> OutputPoints, FirstPointIndexes
remove_duplicates_top_bases_points = RemoveDuplicatePoints(InputPoints=explode_48.Vertices, Tolerance=1e-06)  # -> OutputPoints, FirstPointIndexes
remove_duplicates_bottom_bases_cables_3 = RemoveDuplicateLines(InputLines=explode_47.Segments, Tolerance=1e-06)  # -> OutputLines, FirstLineIndexes
remove_nulls = CleanTree(RemoveNulls=True, RemoveInvalid=True, RemoveEmpty=False, Tree=remove_duplicates_bottom_bases_cables_3.OutputLines)
remove_nulls_2 = CleanTree(RemoveNulls=True, RemoveInvalid=True, RemoveEmpty=False, Tree=remove_duplicates_bottom_bases_points.OutputPoints)
remove_nulls_3 = CleanTree(RemoveNulls=True, RemoveInvalid=True, RemoveEmpty=False, Tree=remove_duplicates_top_bases_points.OutputPoints)

top_bases_cables_2 = Line(flatten(explode_48.Segments))
cables_30 = Line(flatten(cables_29))
struts_32 = Line(flatten(struts_31))

bottom_bases_cables_2 = Line(remove_nulls)
bottom_bases_points = Point(remove_nulls_2)
top_bases_points = Point(remove_nulls_3)

# ----
bases_cables_7 = Line(flatten([top_bases_cables_2, bottom_bases_cables_2]))
points = Point(flatten([bottom_bases_points, top_bases_points]))
cables_31 = Line(cables_30)
struts_33 = Line(struts_32)

# ----
# STEP 5: Visual
# Description: Color swatch are available to add custom color but the custom preview components are linked to global colors (see top of script) with an hidden wire.
line_111 = Line([bases_cables_7, cables_31])
line_112 = Line(struts_33)
pt_30 = Point(points)
swatch_21 = ColourSwatch(SwatchColor=RGB(255, 0, 0))
swatch_22 = ColourSwatch(SwatchColor=RGB(3, 173, 0))
swatch_23 = ColourSwatch(SwatchColor=RGB(0, 64, 255))
preview_21 = CustomPreview(Geometry=line_111, Material=cables_color)
preview_22 = CustomPreview(Geometry=line_112, Material=struts_color)
preview_23 = CustomPreview(Geometry=pt_30, Material=nodes_color)

# ----
# BONUS STEP: Sinusoidal struts
struts_type_3 = Integer(struts_type_2)
struts_34 = Line(struts_13)

# ---- group: Create sinusoidal bars / Sinusoidal calculation
filter_19 = StreamFilter(Gate=struts_type_3, Stream1=struts_34)

# ---- group: Create sinusoidal bars
# Description: Sinusoidal struts are made by interpoling line with start point, midpoint and end point of each bar.
join_2 = JoinCurves(Curves=flatten(filter_19), Preserve=False)
explode_49 = Explode(Curve=join_2, Recursive=True)  # -> simplify(Segments), simplify(Vertices)
intcrv = Interpolate(Vertices=explode_49.Vertices, Degree=3, Periodic=False, KnotStyle=1)  # -> Curve, Length, Domain

# ---- group: Create sinusoidal bars / Sinusoidal struts switcher
filter_20 = StreamFilter(Gate=struts_type_3, Stream0=struts_34, Stream1=intcrv.Curve)

# ----
crv_31 = Curve(filter_20)

# ----
# Nodes
# Bases cables
# Cells cables
# Cells struts
base_cables_3 = Line(base_cables_2)
# STEP 5: Final geometry
nodes_9 = Point(nodes_8)
cable = Line(cables_13)
crv_32 = Curve(crv_31)

# ---- group: Lenght check
len_4 = Length(Curve=flatten(cable))
len_5 = Length(Curve=flatten(crv_32))
len_6 = Length(Curve=flatten(base_cables_3))
length_of_base_cable = Panel(len_4)
length_of_cells_cable = Panel(len_5)
length_of_struts = Panel(len_6)
avr_4 = Average(Input=len_4)
avr_5 = Average(Input=len_5)
avr_6 = Average(Input=len_6)
division_2 = Division(A=avr_5, B=avr_4)
average_length_of_base_cable = Panel(avr_4)
average_length_of_cells_cable = Panel(avr_5)
average_length_of_struts = Panel(avr_6)
r_ratio = Panel(division_2)

# ----
# STEP 6: Visual
# Description: Color swatch are available to add custom color but the custom preview components are linked to global colors (see top of script) with an hidden wire.
line_113 = Line([base_cables_3, cable])
line_114 = Line(crv_32)
pt_31 = Point(nodes_9)
swatch_24 = ColourSwatch(SwatchColor=RGB(255, 0, 0))
swatch_25 = ColourSwatch(SwatchColor=RGB(3, 173, 0))
swatch_26 = ColourSwatch(SwatchColor=RGB(0, 64, 255))
preview_24 = CustomPreview(Geometry=line_113, Material=cables_color)
preview_25 = CustomPreview(Geometry=line_114, Material=struts_color)
preview_26 = CustomPreview(Geometry=pt_31, Material=nodes_color)

# ==== cluster Cluster_2
T = ClusterInput()
N = ClusterInput()
fn = ClusterInput()
dc = ClusterInput()
dm = ClusterInput()
cluster = Cluster(T=T, N=N, fn=fn, dc=dc, dm=dm)  # -> T_2, author_2, objcount_2, fn_3, dc_4, dm_4
merge = Merge(
    Data1=cluster.author_2,
    Data2=cluster.T_2,
    Data3=cluster.objcount_2,
    Data4=cluster.fn_3,
    Data5=cluster.dc_4,
    Data6=cluster.dm_4)
R = ClusterOutput(merge)

# ==== cluster PlanePicker: 0 = XY plane 1= YZ plane 2 = XZ plane
X = UnitX(Factor=1)
Y = UnitY(Factor=1)
Z = UnitZ(Factor=1)
O = ClusterInput()
xy = XYPlane(Origin=O)
yz = YZPlane(Origin=O)
xz = XZPlane(Origin=O)
pl = ConstructPlane(Origin=O, XAxis=Z, YAxis=X)
pl_2 = ConstructPlane(Origin=O, XAxis=Y, YAxis=Z)
pl_3 = ConstructPlane(Origin=O, XAxis=X, YAxis=Y)
G = ClusterInput()
filter = StreamFilter(Gate=G, Stream0=pl_3, Stream1=pl_2, Stream2=pl)
s_2 = ClusterOutput(filter)

# ==== cluster PlanePicker_2: 0 = XY plane 1= YZ plane 2 = XZ plane
X = UnitX(Factor=1)
Y = UnitY(Factor=1)
Z = UnitZ(Factor=1)
O = ClusterInput()
xy = XYPlane(Origin=O)
yz = YZPlane(Origin=O)
xz = XZPlane(Origin=O)
pl = ConstructPlane(Origin=O, XAxis=Z, YAxis=X)
pl_2 = ConstructPlane(Origin=O, XAxis=Y, YAxis=Z)
pl_3 = ConstructPlane(Origin=O, XAxis=X, YAxis=Y)
G = ClusterInput()
filter = StreamFilter(Gate=G, Stream0=pl_3, Stream1=pl_2, Stream2=pl)
s_0 = ClusterOutput(filter)

# ==== cluster Cluster
N = ClusterInput()
T = ClusterInput()
N_2 = Text(N)
split = TextSplit(Text=T, Separators=".")
fn = ClusterInput()
dm = ClusterInput()
item = ListItem(List=split, Index=0, Wrap=True)
dc = ClusterInput()
pan = Panel("""HDT_Reference
HDTReference""")
pan_2 = Panel("""Human
Human""")
lng = ListLength(List=T)
len = TextLength(Text=N_2)
contains = ContainsAB(B=N_2)
dm_2 = Text(dm)
dc_2 = Text(dc)
fn_2 = Text(fn)
replace = ReplaceMembers(Set=item, Find=pan, Replace=pan_2)
cset = CreateSet(List=flatten(replace))  # -> Set, Map
txt = Text(["ScriptComponents", "Grasshopper", "MathComponents", "GalapagosComponents", "FieldComponents", "VectorComponents", "AnalysisComponents", "CurveComponents", "LegacyScriptComponents", "SurfaceComponents", "TriangulationComponents", "MassXForms", "LinearXForms"])
format = Format(Format="Definition by {0}", Culture=127, Data0=N_2)
difference = SetDifference(SetA=cset.Set, SetB=txt)
lng_2 = ListLength(List=flatten(difference))
dispatch = Dispatch(List=format, DispatchPattern=contains)  # -> ListA, ListB
format_2 = Format(Format="Object Count: {0:0}", Culture=127, Data0=lng)
format_3 = Format(Format="Date Modified: {0}", Culture=127, Data0=dm_2)
format_4 = Format(Format="Date Created: {0}", Culture=127, Data0=dc_2)
dependencies = Text(flatten(difference))
author = Text(flatten(dispatch.ListB))
larger = LargerThan(FirstNumber=lng_2, SecondNumber="1")  # -> LargerThan, OrEqualTo
objcount = Text(flatten(format_2))
author_2 = ClusterOutput(author)
dm_3 = Text(flatten(format_3))
fn_3 = ClusterOutput(fn_2)
dc_3 = Text(flatten(format_4))
objcount_2 = ClusterOutput(objcount)
dc_4 = ClusterOutput(dc_3)
filter = StreamFilter(
    Gate=larger.LargerThan,
    Stream0="This definition requires the following plug-in:",
    Stream1="This definition requires the following plug-ins:")
dm_4 = ClusterOutput(dm_3)
pan_3 = Panel("""{0}
{1}""")
join = TextJoin(Text=dependencies)
format_5 = Format(Format=pan_3, Culture=127, Data0=filter, Data1=join)
clean = CleanTree(Tree=format_5, CleanInvalid=True, CleanEmpty=False)
T_2 = ClusterOutput(clean)

# ==== cluster ContainsAB: Tests if a string contains another string.
B = ClusterInput()
A = ClusterInput()
A_2 = String(A)
B_2 = String(B)
eval = Evaluate(F="Contains(x,y)", x=A_2, y=B_2)
c = Boolean(eval)
c_2 = ClusterOutput(c)
