# Grasshopper definition ExperimentalTensegritySimplex - Dynamic tests.gh (Grasshopper 1.0.7)
# plug-ins: Muscle

g_m_s² = Gravity(Vector(0, 0, -9.81))
startpy = StartPythonNET(
    StartPython=Toggle(True),
    AnacondaDirectory="C:\Users\Jonas\Anaconda3",
    CondaEnvironmentName="base",
    Python3xxDllFile="python312.dll")
# reference (1): This grasshopper script provides the numerical results for :
# 
# Desmet, Antoine. Etude numérique et expérimentale du comportement dynamique des structures de tenségrité. Ecole polytechnique de Louvain, Université catholique de Louvain, 2022. Prom. : Latteur, Pierre ; Saraiva Esteves Pacheco De Almeida, João.
# 
# Find a complete description of the dynamic experimental setup in A. Desmet's master thesis, open accessible under this link:
# http://hdl.handle.net/2078.1/thesis:37796
# reference (2): The dynamic experiments are performed on a aluminum tensegrity simplex, which is fully described in the following article:
# 
# Feron J., Rhode-Barbarigos L. & Latteur P. Experimental testing of a tensegrity simplex: self-stress implementation and static loading. ASCE Journal of Structural Engineering (2023). Vol149 No7. https://ascelibrary.org/doi/10.1061/JSENDH.STENG-11517
# changes between references (1) and (2): For the dynamic experiments, the self-weight of the structure top joints varies compared to the static experiments.
# 
# The difference is explained by the self-weight of the accelerometers and of the loading plates which is included in the self-weight of the joints for the dynamic experiments.
display = DisplaySettings(
    SupportsSize=Slider(0.13, range=0.01..2),
    LoadsSize=Slider(14.29, range=0.01..20),
    PrestressSize=Slider(0.22, range=0..1),
    Decimal="2",
    GMS²=g_m_s²)

# ---- group: Dimension of reference
diameter_of_base_outer_circle_m = Slider(2.36, range=0.5..20)

# ---- group: Height profile along the curve
assembly_profile = GraphMapper(x0=0, x1=1, y0=0, y1=1, A=0, B=1, container_name="Linear", Graph_x0=0, Graph_x1=1, Graph_y0=1, Graph_y1=1)

# ---- group: Number of edges per module
reference_polygon = Slider(3, range=3..10)

# ---- group: Number of additional long cables per module
# Description: Structure can't have more add cables than edges
additional_long_cables = Slider(0, range=0..10)
min = Minimum(A=reference_polygon, B=additional_long_cables)

# ----
structure_alignement = Slider(0, range=-180..180)

# ---- group: Span
main_dimension_m = Slider(1.95, range=0.1..100)

# ---- group: Span / max excentricity f
main_dimension_m_2 = Slider(0, range=0..100)

# ---- group: Relative rotation between bases
# Alterned rotation
relative_rotation = Slider(30, range=0..180)
relative_rotation_2 = ValueList({"Alterned": 0, "Spiral": 1}, selected="Alterned")

# ----
# INPUTS
pt = ConstructPoint(XCoordinate="0.59", YCoordinate="-1.02191", ZCoordinate="0")
number_of_modules = Slider(1, range=1..20)
cells_position_on_graph = Range(Domain=Domain(0, 1), Steps=number_of_modules)

# ---- group: Curve shape
assembly_profile_2 = GraphMapper(flatten(cells_position_on_graph), x0=0, x1=1, y0=0, y1=1, Ox=0.4982714355, Oy=1, Px=1, Py=0, container_name="Parabola")

# ---- group: Draw additional transversal cables ?
add_transv_cables = BooleanToggle(False)

# ----
# Height profile
height_factor = Panel(assembly_profile)

# ---- group: Start point
pt_2 = Point(pt)

# ----
# DRAW GEOMETRY
multiplication = Multiplication(A=diameter_of_base_outer_circle_m, B=height_factor)
diameter_of_each_outer_circle = Panel(multiplication)

# ---- group: Create curve
cluster = Cluster_5(P=pt_2, B_2=main_dimension_m, N=number_of_modules, A=main_dimension_m_2, B=assembly_profile_2)

# ---- group: Create curve / curve
crv = Curve(cluster)

# ---- group: Create base planes / curve
reference_curve = Curve(crv)

# ---- group: Create base planes / nbr modules
number_of_cells = Integer(number_of_modules)

# ---- group: Create base planes / Structure Alignment (°)
rad = Radians(Degrees=structure_alignement)

# ---- group: Create base planes
create_structure = CreateStructure(C=reference_curve, N=number_of_cells, A=rad)

# ---- group: Create base planes / base planes
construction_planes = Plane(create_structure)

# ---- group: Rotate base planes / 0 Alterned / 1 Spiral
rotation_type = Integer(relative_rotation_2)

# ---- group: Rotate base planes / Rotation (°)
rad_2 = Radians(Degrees=relative_rotation)

# ---- group: Rotate base planes / base planes
pln = Plane(construction_planes)

# ---- group: Rotate base planes
rotate_base_planes = RotateBasePlanes(relay=pln, angle_rad=rad_2, _0_alterned_1_spiral=rotation_type)

# ---- group: Rotate base planes / Rotated base planes
construction_planes_2 = Plane(rotate_base_planes)

# ---- group: Create base cables and nodes / Base planes
pln_2 = Plane(construction_planes_2)

# ---- group: Create base cables and nodes / Diameters of outer circles
num = Number(diameter_of_each_outer_circle)

# ---- group: Create base cables and nodes / Nbr of edges
int = Integer(reference_polygon)

# ---- group: Create base cables and nodes
polygon = Polygon(Plane=pln_2, Radius=expr("x/2", num), Segments=int, FilletRadius=0)  # -> simplify(Polygon), Length
cluster_2 = Cluster(C=polygon.Polygon)  # -> S, S_2

# ---- group: Create base cables and nodes / Nodes
pt_3 = Point(cluster_2.S_2)

# ---- group: Create base cables and nodes / Base cables
line = Line(cluster_2.S)

# ---- group: Create add transv. cables / Bases planes
construction_planes_3 = Plane(construction_planes)

# ---- group: Create add long. cables / 0 Alterned / 1 Spiral
rotation_type_2 = Integer(relative_rotation_2)

# ---- group: Create Struts / 0 Alterned / 1 Spiral
rotation_type_3 = Integer(relative_rotation_2)

# ---- group: Create Struts / Nodes
pt_4 = Point(pt_3)

# ---- group: Create add long. cables / nbr of add long cables
int_2 = Integer(min)

# ---- group: Create add transv. cables / add transverse cables ?
bool = Boolean(add_transv_cables)

# ---- group: Create long Cables / Nodes
pt_5 = Point(pt_3)

# ---- group: Create add long. cables / Nodes
pt_6 = Point(pt_3)

# ---- group: Create add transv. cables / Nodes
pt_7 = Point(pt_3)

# ---- group: Create Struts
cluster_3 = Cluster_4(nodes=pt_4, alterned_spiral=rotation_type_3)

# ---- group: Create add long. cables
cluster_4 = Cluster_3(nodes=pt_6, alterned_spiral=rotation_type_2, nbr_add_cables=int_2)

# ---- group: Create add transv. cables
cluster_5 = Cluster_2(bool=bool, nodes=pt_7, planes=construction_planes_3)  # -> cables, points

# ---- group: Create long Cables
long_cables = LongCables(T=pt_5)

# ---- group: Create add long. cables / Add Long Cables
line_2 = Line(simplify(cluster_4))

# ---- group: Create add transv. cables / Add transv. Cables
line_3 = Line(simplify(cluster_5.cables))

# ---- group: Create long Cables / Long cables
line_4 = Line(long_cables)

# ---- group: Create Struts / Struts
line_5 = Line(cluster_3)

# ---- group: Create add transv. cables / Add center points
pt_8 = Point(cluster_5.points)

# ---- group: Base cables
line_6 = Line(line)

# ---- group: Long Cables
line_7 = Line(line_4)

# ---- group: Struts
line_8 = Line(line_5)

# ---- group: Nodes
pt_9 = Point(pt_3)

# ---- group: Add long Cables
line_9 = Line(line_2)

# ---- group: struts
number_slider = Slider(60, range=0.1..100)
dom = ConstructDomain(DomainStart=expr("-x", "160"), DomainEnd="160")
M = MaterialLinear(Name="struts", YoungModulus="70390", YieldStrengths=dom, SpecificMass="0")
circular = CrossSectionCircular(Diameter=number_slider, Thickness="2")
# CONSTRUCT FINITE ELEMENT MODEL
line_10 = Line(line_8)
E = Element(Line=line_10, CrossSection=circular, Material=M, ElementName="struts", BucklingLaw=-1, BucklingFactor="1.055")
pipe = Pipe(Curve=line_10, Radius=expr("x/2000", number_slider), Caps=0)

# ---- group: long cables
number_slider_2 = Slider(8, range=0.1..10)
dom_2 = ConstructDomain(DomainStart="-120", DomainEnd="120")
M_2 = MaterialBilinear(Name="long cables", CompressiveYoungModulus="0", TensileYoungModulus="72190", YieldStrengths=dom_2, SpecificMass="0")
circular_2 = CrossSectionCircular(Diameter=number_slider_2, Thickness=0)
line_11 = Line(line_7)
E_2 = Element(Line=line_11, CrossSection=circular_2, Material=M_2, ElementName="long cables", BucklingLaw=10, BucklingFactor=1)
pipe_2 = Pipe(Curve=line_11, Radius=expr("x/2000", number_slider_2), Caps=0)

# ---- group: Base cables
number_slider_3 = Slider(8, range=0.1..10)
dom_3 = ConstructDomain(DomainStart="-120", DomainEnd="120")
M_3 = MaterialBilinear(Name="base cables", CompressiveYoungModulus="0", TensileYoungModulus="71750", YieldStrengths=dom_3, SpecificMass="0")
circular_3 = CrossSectionCircular(Diameter=number_slider_3, Thickness=0)
line_12 = Line(line_6)
E_3 = Element(Line=line_12, CrossSection=circular_3, Material=M_3, ElementName="base cables", BucklingLaw=10, BucklingFactor=1)
pipe_3 = Pipe(Curve=line_12, Radius=expr("x/2000", number_slider_3), Caps=0)

# ---- group: All Nodes
pt_10 = Point(pt_9)

# ---- group: Set nodes index
cluster_6 = Cluster_6(pt=pt_10)

# ---- group: Nodes (correctly ordered)
pt_11 = Point(cluster_6)

# ---- group: Define supports / Nodes
pt_12 = Point(pt_11)

# ---- group: Node preview
offset_z = Slider(0.15, range=0.01..1)
cluster_7 = Cluster_7(pt=pt_11, R=Slider(0.035, range=0.01..0.15), F=offset_z)  # -> S, swatch, r, R_2
# DISPLAY GEOMETRY INFO
panel = Panel("0.12")
nodes_coord_m = Panel(cluster_7.r)
points = PointList(Points=flatten(cluster_7.R_2), Size=panel)
preview = CustomPreview(Geometry=flatten(cluster_7.S), Material=cluster_7.swatch)

# ---- group: Define supports
item = ListItem(List=pt_12, Index="1", Wrap=True)
item_2 = ListItem(List=pt_12, Index="2", Wrap=True)
item_3 = ListItem(List=pt_12, Index="0", Wrap=True)

# ---- group: Define supports / Block X
sptx = SupportX(Point=[item, item_3])

# ---- group: Define supports / Block Y
spty = SupportY(Point=item)

# ---- group: Define supports / Block Z
sptz = SupportZ(Point=[item, item_3, item_2])

# ---- group: Elements preview
preview_2 = CustomPreview(Geometry=flatten([pipe_3, pipe_2]), Material=ColourSwatch(SwatchColor=RGB(41, 41, 204)))
preview_3 = CustomPreview(Geometry=flatten(pipe), Material=ColourSwatch(SwatchColor=RGB(178, 178, 178)))

# ---- group: Display angle / All Nodes
pt_13 = Point(pt_11)

# ---- group: Display angle
tag_vertical_offset = Slider(-0.49, range=-1..0)
amplify_factor = Slider(1.45, range=0.75..2)
text_size = Panel("0.10")
ugly_code_to_display_angles = UglyCodeToDisplayAngles(pt=pt_13, C=Slider(1, range=1..3), num_3=text_size, num=amplify_factor, L=tag_vertical_offset)  # -> D, pt_4, R_2, i_2, R, num_5, V, i_3, i, i_4
angledim = AngularDimension(
    Center=ugly_code_to_display_angles.pt_4,
    PointA=ugly_code_to_display_angles.R_2,
    PointB=ugly_code_to_display_angles.R,
    Reflex=False,
    Text="{0:0.0}°",
    Size=ugly_code_to_display_angles.num_5)
tag = TextTag3D(
    Location=ugly_code_to_display_angles.i_3,
    Text=ugly_code_to_display_angles.i_4,
    Size=ugly_code_to_display_angles.num_5,
    Justification=3)
vdis = VectorDisplay(Anchor=ugly_code_to_display_angles.i, Vector=ugly_code_to_display_angles.V)
vdis_2 = VectorDisplay(Anchor=ugly_code_to_display_angles.i_2, Vector=expr("-x", ugly_code_to_display_angles.V))
alpha = Panel(ugly_code_to_display_angles.D)

# ---- group: All elements
entwine = Entwine(Branch00=E, Branch01=E_3, Branch02=E_2, FlattenInputs=True)  # -> flatten(Result)

# ---- group: Nodes
pt_14 = Point(pt_11)

# ---- group: Define supports / Supports
spt = Support([spty, sptx, sptz])

# ---- group: Finite Element Model
structure = ConstructStructure(Elements=entwine, Points=pt_14, Supports=spt)

# ----
svd = SolverSelfstressAndMechanismsAnalysisBySingularValueDecomposition(Structure=structure, RelativeTolerance=0.001)  # -> struct, r, S, s, Vs_T, Vr_T, m, Um_T, Ur_T; disabled

# ---- group: 0 stress structure
struct = Structure(structure)

# ---- group: gravity (m/s²)
vec = Vector(g_m_s²)

# ---- group: self stress mode Vs_T
num_2 = Number(svd.Vs_T)  # disabled

# ----
# MECHANISMS
mode_index = Slider(0, range=0..10)  # disabled
vec_2 = Vector(svd.Um_T)  # disabled

# ---- group: Select mode
select_mode = SelectMode(T=vec_2, I=mode_index)  # disabled

# ---- group: Mechanism
vec_3 = Vector(select_mode)  # disabled

# ---- group: Rescale mechanism
cluster_8 = Cluster_9(vec=vec_3)  # disabled

# ---- group: Initial prestress / struts
E_4 = Element(E)

# ---- group: Initial prestress
free_length_variation_dl0_mm = Panel("+0.717")
P = Prestress(Element=E_4, FreeLengthVariation=expr("x/1000", free_length_variation_dl0_mm))

# ----
ref_1 = Panel("FIGURE 4")  # disabled

# ---- group: degree s of static indeterminacy
num_3 = Number(svd.s)  # disabled

# ---- group: self-stress levels a (kN)
selfstresslevels = GenePool(Decimals=2, Maximum=8.81, Minimum=0, Value=8.81)  # disabled

# ---- group: Compute self-stress scenario / theoretical structure
struct_2 = Structure(svd.struct)  # disabled

# ----
# APPLY SELF-WEIGHT and INITIAL PRESTRESS
# 
# STARTING POINT FOR ALL EXPERIMENTS
# Change in expertimental setup between static and dynamic tests
# -> different self-weight
# see explanation in the top left corner
measured_mass_of_the_joints_kg = Panel("""2.590
2.590
2.590
3.060
3.060
3.060""")
measured_mass_of_the_elements_kg = Panel("""2.630
2.630
2.630
0.502
0.502
0.502
0.502
0.502
0.502
0.502
0.502
0.502""")
ma = MassAddition(Input=measured_mass_of_the_elements_kg)  # -> Result, PartialResults
lng = ListLength(List=measured_mass_of_the_joints_kg)
division = Division(A=ma.Result, B=lng)
struct_3 = Structure(struct)

# ---- group: mass of the elements (kg/node)
panel_2 = Panel(division)

# ---- group: total mass (kg/node)
addition = Addition(A=measured_mass_of_the_joints_kg, B=panel_2)

# ---- group: Measured mass of the joints (kg)
num_4 = Number(measured_mass_of_the_joints_kg)

# ---- group: Measured mass of the elements (kg)
num_5 = Number(measured_mass_of_the_elements_kg)

# ----
# SELF-STRESS MODES
# reference (3): Feron J. & Latteur P. Implementation and propagation of prestress forces in pin-jointed and tensegrity structures. Engineering Structures (2023). Vol289.
# https://doi.org/10.1016/j.engstruct.2023.116152
# reference (3) paragraph 2.3: Transformation matrix Theta
# 
# is such that:
# Vs * Theta = S
# 
# 
# where:
# Vs = the self-stress modes obtained by SVD
# S = the localized self-stress modes after transformation
# Theta = transformation matrix (without unit) of size (s,s)
# 
# 
# if the localized modes S are found by an algorithm,the transformation matrix (equivalent to this algorithm) may be found by
# Theta = Vs_T * S
struct_4 = Structure(svd.struct)  # disabled
matrix_input = ToMatrixInputs(Tree=num_2)  # -> Rows, Columns, Rows_2; disabled
matrix = ConstructMatrix(Rows=matrix_input.Rows, Columns=matrix_input.Columns, Values=matrix_input.Rows_2)  # disabled

# ---- group: Localize self-stress modes algorithm
localize = LocalizeSelfStressModes(Structure=struct_4, SelfStressModes=num_2, AbsoluteTolerance=1e-10)  # -> Structure, LocalisedSelfStressModes; disabled

# ---- group: Vs_T
matrix_2 = DisplayMatrix(matrix, Digits=2)  # disabled

# ---- group: retrieve lines
cluster_9 = Cluster_8(struct=struct_4)  # disabled

# ----
multiplication_2 = Multiplication(A=vec, B=addition)

# ---- group: Self-Weight loads
measured_selfweight_values_n = Panel(multiplication_2)
destruct = DeconstructStructure(Structure=struct)  # -> Nodes, Elements
load = PointLoad(Point=destruct.Nodes, Vector=expr("x/1000", measured_selfweight_values_n))

# ----
dr = DynamicRelaxationMethod(
    Structure=struct_3,
    PointLoads=load,
    Prestress=P,
    RelativeTolerance=0.0001,
    AbsoluteTolerance=0.01,
    DeltaT=0.01,
    MaxTimeStep=10000,
    MaxPeakReset=1000,
    MassAmplification=1,
    MinimumMass=0.005)  # -> Structure, IsInEquilibrium, TimeStep, PeakReset

# ---- group: prestressed structure
struct_5 = Structure(dr.Structure)

# ---- group: results analysis
destruct_2 = DeconstructStructure(Structure=struct_5)  # -> Nodes, Elements
deelem = DeconstructElement(Element=destruct_2.Elements)  # -> Name, ElementIndex, EndNodesIndexes, Line, FreeLength, CrossSection, Material, Weight, Tension, TminTmaxKN
denode = DeconstructNode(Node=destruct_2.Nodes)  # -> PtM, Index, IsFree, LKN, UnbalancedLoad, Reactions

# ---- group: Display angle / All Nodes
# DISPLAY GEOMETRY INFO
pt_15 = Point(denode.PtM)

# ---- group: Display angle
tag_vertical_offset_2 = Slider(-0.49, range=-1..0)
amplify_factor_2 = Slider(1.45, range=0.75..2)
text_size_2 = Panel("0.10")
ugly_code_to_display_angles_2 = UglyCodeToDisplayAngles(pt=pt_15, C=Slider(1, range=1..3), num_3=text_size_2, num=amplify_factor_2, L=tag_vertical_offset_2)  # -> D, pt_4, R_2, i_2, R, num_5, V, i_3, i, i_4
angledim_2 = AngularDimension(
    Center=ugly_code_to_display_angles_2.pt_4,
    PointA=ugly_code_to_display_angles_2.R_2,
    PointB=ugly_code_to_display_angles_2.R,
    Reflex=False,
    Text="{0:0.0}°",
    Size=ugly_code_to_display_angles_2.num_5)
tag_2 = TextTag3D(
    Location=ugly_code_to_display_angles_2.i_3,
    Text=ugly_code_to_display_angles_2.i_4,
    Size=ugly_code_to_display_angles_2.num_5,
    Justification=3)
vdis_3 = VectorDisplay(Anchor=ugly_code_to_display_angles_2.i, Vector=ugly_code_to_display_angles_2.V)
vdis_4 = VectorDisplay(Anchor=ugly_code_to_display_angles_2.i_2, Vector=expr("-x", ugly_code_to_display_angles_2.V))
alpha_2 = Panel(ugly_code_to_display_angles_2.D)

# ---- group: Preview axial forces
showf = ShowForces(
    Lines=deelem.Line,
    Forces=deelem.Tension,
    TensionThickness="3",
    CompressionThickness=expr("x*2", "3"),
    ValueSettings="2",
    TextSize=0.1)

# ---- group: prestressed structure
struct_6 = Structure(struct_5)

# ---- group: double click to compute
compute = BooleanToggle(False)  # disabled
gate = StreamGate(Stream=struct_6, Gate=compute)  # -> Target0, Target1; disabled

compute_2 = BooleanToggle(True)
gate_2 = StreamGate(Stream=struct_6, Gate=compute_2)  # -> Target0, Target1

# ---- group: initially prestressed structure
struct_7 = Structure(gate.Target1)  # disabled

# ---- group: Preview Displacements / prestressed nodes
pt_16 = Point(denode.PtM)

pt_17 = Point(denode.PtM)  # disabled

# ---- group: prestressed structure
struct_8 = Structure(struct_6)

# ----
destruct_3 = DeconstructStructure(Structure=struct_8)  # -> Nodes, Elements
mass = ConstructPointMass(Point=destruct_3.Nodes, MKg=num_4)
dynamic = DynamicModalAnalysis(Structure=struct_8, PointMKg=mass, ElementMassMatrix=2, NModes=0)  # -> Structure, NaturalFrequencies, NaturalModes, PointMKg

matrix_input_2 = ToMatrixInputs(Tree=localize.LocalisedSelfStressModes)  # -> Rows, Columns, Rows_2; disabled
matrix_3 = ConstructMatrix(Rows=matrix_input_2.Rows, Columns=matrix_input_2.Columns, Values=matrix_input_2.Rows_2)  # disabled
transpose = TransposeMatrix(Matrix=matrix_2)  # disabled

# ---- group: Localized self stress mode S
transpose_2 = TransposeMatrix(Matrix=matrix_3)  # disabled

# ---- group: S
matrix_4 = DisplayMatrix(transpose_2)  # disabled

# ---- group: Vs_T * S =
multiplication_3 = Multiplication(A=matrix_2, B=matrix_4)  # disabled

# ---- group: Theta
matrix_5 = DisplayMatrix(multiplication_3)  # disabled

# ---- group: Vs * Theta =
multiplication_4 = Multiplication(A=transpose, B=matrix_5)  # disabled

# ----
dematrix = DeconstructMatrix(Matrix=multiplication_4)  # -> Rows, Columns, Values; disabled

# ---- group: Preview self-stress mode S
panel_3 = Panel("2")  # disabled
panel_4 = Panel("3")  # disabled
showf_2 = ShowForces(
    Lines=cluster_9,
    Forces=dematrix.Values,
    TensionThickness=panel_4,
    CompressionThickness=expr("x*2", panel_4),
    ValueSettings=panel_3,
    TextSize=0.1)  # disabled

# ---- group: S
matrix_6 = DisplayMatrix(multiplication_4)  # disabled

# ---- group: localized modes S (-)
matrix_7 = Matrix(matrix_6)  # disabled

# ---- group: Compute self-stress scenario / localized modes S
num_6 = Number(dematrix.Values)  # disabled

# ---- group: Preview Mechanism
scale = Slider(4, range=1..5)  # disabled
swatch = ColourSwatch(SwatchColor=RGB(0, 0, 0))  # disabled
line_width = Panel("2")  # disabled
pt_18 = Point(pt_14)  # disabled
vec_4 = Vector(cluster_8)  # disabled

# ---- group: Preview Mechanism / Vector X,Y,Z components
vector_components = VectorComponents(pt=pt_18, vec=vec_4, num=scale)  # -> pt_4, vec_4; disabled

# ---- group: Preview Mechanism / Rescaled vector
cluster_10 = Cluster_10(pt=pt_18, vec=vec_4, scale=scale)  # -> pt_2, vec_2; disabled

# ---- group: Preview Mechanism (continued)
vdisex = VectorDisplayEx(Point=cluster_10.pt_2, Vector=cluster_10.vec_2, Colour=swatch, Width=expr("x*3", line_width))  # disabled
vdisex_2 = VectorDisplayEx(Point=vector_components.pt_4, Vector=vector_components.vec_4, Colour=RGB(0, 0, 0), Width=line_width)  # disabled

# ----
# SELF-STRESS STATE
panel_5 = Panel("SelfStressLevels")  # disabled
gc = GenesCount(GenesName=panel_5, Count=num_3)  # disabled
ref_1_2 = Panel("FIGURE 3")  # disabled
matrix_8 = ConstructMatrix(Rows=num_3, Columns=1, Values=selfstresslevels)  # disabled
multiplication_5 = Multiplication(A=matrix_7, B=matrix_8)  # disabled

# ---- group: self stress state: t = S*a (kN)
matrix_9 = DisplayMatrix(multiplication_5, Digits=2)  # disabled

# ----
dematrix_2 = DeconstructMatrix(Matrix=matrix_9)  # -> Rows, Columns, Values; disabled

# ---- group: Preview self-stress state t
panel_6 = Panel("2")  # disabled
panel_7 = Panel("3")  # disabled
showf_3 = ShowForces(
    Lines=cluster_9,
    Forces=dematrix_2.Values,
    TensionThickness=panel_7,
    CompressionThickness=expr("x*2", panel_7),
    ValueSettings=panel_6,
    TextSize=0.1)  # disabled

# ---- group: Compute self-stress scenario
step_number = Slider(4, range=0..4)  # disabled
self_stress_level_increments_kn = Panel("""1
1.7
3.4
5.1
6.8""")  # disabled
ref_1_3 = Panel("table 3")  # disabled
item_4 = ListItem(List=self_stress_level_increments_kn, Index=step_number, Wrap=True)  # disabled

# ---- group: Compute self-stress scenario / additional self-stress forces (kN)
multiplication_6 = Multiplication(A=num_6, B=item_4)  # disabled

# ---- group: Compute self-stress scenario (continued)
selfstress = SelfStressScenario(Structure=struct_2, TargetTensions=multiplication_6)  # disabled
self_stress_scenario = Panel(selfstress)  # disabled

# ----
# APPLY SELF-STRESS SCENARIO
# ref (1): results for FIGURE 5g
initial_selfstress_level_kn = Panel("1.5")  # disabled
dr_2 = DynamicRelaxationMethod(
    Structure=struct_7,
    Prestress=selfstress,
    RelativeTolerance=0.0001,
    AbsoluteTolerance=0.01,
    DeltaT=0.01,
    MaxTimeStep=10000,
    MaxPeakReset=1000,
    MassAmplification=1,
    MinimumMass=0.005)  # -> Structure, IsInEquilibrium, TimeStep, PeakReset; disabled

# ---- group: highly selfstressed structure
struct_9 = Structure(dr_2.Structure)  # disabled

# ---- group: results analysis
destruct_4 = DeconstructStructure(Structure=struct_9)  # -> Nodes, Elements; disabled
deelem_2 = DeconstructElement(Element=destruct_4.Elements)  # -> Name, ElementIndex, EndNodesIndexes, Line, FreeLength, CrossSection, Material, Weight, Tension, TminTmaxKN; disabled
denode_2 = DeconstructNode(Node=destruct_4.Nodes)  # -> PtM, Index, IsFree, LKN, UnbalancedLoad, Reactions; disabled

# ---- group: Preview reactions
number_slider_4 = Slider(0.3, range=0..1)  # disabled
preview_support = PreviewSupport(relay=denode_2.PtM, A=denode_2.Reactions, B=number_slider_4)  # -> R, V; disabled
vdisex_3 = VectorDisplayEx(Point=preview_support.R, Vector=preview_support.V, Colour=RGB(0, 0, 0), Width=4)  # disabled

# ---- group: Preview Displacements / highly prestressed nodes
pt_19 = Point(denode_2.PtM)  # disabled

# ---- group: displacements
vec2pt = Vector2Pt(PointA=pt_17, PointB=pt_19, Unitize=False)  # -> Vector, Length; disabled

# ---- group: Preview axial forces
panel_8 = Panel("2")  # disabled
panel_9 = Panel("3")  # disabled
showf_4 = ShowForces(
    Lines=deelem_2.Line,
    Forces=deelem_2.Tension,
    TensionThickness=panel_9,
    CompressionThickness=expr("x*2", panel_9),
    ValueSettings=panel_8,
    TextSize=0.1)  # disabled

# ---- group: Preview Displacements
vdisex_4 = VectorDisplayEx(Point=pt_17, Vector=vec2pt.Vector, Colour=RGB(0, 0, 0), Width=4)  # disabled

# ---- group: Display angle / All Nodes
pt_20 = Point(denode_2.PtM)  # disabled

# ---- group: Display angle
tag_vertical_offset_3 = Slider(-0.49, range=-1..0)  # disabled
amplify_factor_3 = Slider(1.45, range=0.75..2)  # disabled
number_slider_5 = Slider(1, range=1..3)  # disabled
text_size_3 = Panel("0.10")  # disabled
ugly_code_to_display_angles_3 = UglyCodeToDisplayAngles(pt=pt_20, C=number_slider_5, num_3=text_size_3, num=amplify_factor_3, L=tag_vertical_offset_3)  # -> D, pt_4, R_2, i_2, R, num_5, V, i_3, i, i_4; disabled
angledim_3 = AngularDimension(
    Center=ugly_code_to_display_angles_3.pt_4,
    PointA=ugly_code_to_display_angles_3.R_2,
    PointB=ugly_code_to_display_angles_3.R,
    Reflex=False,
    Text="{0:0.0}°",
    Size=ugly_code_to_display_angles_3.num_5)  # disabled
tag_3 = TextTag3D(
    Location=ugly_code_to_display_angles_3.i_3,
    Text=ugly_code_to_display_angles_3.i_4,
    Size=ugly_code_to_display_angles_3.num_5,
    Justification=3)  # disabled
vdis_5 = VectorDisplay(Anchor=ugly_code_to_display_angles_3.i, Vector=ugly_code_to_display_angles_3.V)  # disabled
vdis_6 = VectorDisplay(Anchor=ugly_code_to_display_angles_3.i_2, Vector=expr("-x", ugly_code_to_display_angles_3.V))  # disabled
alpha_3 = Panel(ugly_code_to_display_angles_3.D)  # disabled

# ----
# INCREASE PRESTRESS LEVEL
struct_10 = Structure(gate_2.Target1)

# ---- group: lengthening of all struts
destruct_5 = DeconstructStructure(Structure=struct_10)  # -> Nodes, Elements
step_number_2 = Slider(7, range=0..7)
length_variation_mm = Panel("""0.0
0.6
1.2
1.8
2.4
3.0
3.6
3.94
4.14""")
struts_grp_idx = Panel("0")
E_5 = Element(destruct_5.Elements)
cluster_11 = Cluster_14(all_elements=E_5, B=struts_grp_idx)
item_5 = ListItem(List=length_variation_mm, Index=step_number_2, Wrap=True)
lengthening_mm = Panel(item_5)
P_2 = Prestress(Element=cluster_11, FreeLengthVariation=expr("x/1000", lengthening_mm))

# ----
dr_3 = DynamicRelaxationMethod(
    Structure=struct_10,
    Prestress=P_2,
    RelativeTolerance=0.0001,
    AbsoluteTolerance=0.01,
    DeltaT=0.01,
    MaxTimeStep=10000,
    MaxPeakReset=1000,
    MassAmplification=1,
    MinimumMass=0.005)  # -> Structure, IsInEquilibrium, TimeStep, PeakReset

# ---- group: highly prestressed structure
struct_11 = Structure(dr_3.Structure)

# ---- group: results analysis
destruct_6 = DeconstructStructure(Structure=struct_11)  # -> Nodes, Elements
deelem_3 = DeconstructElement(Element=destruct_6.Elements)  # -> Name, ElementIndex, EndNodesIndexes, Line, FreeLength, CrossSection, Material, Weight, Tension, TminTmaxKN
denode_3 = DeconstructNode(Node=destruct_6.Nodes)  # -> PtM, Index, IsFree, LKN, UnbalancedLoad, Reactions

# ---- group: Preview reactions
preview_support_2 = PreviewSupport(relay=denode_3.PtM, A=denode_3.Reactions, B=Slider(0.3, range=0..1))  # -> R, V
vdisex_5 = VectorDisplayEx(Point=preview_support_2.R, Vector=preview_support_2.V, Colour=RGB(0, 0, 0), Width=4)

# ---- group: Preview Displacements / highly prestressed nodes
pt_21 = Point(denode_3.PtM)

# ---- group: displacements
vec2pt_2 = Vector2Pt(PointA=pt_16, PointB=pt_21, Unitize=False)  # -> Vector, Length

# ---- group: Preview axial forces
showf_5 = ShowForces(
    Lines=deelem_3.Line,
    Forces=deelem_3.Tension,
    TensionThickness="3",
    CompressionThickness=expr("x*2", "3"),
    ValueSettings="2",
    TextSize=0.1)

# ---- group: Preview Displacements
vdisex_6 = VectorDisplayEx(Point=pt_16, Vector=vec2pt_2.Vector, Colour=RGB(0, 0, 0), Width=4)

# ---- group: Display angle / All Nodes
pt_22 = Point(denode_3.PtM)

# ---- group: Display angle
tag_vertical_offset_4 = Slider(-0.49, range=-1..0)
amplify_factor_4 = Slider(1.45, range=0.75..2)
text_size_4 = Panel("0.10")
ugly_code_to_display_angles_4 = UglyCodeToDisplayAngles(pt=pt_22, C=Slider(1, range=1..3), num_3=text_size_4, num=amplify_factor_4, L=tag_vertical_offset_4)  # -> D, pt_4, R_2, i_2, R, num_5, V, i_3, i, i_4
angledim_4 = AngularDimension(
    Center=ugly_code_to_display_angles_4.pt_4,
    PointA=ugly_code_to_display_angles_4.R_2,
    PointB=ugly_code_to_display_angles_4.R,
    Reflex=False,
    Text="{0:0.0}°",
    Size=ugly_code_to_display_angles_4.num_5)
tag_4 = TextTag3D(
    Location=ugly_code_to_display_angles_4.i_3,
    Text=ugly_code_to_display_angles_4.i_4,
    Size=ugly_code_to_display_angles_4.num_5,
    Justification=3)
vdis_7 = VectorDisplay(Anchor=ugly_code_to_display_angles_4.i, Vector=ugly_code_to_display_angles_4.V)
vdis_8 = VectorDisplay(Anchor=ugly_code_to_display_angles_4.i_2, Vector=expr("-x", ugly_code_to_display_angles_4.V))
alpha_4 = Panel(ugly_code_to_display_angles_4.D)

# ----
# APPLY EXTERNAL LOADS
struct_12 = Structure(struct_11)
struct_13 = Structure(struct_12)

# ---- group: Define Loads
loading_step = Slider(8, range=0..21)
incremental_loading_n_node = Panel("""0.0
112.3
210.4
308.5
406.6
504.7
602.8
700.9
799.0
897.1
995.2
1093.3
1191.4
1289.5
1389.5
1489.5
1589.5
1689.5
1789.5
1887.6
1985.7
2083.8""")
loaded_node_idx = Panel("""3
4
5""")
struct_14 = Structure(struct_12)
destruct_7 = DeconstructStructure(Structure=struct_14)  # -> Nodes, Elements
cluster_12 = Cluster_16(L=incremental_loading_n_node, i=loading_step)
item_6 = ListItem(List=destruct_7.Nodes, Index=loaded_node_idx, Wrap=True)
load_2 = PointLoad(Point=item_6, Vector=cluster_12)

# ---- group: Dynamic Relaxation Solver
dr_4 = DynamicRelaxationMethod(
    Structure=struct_13,
    PointLoads=load_2,
    RelativeTolerance=0.0001,
    AbsoluteTolerance=0.01,
    DeltaT=0.01,
    MaxTimeStep=10000,
    MaxPeakReset=1000,
    MassAmplification=1,
    MinimumMass=0.005)  # -> Structure, IsInEquilibrium, TimeStep, PeakReset

# ---- group: Loaded structure
struct_15 = Structure(dr_4.Structure)

# ---- group: results analysis
destruct_8 = DeconstructStructure(Structure=struct_15)  # -> Nodes, Elements
deelem_4 = DeconstructElement(Element=destruct_8.Elements)  # -> Name, ElementIndex, EndNodesIndexes, Line, FreeLength, CrossSection, Material, Weight, Tension, TminTmaxKN
denode_4 = DeconstructNode(Node=destruct_8.Nodes)  # -> PtM, Index, IsFree, LKN, UnbalancedLoad, Reactions

# ---- group: Preview reactions
preview_support_3 = PreviewSupport(relay=denode_4.PtM, A=denode_4.Reactions, B=Slider(0.3, range=0..1))  # -> R, V
vdisex_7 = VectorDisplayEx(Point=preview_support_3.R, Vector=preview_support_3.V, Colour=RGB(0, 0, 0), Width=4)

# ---- group: Preview Displacements / loaded nodes
pt_23 = Point(denode_4.PtM)

# ---- group: Preview Displacements / prestressed nodes
pt_24 = Point(denode_3.PtM)

# ---- group: Preview Displacements / displacements
vec2pt_3 = Vector2Pt(PointA=pt_24, PointB=pt_23, Unitize=False)  # -> Vector, Length

# ---- group: Preview axial forces
showf_6 = ShowForces(
    Lines=deelem_4.Line,
    Forces=deelem_4.Tension,
    TensionThickness="3",
    CompressionThickness=expr("x*2", "3"),
    ValueSettings="2",
    TextSize=0.1)

# ---- group: Preview Displacements
vdisex_8 = VectorDisplayEx(Point=pt_24, Vector=vec2pt_3.Vector, Colour=RGB(0, 0, 0), Width=4)

# ---- group: Display angle / All Nodes
pt_25 = Point(denode_4.PtM)

# ---- group: Display angle
tag_vertical_offset_5 = Slider(-0.49, range=-1..0)
amplify_factor_5 = Slider(1.45, range=0.75..2)
text_size_5 = Panel("0.10")
ugly_code_to_display_angles_5 = UglyCodeToDisplayAngles(pt=pt_25, C=Slider(1, range=1..3), num_3=text_size_5, num=amplify_factor_5, L=tag_vertical_offset_5)  # -> D, pt_4, R_2, i_2, R, num_5, V, i_3, i, i_4
angledim_5 = AngularDimension(
    Center=ugly_code_to_display_angles_5.pt_4,
    PointA=ugly_code_to_display_angles_5.R_2,
    PointB=ugly_code_to_display_angles_5.R,
    Reflex=False,
    Text="{0:0.0}°",
    Size=ugly_code_to_display_angles_5.num_5)
tag_5 = TextTag3D(
    Location=ugly_code_to_display_angles_5.i_3,
    Text=ugly_code_to_display_angles_5.i_4,
    Size=ugly_code_to_display_angles_5.num_5,
    Justification=3)
vdis_9 = VectorDisplay(Anchor=ugly_code_to_display_angles_5.i, Vector=ugly_code_to_display_angles_5.V)
vdis_10 = VectorDisplay(Anchor=ugly_code_to_display_angles_5.i_2, Vector=expr("-x", ugly_code_to_display_angles_5.V))
alpha_5 = Panel(ugly_code_to_display_angles_5.D)

# ==== cluster CreateStructure
C = ClusterInput()
A = ClusterInput()
N = ClusterInput()
pframes = PerpFrames(Curve=C, Count=N, Align=True)  # -> Frames, Parameters
rotate = Rotate(Geometry=pframes.Frames, Angle=A, Plane=pframes.Frames)  # -> Geometry, Transform
planes = ClusterOutput(rotate.Geometry)

# ==== cluster RotateBasePlanes
relay = ClusterInput()
angle_rad = ClusterInput()

# ---- group: nbr of planes
lng = ListLength(List=relay)

# ---- group: 0 Alterned angles
repeat = RepeatData(Data=flatten(["0", angle_rad]), Length=lng)  # -> flatten(Data)
plane_angles_rad = Panel(repeat)

# ----
_0_alterned_1_spiral = ClusterInput()

# ---- group: 1 Spiral angles
series = Series(Start=0, Step=angle_rad, Count=lng)  # -> flatten(Series)
plane_angles_rad_2 = Panel(series)

# ---- group: Chosen Angles
filter = StreamFilter(Gate=_0_alterned_1_spiral, Stream0=plane_angles_rad, Stream1=plane_angles_rad_2)

# ----
rotate = Rotate(Geometry=relay, Angle=filter, Plane=relay)  # -> Geometry, Transform
G = ClusterOutput(rotate.Geometry)

# ==== cluster Cluster
C = ClusterInput()
explode = Explode(Curve=C, Recursive=True)  # -> simplify(Segments), simplify(Vertices)
cset = CreateSet(List=explode.Vertices)  # -> Set, Map
S = ClusterOutput(explode.Segments)
S_2 = ClusterOutput(cset.Set)

# ==== cluster LongCables
T = ClusterInput()
viewer = ParamViewer(T)
points = PointList(Points=T, Size="0.5")
shift = ShiftList(List=viewer, Shift=-1, Wrap=False)
shift_2 = ShiftList(List=viewer, Shift=1, Wrap=False)
panel = Panel(shift_2)
panel_2 = Panel(shift)
branch = TreeBranch(Tree=T, Path=panel_2, MaintainPaths=True)
branch_2 = TreeBranch(Tree=T, Path=panel, MaintainPaths=True)
ln = Line(StartPoint=branch, EndPoint=branch_2)
L = ClusterOutput(ln)

# ==== cluster Cluster_2
nodes = ClusterInput()
planes = ClusterInput()
bool = ClusterInput()
deplane = DeconstructPlane(Plane=planes)  # -> Origin, XAxis, YAxis, ZAxis

# ---- group: nbr of points per plane
lng = ListLength(List=nodes)

# ---- group: Points on initial curve
pt = Point(simplify(graft(deplane.Origin)))

# ----
repeat = RepeatData(Data=pt, Length=lng)  # -> simplify(Data)

# ---- group: Additional transversal cables
ln = Line(StartPoint=nodes, EndPoint=repeat)

# ---- group: Draw add transv. cables ?
filter = StreamFilter(Gate=bool, Stream1=ln)  # -> simplify(Stream)

# ---- group: Draw add center points ?
filter_2 = StreamFilter(Gate=bool, Stream1=pt)  # -> simplify(Stream)

# ----
cables = ClusterOutput(filter)
points = ClusterOutput(filter_2)

# ==== cluster Cluster_3
alterned_spiral = ClusterInput()
nodes = ClusterInput()
gate = StreamGate(Stream=nodes, Gate=alterned_spiral)  # -> Target0, Target1
nbr_add_cables = ClusterInput()
points = PointList(Points=gate.Target0, Size="0.5")

# ---- group: Spiral
points_2 = PointList(Points=gate.Target1, Size="0.5")
viewer = ParamViewer(gate.Target1)
shift = ShiftList(List=viewer, Shift=-1, Wrap=False)
shift_2 = ShiftList(List=viewer, Shift=1, Wrap=False)
panel = Panel(shift_2)
panel_2 = Panel(shift)
panel_3 = Panel("-1")

# ---- group: Spiral / Top Points not shifted
branch = TreeBranch(Tree=gate.Target1, Path=panel, MaintainPaths=True)

# ---- group: Spiral / Top Points
shift_3 = ShiftList(List=branch, Shift=panel_3, Wrap=True)  # -> simplify(List)

# ---- group: Spiral / Bottom Points
branch_2 = TreeBranch(Tree=gate.Target1, Path=panel_2, MaintainPaths=True)

# ---- group: cables to draw
series = Series(Start=0, Step=1, Count=nbr_add_cables)

# ---- group: Alterned
# Description: The nodes index of one branch over two must be shifted due to alterned configuration
viewer_2 = ParamViewer(gate.Target0)
panel_4 = Panel("""True
False""")
panel_5 = Panel("""False
True""")
cull = CullPattern(List=viewer_2, CullPattern=panel_4)
cull_2 = CullPattern(List=viewer_2, CullPattern=panel_5)
panel_6 = Panel(cull)
panel_7 = Panel(cull_2)
branch_3 = TreeBranch(Tree=gate.Target0, Path=panel_7, MaintainPaths=True)
panel_8 = Panel("-1")

# ---- group: Alterned / Regular Branch
branch_4 = TreeBranch(Tree=gate.Target0, Path=panel_6, MaintainPaths=True)

# ---- group: Alterned / Alterned Branch
bot = ShiftList(List=branch_3, Shift=panel_8, Wrap=True)  # -> simplify(List)

# ---- group: Alterned / Nodes tree with alterned branch
merge = Merge(Data1=branch_4, Data2=bot)  # -> simplify(Result)

# ---- group: Alterned (continued)
viewer_3 = ParamViewer(merge)
shift_4 = ShiftList(List=viewer_3, Shift=-1, Wrap=False)
shift_5 = ShiftList(List=viewer_3, Shift=1, Wrap=False)
panel_9 = Panel(shift_5)
panel_10 = Panel(shift_4)

# ----
points_3 = PointList(Points=merge, Size="0.5")

# ---- group: Alterned / Bottom Points
branch_5 = TreeBranch(Tree=merge, Path=panel_10, MaintainPaths=True)

# ---- group: Alterned / Top Points
branch_6 = TreeBranch(Tree=merge, Path=panel_9, MaintainPaths=True)

# ---- group: Bottom Points - Alterned or Spiral ?
filter = StreamFilter(Gate=alterned_spiral, Stream0=branch_5, Stream1=branch_2)

# ---- group: Top Points - Alterned or Spiral ?
filter_2 = StreamFilter(Gate=alterned_spiral, Stream0=branch_6, Stream1=shift_3)

# ---- group: Bottom points to draw
selection_of_start_points = ListItem(List=filter, Index=series, Wrap=True)

# ---- group: Top Points to draw
item = ListItem(List=filter_2, Index=series, Wrap=True)

# ---- group: Additional long cables
ln = Line(StartPoint=selection_of_start_points, EndPoint=item)

# ----
L = ClusterOutput(ln)

# ==== cluster Cluster_4
nodes = ClusterInput()
alterned_spiral = ClusterInput()
viewer = ParamViewer(nodes)
points = PointList(Points=nodes, Size="0.5")
panel = Panel("""1
-1""")
shift = ShiftList(List=viewer, Shift=-1, Wrap=False)
shift_2 = ShiftList(List=viewer, Shift=1, Wrap=False)
lng = ListLength(List=shift_2)
repeat = RepeatData(Data=panel, Length=lng)  # -> simplify(graft(Data))
panel_2 = Panel(shift_2)
panel_3 = Panel(shift)
panel_4 = Panel(repeat)

# ---- group: Alterned or Spiral ?
filter = StreamFilter(Gate=alterned_spiral, Stream0=panel_4, Stream1="1")

# ---- group: Bottom points
branch = TreeBranch(Tree=nodes, Path=panel_3, MaintainPaths=True)

# ---- group: Top Points
branch_2 = TreeBranch(Tree=nodes, Path=panel_2, MaintainPaths=True)

# ---- group: Top Points Shifted
shift_3 = ShiftList(List=branch_2, Shift=filter, Wrap=True)  # -> simplify(List)

# ----
points_2 = PointList(Points=branch, Size="0.5")
points_3 = PointList(Points=shift_3, Size="0.5")
ln = Line(StartPoint=branch, EndPoint=shift_3)
L = ClusterOutput(ln)

# ==== cluster Cluster_5
P = ClusterInput()
A = ClusterInput()
B = ClusterInput()
pdecon = Deconstruct(Point=P)  # -> XComponent, YComponent, ZComponent
B_2 = ClusterInput()
N = ClusterInput()
multiplication = Multiplication(A=A, B=B)
dom = ConstructDomain(DomainStart=pdecon.ZComponent, DomainEnd=B_2)
range = Range(Domain=dom, Steps=N)
addition = Addition(A=pdecon.XComponent, B=multiplication)
panel = Panel(multiplication)
pt = ConstructPoint(XCoordinate=addition, YCoordinate=pdecon.YComponent, ZCoordinate=range)
pline = PolyLine(Vertices=pt, Closed=False)
pl = ClusterOutput(pline)

# ==== cluster Cluster_6
pt = ClusterInput()
pt_2 = Point(pt)
item = ListItem(List=pt_2, Index="0", Wrap=True)
item_2 = ListItem(List=pt_2, Index="1", Wrap=True)
item_3 = ListItem(List=pt_2, Index="2", Wrap=True)
merge = Merge(Data1=item_3, Data2=item_2, Data3=item)
pt_3 = Point(flatten(merge))
pt_4 = ClusterOutput(pt_3)

# ==== cluster Cluster_7
pt = ClusterInput()
pt_2 = Point(pt)
F = ClusterInput()
Z = UnitZ(Factor=F)
R = ClusterInput()
eval = Evaluate(F="Format(\"{0:0.0} {1:0.0} {2:0.0}\", x.x*1000, x.y*1000, x.z*1000)", x=pt_2)
addition = Addition(A=pt_2, B=Z)
sph = Sphere(Base=pt_2, Radius=R)
r = ClusterOutput(eval)
R_2 = ClusterOutput(addition)
S = ClusterOutput(sph)
swatch = ClusterOutput(ColourSwatch(SwatchColor=RGB(0, 0, 0)))

# ==== cluster Cluster_8
struct = ClusterInput()
destruct = DeconstructStructure(Structure=struct)  # -> Nodes, Elements
deelem = DeconstructElement(Element=destruct.Elements)  # -> Name, ElementIndex, EndNodesIndexes, Line, FreeLength, CrossSection, Material, Weight, Tension, TminTmaxKN
L = ClusterOutput(deelem.Line)

# ==== cluster SelectMode
I = ClusterInput()
T = ClusterInput()
path = ConstructPath(Indices=I)
branch = TreeBranch(Tree=T, Path=path, MaintainPaths=True)
B = ClusterOutput(branch)

# ==== cluster Cluster_9
vec = ClusterInput()
vec_2 = Vector(vec)
devec = DeconstructVector(Vector=vec_2)  # -> XComponent, YComponent, ZComponent
bnd = Bounds(Numbers=devec.ZComponent)
dedomain = DeconstructDomain(Domain=bnd)  # -> Start, End
multiplication = Multiplication(A=dedomain.End, B=-1)
division = Division(A=vec_2, B=multiplication)
vec_3 = Vector(division)
vec_4 = ClusterOutput(vec_3)

# ==== cluster VectorComponents
vec = ClusterInput()
num = ClusterInput()
pt = ClusterInput()
vec_2 = Vector(vec)
num_2 = Number(num)
pt_2 = Point(pt)
devec = DeconstructVector(Vector=vec_2)  # -> XComponent, YComponent, ZComponent
Y = UnitY(Factor=devec.YComponent)
Z = UnitZ(Factor=devec.ZComponent)
X = UnitX(Factor=devec.XComponent)
division = Division(A=X, B=num_2)
division_2 = Division(A=Y, B=num_2)
division_3 = Division(A=Z, B=num_2)
entwine = Entwine(Branch00=pt_2, Branch01=pt_2, Branch02=pt_2, FlattenInputs=True)
entwine_2 = Entwine(Branch00=division, Branch01=division_2, Branch02=division_3, FlattenInputs=True)
pt_3 = Point(entwine)
vec_3 = Vector(entwine_2)
pt_4 = ClusterOutput(pt_3)
vec_4 = ClusterOutput(vec_3)

# ==== cluster Cluster_10
vec = ClusterInput()
scale = ClusterInput()
pt = ClusterInput()
division = Division(Vec=vec, Scale=scale)
pt_2 = ClusterOutput(pt)
vec_2 = ClusterOutput(division)

# ==== cluster UglyCodeToDisplayAngles
pt = ClusterInput()
C = ClusterInput()
num = ClusterInput()
pt_2 = Point(pt)
series = Series(Start=0, Step=1, Count=C)
cluster = Cluster_11(pt=pt_2)  # -> am, bottom_nodes, G
num_2 = Number(num)
int = Integer(series)
L = ClusterInput()
cluster_2 = Cluster_12(L=pt_2)
item = ListItem(List=cluster_2, Index=int, Wrap=True)
item_2 = ListItem(List=cluster.G, Index=int, Wrap=True)
item_3 = ListItem(List=cluster.bottom_nodes, Index=int, Wrap=True)
item_4 = ListItem(List=L, Index=int, Wrap=True)
subtraction = Subtraction(A=item, B=item_3)
pt_3 = Point(cluster.am)
i = ClusterOutput(item)
pt_4 = ClusterOutput(pt_3)
Z = UnitZ(Factor=item_4)
i_2 = ClusterOutput(item_2)
eval = Evaluate(F="Format(\"{0:0.0}\", x.z*1000)", x=subtraction)
vec2pt = Vector2Pt(PointA=item, PointB=item_2, Unitize=False)  # -> Vector, Length
Z_2 = UnitZ(Factor=1)
cluster_3 = Cluster_13(A_2=pt_3, A=pt_3, B=item_2, B_2=num_2)
cluster_4 = Cluster_13(A_2=pt_3, A=pt_3, B=item_3, B_2=num_2)
addition = Addition(A=item, B=Z)
pl = ConstructPlane(Origin=addition, XAxis=Z_2, YAxis=Vector(0, 1, 0))
vec2pt_2 = Vector2Pt(PointA=pt_3, PointB=cluster_4, Unitize=False)  # -> Vector, Length
vec2pt_3 = Vector2Pt(PointA=pt_3, PointB=cluster_3, Unitize=False)  # -> Vector, Length
V = ClusterOutput(vec2pt.Vector)
R = ClusterOutput(cluster_3)
R_2 = ClusterOutput(cluster_4)
num_3 = ClusterInput()
angle = Angle(VectorA=vec2pt_2.Vector, VectorB=vec2pt_3.Vector)  # -> Angle, Reflex
item_5 = ListItem(List=pl, Index="0", Wrap=True)
item_6 = ListItem(List=eval, Index="0", Wrap=True)
deg = Degrees(Radians=angle.Angle)
num_4 = Number(num_3)
i_3 = ClusterOutput(item_5)
i_4 = ClusterOutput(item_6)
num_5 = ClusterOutput(num_4)
D = ClusterOutput(deg)

# ==== cluster Cluster_14
all_elements = ClusterInput()
deelem = DeconstructElement(Element=all_elements)  # -> Name, ElementIndex, EndNodesIndexes, Line, FreeLength, CrossSection, Material, Weight, Tension, TminTmaxKN
B = ClusterInput()
cset = CreateSet(List=deelem.Name)  # -> Set, Map
equals = Equality(FirstNumber=cset.Map, SecondNumber=B)  # -> Equality, Inequality
cull = CullPattern(List=all_elements, CullPattern=equals.Equality)
struts = ClusterOutput(cull)

# ==== cluster PreviewSupport
relay = ClusterInput()
A = ClusterInput()
B = ClusterInput()
multiplication = Multiplication(A=A, B=B)
subtraction = Subtraction(A=relay, B=multiplication)
R = ClusterOutput(subtraction)
V = ClusterOutput(multiplication)

# ==== cluster Cluster_16
L = ClusterInput()
i = ClusterInput()
item = ListItem(List=L, Index=i, Wrap=False)
applied_load_n_node = Panel(item)
cluster = Cluster_15(x=applied_load_n_node)
vec = ClusterOutput(cluster)

# ==== cluster Cluster_11
pt = ClusterInput()

# ---- group: All Nodes
pt_2 = Point(pt)

# ----
panel = Panel("""3
4
5""")
panel_2 = Panel("""0
1
2""")
item = ListItem(List=pt_2, Index=panel, Wrap=True)
item_2 = ListItem(List=pt_2, Index=panel_2, Wrap=True)

# ---- group: Bottom Nodes
pt_3 = Point(flatten(item_2))

# ---- group: Top Nodes
pt_4 = Point(item)

# ----
bang = ExplodeTree(Data=graft(pt_3))  # -> Branch0, Branch1, Branch2
pl_3pt = Plane3Pt(PointA=bang.Branch1, PointB=bang.Branch0, PointC=bang.Branch2)
pln = Plane(pl_3pt)
avr = Average(Input=pt_3)
project = Project(Geometry=pt_4, Plane=pln)  # -> Geometry, Transform
am = ClusterOutput(avr)
G = ClusterOutput(project.Geometry)
bottom_nodes = ClusterOutput(pt_3)

# ==== cluster Cluster_12
L = ClusterInput()
panel = Panel("""3
4
5""")
item = ListItem(List=L, Index=panel, Wrap=True)
pt = Point(item)
top_points = ClusterOutput(pt)

# ==== cluster Cluster_13
A = ClusterInput()
B = ClusterInput()
B_2 = ClusterInput()
vec2pt = Vector2Pt(PointA=A, PointB=B, Unitize=False)  # -> Vector, Length
A_2 = ClusterInput()
multiplication = Multiplication(A=vec2pt.Vector, B=B_2)
addition = Addition(A=A_2, B=multiplication)
R = ClusterOutput(addition)

# ==== cluster Cluster_15
x = ClusterInput()
neg = Negative(Value=x)
Z = UnitZ(Factor=neg)
division = Division(A=Z, B=1000)
vec = Vector(division)
vec_2 = ClusterOutput(vec)
