# Grasshopper definition TensegritySimplexAnalysis.gh (Grasshopper 1.0.7)
# plug-ins: Muscle, Muscles

muscles_version = Panel("Muscles v0.4")
toggle = BooleanToggle(True)
display = DisplaySettings(
    SupportsSize=Slider(0.1, range=0.01..2),
    LoadsSize=Slider(2.49, range=0.01..20),
    Decimal="1",
    GMS²=Vector(0, 0, -9.81),
    DynamicMassScale=1)
python = InitializePython(UserMode="false", StartPython=toggle, LogLevel=<missing>)
startpy = StartPythonNET(
    StartPython=toggle,
    UserMode="false",
    AnacondaDirectory="C:\Users\Jonas\Anaconda3",
    CondaEnvironmentName="base",
    Python3xxDllFile="python312.dll")

# ---- group: Dimension of reference
diameter_of_base_outer_circle_m = Slider(2.36, range=0.5..20)

# ---- group: Number of edges per module
reference_polygon = Slider(3, range=3..10)

# ---- group: Number of additional long cables per module
# Description: Structure can't have more add cables than edges
additional_long_cables = Slider(0, range=0..10)
min = Minimum(A=reference_polygon, B=additional_long_cables)

# ----
structure_alignement = Slider(0, range=-180..180)

# ---- group: Span
main_dimension_m = Slider(1.95, range=0.1..100)

# ---- group: Span / max excentricity f
main_dimension_m_2 = Slider(0, range=0..100)

# ---- group: Relative rotation between bases
# Alterned rotation
# Spiral rotation
relative_rotation = Slider(30, range=0..180)
relative_rotation_2 = ValueList({"Alterned": 0, "Spiral": 1}, selected="Alterned")

# ----
# INPUTS
pt = ConstructPoint(XCoordinate="0.59", YCoordinate="-1.02191", ZCoordinate="0")
number_of_modules = Slider(1, range=1..20)

# ---- group: nothing to do
cells_position_on_graph = Range(Domain=Domain(0, 1), Steps=number_of_modules)

# ---- group: Height profile along the curve
assembly_profile = GraphMapper(
    flatten(cells_position_on_graph),
    x0=0,
    x1=1,
    y0=0,
    y1=1,
    A=0,
    B=1,
    container_name="Linear",
    Graph_x0=0,
    Graph_x1=1,
    Graph_y0=1,
    Graph_y1=1)

# ----
cells_position_on_graph_2 = Range(Domain=Domain(0, 1), Steps=number_of_modules)

# ---- group: Curve shape
assembly_profile_2 = GraphMapper(flatten(cells_position_on_graph_2), x0=0, x1=1, y0=0, y1=1, Ox=0.4982714355, Oy=1, Px=1, Py=0, container_name="Parabola")

# ---- group: Draw additional transversal cables ?
add_transv_cables = BooleanToggle(False)

# ----
# Height profile
height_factor = Panel(assembly_profile)

# ---- group: Start point
pt_2 = Point(pt)

# ----
# DRAW GEOMETRY
multiplication = Multiplication(A=diameter_of_base_outer_circle_m, B=height_factor)
diameter_of_each_outer_circle = Panel(multiplication)

# ---- group: Create curve
cluster = Cluster_5(P=pt_2, B_2=main_dimension_m, N=number_of_modules, A=main_dimension_m_2, B=assembly_profile_2)

# ---- group: Create curve / curve
crv = Curve(cluster)

# ---- group: Create base planes / Structure Alignment (°)
rad = Radians(Degrees=structure_alignement)

# ---- group: Create base planes / curve
reference_curve = Curve(crv)

# ---- group: Create base planes / nbr modules
number_of_cells = Integer(number_of_modules)

# ---- group: Create base planes
create_structure = CreateStructure(C=reference_curve, N=number_of_cells, A=rad)

# ---- group: Create base planes / base planes
construction_planes = Plane(create_structure)

# ---- group: Rotate base planes / Rotation (°)
rad_2 = Radians(Degrees=relative_rotation)

# ---- group: Rotate base planes / 0 Alterned / 1 Spiral
rotation_type = Integer(relative_rotation_2)

# ---- group: Rotate base planes / base planes
pln = Plane(construction_planes)

# ---- group: Rotate base planes
rotate_base_planes = RotateBasePlanes(relay=pln, angle_rad=rad_2, _0_alterned_1_spiral=rotation_type)

# ---- group: Rotate base planes / Rotated base planes
construction_planes_2 = Plane(rotate_base_planes)

# ---- group: Create base cables and nodes / Base planes
pln_2 = Plane(construction_planes_2)

# ---- group: Create base cables and nodes / Diameters of outer circles
num = Number(diameter_of_each_outer_circle)

# ---- group: Create base cables and nodes / Nbr of edges
int = Integer(reference_polygon)

# ---- group: Create base cables and nodes
polygon = Polygon(Plane=pln_2, Radius=expr("x/2", num), Segments=int, FilletRadius=0)  # -> simplify(Polygon), Length
cluster_2 = Cluster(C=polygon.Polygon)  # -> S, S_2

# ---- group: Create base cables and nodes / Nodes
pt_3 = Point(cluster_2.S_2)

# ---- group: Create base cables and nodes / Base cables
line = Line(cluster_2.S)

# ---- group: Create Struts / Nodes
pt_4 = Point(pt_3)

# ---- group: Create Struts / 0 Alterned / 1 Spiral
rotation_type_2 = Integer(relative_rotation_2)

# ---- group: Create add long. cables / 0 Alterned / 1 Spiral
rotation_type_3 = Integer(relative_rotation_2)

# ---- group: Create add long. cables / nbr of add long cables
int_2 = Integer(min)

# ---- group: Create add transv. cables / add transverse cables ?
bool = Boolean(add_transv_cables)

# ---- group: Create add transv. cables / Bases planes
construction_planes_3 = Plane(construction_planes)

# ---- group: Create long Cables / Nodes
pt_5 = Point(pt_3)

# ---- group: Create add long. cables / Nodes
pt_6 = Point(pt_3)

# ---- group: Create add transv. cables / Nodes
pt_7 = Point(pt_3)

# ---- group: Create Struts
cluster_3 = Cluster_4(nodes=pt_4, alterned_spiral=rotation_type_2)

# ---- group: Create add long. cables
cluster_4 = Cluster_3(nodes=pt_6, alterned_spiral=rotation_type_3, nbr_add_cables=int_2)

# ---- group: Create add transv. cables
cluster_5 = Cluster_2(bool=bool, nodes=pt_7, planes=construction_planes_3)  # -> cables, points

# ---- group: Create long Cables
long_cables = LongCables(T=pt_5)

# ---- group: Create add long. cables / Add Long Cables
line_2 = Line(simplify(cluster_4))

# ---- group: Create add transv. cables / Add transv. Cables
line_3 = Line(simplify(cluster_5.cables))

# ---- group: Create long Cables / Long cables
line_4 = Line(long_cables)

# ---- group: Create Struts / Struts
line_5 = Line(cluster_3)

# ---- group: Create add transv. cables / Add center points
pt_8 = Point(cluster_5.points)

# ---- group: Nodes
pt_9 = Point(pt_3)

# ---- group: Add center points
pt_10 = Point(pt_8)

# ----
offset_z = Slider(0.15, range=0.01..1)

# ---- group: Base cables
line_6 = Line(line)

# ---- group: Long Cables
line_7 = Line(line_4)

# ---- group: Add long Cables
line_8 = Line(line_2)

# ---- group: Add Transv Cables
line_9 = Line(line_3)

# ---- group: Struts
line_10 = Line(line_5)

# ---- group: All Nodes
pt_11 = Point(pt_9)

# ---- group: Change nodes indexation
cluster_6 = Cluster_6(pt=pt_11)

# ----
Z = UnitZ(Factor=offset_z)
addition = Addition(A=cluster_6, B=Z)
eval = Evaluate(F="Format(\"{0:0.0} {1:0.0} {2:0.0}\", x.x*1000, x.y*1000, x.z*1000)", x=cluster_6)

# ---- group: Draw elements length
line_11 = Line(flatten([line_4, line_5, line_2, line]))
# DISPLAY GEOMETRY INFO
translation_z = Slider(-0.02, range=-1..1.1)
len = Length(Curve=line_11)
eval_2 = EvaluateCurve(Curve=line_11, Parameter="0.5")  # -> Point, Tangent, Angle
multiplication_2 = Multiplication(A=len, B=1000)
Z_2 = UnitZ(Factor=translation_z)
expression = Expression(x=multiplication_2, Expression="Format(\"{0:0.0}\", x)")
addition_2 = Addition(A=Z_2, B=eval_2.Point)
tag = TextTag(Location=addition_2, Text=expression, Colour=ColourSwatch(SwatchColor=RGB(153, 0, 0)))

# ---- group: Display Angles / All Nodes
pt_12 = Point(cluster_6)

# ---- group: All Nodes
pt_13 = Point(pt_12)

# ---- group: Draw nodes coordinates (mm) / All Nodes
pt_14 = Point(cluster_6)

# ----
panel = Panel("""3
4
5""")
panel_2 = Panel("""0
1
2""")

# ---- group: Draw nodes coordinates (mm)
translation_z_2 = Slider(0.05, range=-1..1.1)
multiplication_3 = Multiplication(A=pt_14, B=1000)
Z_3 = UnitZ(Factor=translation_z_2)
eval_3 = Evaluate(F="Format(\"({0:0.0}, {1:0.0}, {2:0.0})\", x.x, x.y, x.z)", x=multiplication_3)
addition_3 = Addition(A=Z_3, B=pt_14)
tag_2 = TextTag(Location=addition_3, Text=eval_3, Colour=ColourSwatch(SwatchColor=RGB(25, 0, 153)))

# ----
height = GenePool(Decimals=2, Maximum=0, Minimum=-1, Value=[-0.24, -0.24, -0.34])
sph = Sphere(Base=pt_11, Radius=Slider(0.045, range=0.01..0.15))
item = ListItem(List=pt_13, Index=panel, Wrap=True)
item_2 = ListItem(List=pt_13, Index=panel_2, Wrap=True)

# ---- group: Bottom Nodes
pt_15 = Point(flatten(item_2))

# ---- group: Top Nodes
pt_16 = Point(item)

# ----
bang = ExplodeTree(Data=graft(pt_16))  # -> Branch0, Branch1, Branch2
preview = CustomPreview(Geometry=flatten(sph), Material=ColourSwatch(SwatchColor=RGB(0, 0, 0)))
addition_4 = Addition(A="2.9998", B="0.00075")

# ---- group: Struts
line_12 = Line(line_10)
number_slider = Slider(60, range=0.1..100)
pipe = Pipe(Curve=line_12, Radius=expr("x/2000", number_slider), Caps=0)
circular = CrossSectionCircular(Diameter=number_slider, Thickness="2")
M = Material(Name="struts", YoungModulus="70390", YieldStrength="160", SpecificMass="0")
B = ElementBar(Line=line_12, FreeLength=addition_4, CrossSection=circular, Material=M, BucklingLaw="Euler", BucklingFactor="1.055")

# ---- group: Base Cables
line_13 = Line(line_6)
number_slider_2 = Slider(8, range=0.1..10)
pipe_2 = Pipe(Curve=line_13, Radius=expr("x/2000", number_slider_2), Caps=0)
circular_2 = CrossSectionCircular(Diameter=number_slider_2, Thickness=0)
M_2 = Material(Name="base cables", YoungModulus="71750", YieldStrength="120", SpecificMass="0")
C = ElementCable(Line=line_13, FreeLength="2.0438", CrossSection=circular_2, Material=M_2, CanResistCompression=True)

# ---- group: Long Cables
line_14 = Line(line_7)
number_slider_3 = Slider(8, range=0.1..10)
pipe_3 = Pipe(Curve=line_14, Radius=expr("x/2000", number_slider_3), Caps=0)
circular_3 = CrossSectionCircular(Diameter=number_slider_3, Thickness=0)
M_3 = Material(Name="long cables", YoungModulus="72190", YieldStrength="120", SpecificMass="0")
C_2 = ElementCable(Line=line_14, FreeLength="2.0434", CrossSection=circular_3, Material=M_3, CanResistCompression=True)

# ----
pl_3pt = Plane3Pt(PointA=bang.Branch1, PointB=bang.Branch0, PointC=bang.Branch2)
avr = Average(Input=pt_16)
pln_3 = Plane(pl_3pt)

# ---- group: Display Elements
preview_2 = CustomPreview(Geometry=flatten(pipe), Material=ColourSwatch(SwatchColor=RGB(178, 178, 178)))
preview_3 = CustomPreview(Geometry=flatten([pipe_2, pipe_3]), Material=ColourSwatch(SwatchColor=RGB(41, 41, 204)))

# ----
pipe_4 = Pipe(Curve=flatten([line_12, line_13, line_14]), Radius=expr("x/2000", number_slider), Caps=0)
preview_4 = CustomPreview(Geometry=flatten(pipe_4), Material=ColourSwatch(SwatchColor=RGB(178, 178, 178)))
targeted_kn_in_bars = Panel("""1.5
5.0""")
levels = Panel("""1.36
4.96""")
number_slider_4 = Slider(1, range=1..10)
panel_3 = Panel("""0
1
2""")
number_slider_5 = Slider(2084, range=0..2300)
division = Division(A=Slider(1000, range=0..8000), B=1000)
Z_4 = UnitZ(Factor=expr("x*3", division))
Y = UnitY(Factor=expr("-x", division))
X = UnitX(Factor=division)
neg = Negative(Value=Z_4)
panel_4 = Panel("""3
4
5""")
panel_5 = Panel("""3
4
5""")
panel_6 = Panel("""3
4
5""")
panel_7 = Panel("""0
1
2""")
limit = Panel("-10.66")
galapagos = Galapagos(fitness=sqr, gene=number_slider_5)

# ----
# GENERATE FINITE ELEMENT MODEL
panel_8 = Panel("0.12")
nodes_coord_m = Panel(eval)
points = PointList(Points=flatten(addition), Size=panel_8)
entwine = Entwine(Branch00=B, Branch01=C, Branch02=C_2, FlattenInputs=True)  # -> flatten(Result)
toggle_2 = BooleanToggle(False)
pt_17 = Point(flatten(cluster_6))
E = Element(entwine)

# ---- group: Display elements name
E_2 = Element(entwine)
elem_prop = ElementProperties(Element=E_2)  # -> Type, ElementIndex, NodesIndexes, Line, FreeLength, MainCrossSection, CrossSectionsList, MainMaterial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
line_15 = Line(flatten(elem_prop.Line))
translation_z_3 = Slider(0, range=-1..1.1)
eval_4 = EvaluateCurve(Curve=line_15, Parameter="0.5")  # -> Point, Tangent, Angle
panel_9 = Panel("""S1
S2
S3
CB1
CB2
CB3
CT1
CT2
CT3
CV1
CV2
CV3""")
Z_5 = UnitZ(Factor=translation_z_3)
addition_5 = Addition(A=Z_5, B=eval_4.Point)
tag_3 = TextTag(Location=addition_5, Text=panel_9, Colour=ColourSwatch(SwatchColor=RGB(76, 0, 0)))

# ---- group: Generate Supports
pt_18 = Point(cluster_6)
item_3 = ListItem(List=pt_18, Index="1", Wrap=True)
item_4 = ListItem(List=pt_18, Index="2", Wrap=True)
item_5 = ListItem(List=pt_18, Index="0", Wrap=True)

# ---- group: Generate Supports / Block X
sptx = SupportX(Point=[item_3, item_5])

# ---- group: Generate Supports / Block Y
spty = SupportY(Point=item_3)

# ---- group: Generate Supports / Block Z
sptz = SupportZ(Point=[item_3, item_5, item_4])

# ---- group: Generate Supports (continued)
spt = Support([spty, sptx, sptz])

# ----
structure = StructureAssemble(Elements=E, Points=pt_17, Supports=spt)

# ----
# SELF-STRESS and MECHANISMS ANALYSIS
svd = SolverSelfstressAndMechanismsAnalysisBySingularValueDecomposition(Structure=structure, ZeroTol=0.001)  # -> Structure, Rank, S, A, StaticDeg, SelfStress, KinematicDeg, Mechanisms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

# ---- group: Mechanisms analysis / degrees of freedom to vector of displacements
cluster_7 = Cluster_7(num=svd.Mechanisms)

# ---- group: Display Angles
cluster_8 = Cluster_8(pt=pt_12)  # -> am, bottom_nodes, G
amplify_factor = Slider(1.44, range=0.75..2)
cluster_9 = Cluster_9(L=pt_12)
panel_10 = Panel("2")
item_6 = ListItem(List=cluster_9, Index=panel_10, Wrap=True)
item_7 = ListItem(List=cluster_8.G, Index=panel_10, Wrap=True)
item_8 = ListItem(List=cluster_8.bottom_nodes, Index=panel_10, Wrap=True)
subtraction = Subtraction(A=item_6, B=item_8)
pt_19 = Point(cluster_8.am)
eval_5 = Evaluate(F="Format(\"{0:0.0}[mm]\", x.z*1000)", x=subtraction)
Z_6 = UnitZ(Factor=1)
vec2pt = Vector2Pt(PointA=item_6, PointB=item_7, Unitize=False)  # -> Vector, Length
vdis = VectorDisplay(Anchor=item_6, Vector=vec2pt.Vector)

# ----
item_9 = ListItem(List=height, Index=panel_10, Wrap=True)
item_10 = ListItem(List=pt_16, Index=panel_10, Wrap=True)
cluster_10 = Cluster_12(A_2=pt_19, A=pt_19, B=item_7, B_2=amplify_factor)
cluster_11 = Cluster_12(A_2=pt_19, A=pt_19, B=item_8, B_2=amplify_factor)

# ---- group: Display Angles (continued)
Z_7 = UnitZ(Factor=item_9)
addition_6 = Addition(A=item_6, B=Z_7)
pl = ConstructPlane(Origin=addition_6, XAxis=Z_6, YAxis=Vector(0, 1, 0))
cluster_12 = Cluster_11(num="0.10", L_5=pl, L_6=eval_5, L_3=pl, L_4=eval_5, L=pl, L_2=eval_5)
angledim = AngularDimension(Center=pt_19, PointA=cluster_11, PointB=cluster_10, Reflex=False, Text="{0:0}°", Size="0.10")

# ----
vdis_2 = VectorDisplay(Anchor=item_7, Vector=expr("-x", vec2pt.Vector))
project = Project(Geometry=cluster_10, Plane=pln_3)  # -> Geometry, Transform
ln = Line(StartPoint=avr, EndPoint=project.Geometry)
vec2pt_2 = Vector2Pt(PointA=cluster_10, PointB=project.Geometry, Unitize=False)  # -> Vector, Length
vdis_3 = VectorDisplay(Anchor=project.Geometry, Vector=expr("-x", vec2pt_2.Vector))
vdis_4 = VectorDisplay(Anchor=cluster_10, Vector=vec2pt_2.Vector)

# ----
# STRUCTURE PROPERTIES
disassemble = StructureDisassemble(Structure=structure)  # -> Nodes, Elements

elem_prop_2 = ElementProperties(Element=disassemble.Elements)  # -> Type, ElementIndex, NodesIndexes, Line, FreeLength, MainCrossSection, CrossSectionsList, MainMaterial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
node_prop = NodeProperties(Node=disassemble.Nodes)  # -> PtM, FixationsCount, IsFree, LoadKN, UnbalancedLoad, ReactKN, ReactKN_2

len_2 = Length(Curve=elem_prop_2.Line)
cs_prop = CrossSectionProperties(CrossSection=elem_prop_2.MainCrossSection)  # -> Dimension, Thickness, DimensionThickness, AMm2, Inertia, QIA2
prop = MaterialProperties(Material=elem_prop_2.MainMaterial)  # -> Name, YieldStrength, YoungModulus, SpecificMass

# ---- group: A (mm²)
num_2 = Number(flatten(cs_prop.AMm2))

# ---- group: E (N/mm²)
num_3 = Number(flatten(prop.YoungModulus))

# ---- group: L (m)
num_4 = Number(flatten(len_2))

# ---- group: Mechanisms analysis
translation_z_4 = Slider(-0.36, range=-1..1.1)
disassemble_2 = StructureDisassemble(Structure=svd.Structure)  # -> Nodes, Elements
scale = Slider(1, range=1..3)
Z_8 = UnitZ(Factor=translation_z_4)
neg_2 = Negative(Value=cluster_7)
devec = DeconstructVector(Vector=neg_2)  # -> XComponent, YComponent, ZComponent
Y_2 = UnitY(Factor=devec.YComponent)
Z_9 = UnitZ(Factor=devec.ZComponent)
X_2 = UnitX(Factor=devec.XComponent)
swatch = ColourSwatch(SwatchColor=RGB(0, 0, 0))
division_2 = Division(A=neg_2, B=scale)
division_3 = Division(A=X_2, B=scale)
division_4 = Division(A=Y_2, B=scale)
addition_7 = Addition(B=Z_8)
division_5 = Division(A=Z_9, B=scale)
eval_6 = Evaluate(F="Format(\"({0:0.00}, {1:0.00}, {2:0.00})\", x.x, x.y, x.z)", x=neg_2)
tag_4 = TextTag(Location=addition_7, Text=eval_6, Colour=swatch)

# ----
node_prop_2 = NodeProperties(Node=disassemble_2.Nodes)  # -> PtM, FixationsCount, IsFree, LoadKN, UnbalancedLoad, ReactKN, ReactKN_2
eval_7 = Evaluate(F="Format(\"{0:0.0000} {1:0.0000} {2:0.0000}\", x.x, x.y, x.z)", x=neg_2)
nodes_coord_m_2 = Panel(eval_7)

# ---- group: Mechanisms analysis (continued)
vdisex = VectorDisplayEx(Point=node_prop_2.PtM, Vector=division_2, Colour=ColourSwatch(SwatchColor=RGB(0, 0, 0)), Width=expr("x*3", "2"))
# APPLY SELF-WEIGHT
vdisex_2 = VectorDisplayEx(Point=node_prop_2.PtM, Vector=division_3, Colour=swatch, Width="2")
vdisex_3 = VectorDisplayEx(Point=node_prop_2.PtM, Vector=division_4, Colour=swatch, Width="2")
vdisex_4 = VectorDisplayEx(Point=node_prop_2.PtM, Vector=division_5, Colour=swatch, Width="2")

# ---- group: Self-stress analysis
sss = SelfStressScenario(StructureToSelfStress=svd.Structure, SelfStressModes=svd.SelfStress, SelfStressLevels=Slider(1.5, range=0..8.9))
disassemble_3 = StructureDisassemble(Structure=sss)  # -> Nodes, Elements
number_slider_6 = Slider(0.13, range=0..1)
panel_11 = Panel("1")

# ----
elem_results = ElementsResults(Element=disassemble_3.Elements)  # -> Line, FreeLength, IsValid, UnityCheck, Xsi, Tension, TensionAllowable
item_11 = ListItem(List=elem_results.Line, Index=panel_3, Wrap=True)
item_12 = ListItem(List=elem_results.Tension, Index=panel_3, Wrap=True)
showf = ShowForces(Lines=item_11, Forces=item_12, Thickness=Slider(6, range=1..10), ValueSettings=panel_11, TextSize=number_slider_6)

# ---- group: Self-stress analysis (continued)
showf_2 = ShowForces(
    Lines=elem_results.Line,
    Forces=elem_results.Tension,
    Thickness=number_slider_4,
    ValueSettings=panel_11,
    TextSize=number_slider_6)

# ---- group: Self-Weight loads
panel_12 = Panel("""45.7
45.7
45.7
41.6
41.6
41.6""")
disassemble_4 = StructureDisassemble(Structure=sss)  # -> Nodes, Elements
division_6 = Division(A=panel_12, B=1000)
neg_3 = Negative(Value=division_6)
node_prop_3 = NodeProperties(Node=disassemble_4.Nodes)  # -> PtM, FixationsCount, IsFree, LoadKN, UnbalancedLoad, ReactKN, ReactKN_2
Z_10 = UnitZ(Factor=neg_3)
load = PointLoad(Point=node_prop_3.PtM, Vector=Z_10)

# ----
dr = SolverNonLinearDynamicRelaxationMethod(
    Structure=sss,
    ExternalPointLoads=load,
    Tolerance0=0.0001,
    DeltaT=0.01,
    MaxTimeStep=10000,
    MaxPeakReset=1000,
    MassAmplification=1,
    MassAmplification_2=1)  # -> Structure, TimeStep, PeakReset, PeakReset_2

# ----
# DRAW MEASURED STRUCTURE
panel_13 = Panel("""0
-2049.5
1""")
panel_14 = Panel("""1.5	
-5.5
1""")
panel_15 = Panel("""1771
-1028
2.5""")
panel_16 = Panel("""604
-2207.7
1946.5""")
panel_17 = Panel("""-439
-450.7
1946""")
panel_18 = Panel("""1602
-422.7
1947""")
bang_2 = ExplodeTree(Data=graft(panel_13))  # -> Branch0, Branch1, Branch2
bang_3 = ExplodeTree(Data=graft(panel_14))  # -> Branch0, Branch1, Branch2
bang_4 = ExplodeTree(Data=graft(panel_15))  # -> Branch0, Branch1, Branch2
bang_5 = ExplodeTree(Data=graft(panel_16))  # -> Branch0, Branch1, Branch2
bang_6 = ExplodeTree(Data=graft(panel_17))  # -> Branch0, Branch1, Branch2
bang_7 = ExplodeTree(Data=graft(panel_18))  # -> Branch0, Branch1, Branch2
pt_20 = ConstructPoint(XCoordinate=bang_2.Branch0, YCoordinate=bang_2.Branch1, ZCoordinate=bang_2.Branch2)
pt_21 = ConstructPoint(XCoordinate=bang_3.Branch0, YCoordinate=bang_3.Branch1, ZCoordinate=bang_3.Branch2)
pt_22 = ConstructPoint(XCoordinate=bang_4.Branch0, YCoordinate=bang_4.Branch1, ZCoordinate=bang_4.Branch2)
pt_23 = ConstructPoint(XCoordinate=bang_5.Branch0, YCoordinate=bang_5.Branch1, ZCoordinate=bang_5.Branch2)
pt_24 = ConstructPoint(XCoordinate=bang_6.Branch0, YCoordinate=bang_6.Branch1, ZCoordinate=bang_6.Branch2)
pt_25 = ConstructPoint(XCoordinate=bang_7.Branch0, YCoordinate=bang_7.Branch1, ZCoordinate=bang_7.Branch2)
division_7 = Division(A=pt_20, B=1000)
division_8 = Division(A=pt_21, B=1000)
division_9 = Division(A=pt_22, B=1000)
division_10 = Division(A=pt_23, B=1000)
division_11 = Division(A=pt_24, B=1000)
division_12 = Division(A=pt_25, B=1000)
measured_forces = Panel("""-1.376
-1.276
-1.305
0.522
0.511
0.529
0.530
0.524
0.509
0.870
0.859
0.835""")

# ---- group: Pt 0
pt_26 = Point(division_7)

# ---- group: Pt 2
pt_27 = Point(division_9)

# ---- group: Pt 1
pt_28 = Point(division_8)

# ---- group: Pt 4
pt_29 = Point(division_11)

# ---- group: Pt 3
pt_30 = Point(division_10)

# ---- group: Pt 5
pt_31 = Point(division_12)

# ---- group: Barres / 05B
ln_2 = Line(StartPoint=pt_26, EndPoint=pt_31)

# ---- group: Barres / 13B
ln_3 = Line(StartPoint=pt_28, EndPoint=pt_30)

# ---- group: Barres / 24B
ln_4 = Line(StartPoint=pt_27, EndPoint=pt_29)

# ---- group: Cables Hor Bas / 01C
ln_5 = Line(StartPoint=pt_26, EndPoint=pt_28)

# ---- group: Cables Hor Bas / 02C
ln_6 = Line(StartPoint=pt_26, EndPoint=pt_27)

# ---- group: Cables Hor Bas / 12C
ln_7 = Line(StartPoint=pt_28, EndPoint=pt_27)

# ---- group: Cables Hor Haut / 34C
ln_8 = Line(StartPoint=pt_30, EndPoint=pt_29)

# ---- group: Cables Hor Haut / 35C
ln_9 = Line(StartPoint=pt_30, EndPoint=pt_31)

# ---- group: Cables Hor Haut / 45C
ln_10 = Line(StartPoint=pt_29, EndPoint=pt_31)

# ---- group: Cables Long / 03C
ln_11 = Line(StartPoint=pt_26, EndPoint=pt_30)

# ---- group: Cables Long / 14C
ln_12 = Line(StartPoint=pt_28, EndPoint=pt_29)

# ---- group: Cables Long / 25C
# INFO
# STEP 2: Create bases
# Regular cell
# Cell height
# Assembly length
# Node on node
# Node on cable
# Alterned rotation
# Regular rotation
# Custom profile
# Linear profile
# 2 cells
# 4 cells
# Triangle
# Pentagon
ln_13 = Line(StartPoint=pt_27, EndPoint=pt_31)

# ----
merge = Merge(Data1=pt_26, Data2=pt_28, Data3=pt_27, Data4=pt_30, Data5=pt_29, Data6=pt_31)
merge_2 = Merge(
    Data1=ln_4,
    Data2=ln_3,
    Data3=ln_2,
    Data4=ln_7,
    Data5=ln_5,
    Data6=ln_6,
    Data7=ln_10,
    Data8=ln_8,
    Data9=ln_9,
    Data10=ln_13,
    Data11=ln_12,
    Data12=ln_11)
line_16 = Line(merge_2)
pt_32 = Point(merge)
preview_5 = CustomPreview(Geometry=flatten(line_16), Material=ColourSwatch(SwatchColor=RGB(210, 230, 207)))  # disabled
showf_3 = ShowForces(Lines=line_16, Forces=measured_forces, Thickness=2, ValueSettings=2, TextSize=0.1)

# ---- group: Displacements and Forces Results
disassemble_5 = StructureDisassemble(Structure=dr.Structure)  # -> Nodes, Elements
swatch_2 = ColourSwatch(SwatchColor=RGB(0, 178, 15))

# ----
elem_results_2 = ElementsResults(Element=disassemble_5.Elements)  # -> Line, FreeLength, IsValid, UnityCheck, Xsi, Tension, TensionAllowable

# ---- group: Draw elements length
line_17 = Line(flatten(elem_results_2.Line))
# DISPLAY GEOMETRY INFO
translation_z_5 = Slider(-0.02, range=-1..1.1)
len_3 = Length(Curve=line_17)
eval_8 = EvaluateCurve(Curve=line_17, Parameter="0.5")  # -> Point, Tangent, Angle
multiplication_4 = Multiplication(A=len_3, B=1000)
Z_11 = UnitZ(Factor=translation_z_5)
expression_2 = Expression(x=multiplication_4, Expression="Format(\"{0:0.0}\", x)")
addition_8 = Addition(A=Z_11, B=eval_8.Point)
tag_5 = TextTag(Location=addition_8, Text=expression_2, Colour=ColourSwatch(SwatchColor=RGB(153, 0, 0)))

# ----
node_prop_4 = NodeProperties(Node=disassemble_5.Nodes)  # -> PtM, FixationsCount, IsFree, LoadKN, UnbalancedLoad, ReactKN, ReactKN_2

# ---- group: Display Angles / All Nodes
pt_33 = Point(node_prop_4.PtM)

# ---- group: Display Angles
height_2 = GenePool(Decimals=2, Maximum=0, Minimum=-1, Value=[-0.24, -0.24, -0.69])
cluster_13 = Cluster_8(pt=pt_33)  # -> am, bottom_nodes, G
amplify_factor_2 = Slider(1.44, range=0.75..2)
cluster_14 = Cluster_9(L=pt_33)
item_13 = ListItem(List=cluster_14, Index="0", Wrap=True)
item_14 = ListItem(List=cluster_13.G, Index="0", Wrap=True)
item_15 = ListItem(List=cluster_13.bottom_nodes, Index="0", Wrap=True)
item_16 = ListItem(List=height_2, Index="0", Wrap=True)
subtraction_2 = Subtraction(A=item_13, B=item_15)
pt_34 = Point(cluster_13.am)
Z_12 = UnitZ(Factor=item_16)
eval_9 = Evaluate(F="Format(\"{0:0.0}\", x.z*1000)", x=subtraction_2)
Z_13 = UnitZ(Factor=1)
cluster_15 = Cluster_12(A_2=pt_34, A=pt_34, B=item_14, B_2=amplify_factor_2)
cluster_16 = Cluster_12(A_2=pt_34, A=pt_34, B=item_15, B_2=amplify_factor_2)
vec2pt_3 = Vector2Pt(PointA=item_13, PointB=item_14, Unitize=False)  # -> Vector, Length
addition_9 = Addition(A=item_13, B=Z_12)
pl_2 = ConstructPlane(Origin=addition_9, XAxis=Z_13, YAxis=Vector(0, 1, 0))
vdis_5 = VectorDisplay(Anchor=item_14, Vector=expr("-x", vec2pt_3.Vector))
cluster_17 = Cluster_11(num="0.10", L_5=pl_2, L_6=eval_9, L_3=pl_2, L_4=eval_9, L=pl_2, L_2=eval_9)
vdis_6 = VectorDisplay(Anchor=item_13, Vector=vec2pt_3.Vector)
angledim_2 = AngularDimension(Center=pt_34, PointA=cluster_16, PointB=cluster_15, Reflex=False, Text="{0:0.0}°", Size="0.10")

# ----
elem_prop_3 = ElementProperties(Element=disassemble_5.Elements)  # -> Type, ElementIndex, NodesIndexes, Line, FreeLength, MainCrossSection, CrossSectionsList, MainMaterial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

# ---- group: Displacements and Forces Results (continued)
vec2pt_4 = Vector2Pt(PointA=node_prop.PtM, PointB=node_prop_4.PtM, Unitize=False)  # -> Vector, Length
eval_10 = Evaluate(F="Format(\"{0:0.00} {1:0.00} {2:0.00}\", x.x*1000, x.y*1000, x.z*1000)", x=node_prop_4.PtM)
devec_2 = DeconstructVector(Vector=node_prop_4.LoadKN)  # -> XComponent, YComponent, ZComponent
showf_4 = ShowForces(Lines=elem_results_2.Line, Forces=elem_results_2.Tension, Thickness=number_slider_4, ValueSettings=2, TextSize=0.1)
eval_11 = Evaluate(F=elem_results_2.Tension)
expression_3 = Expression(x=devec_2.ZComponent, Expression="Format(\"{0:0.000}\", x)")
coord_in_mm = Panel(eval_10)
forces_in_kn = Panel(eval_11)
sph_2 = Sphere(Base=node_prop_4.PtM, Radius=expr("-x*1.5", devec_2.ZComponent))
vdisex_5 = VectorDisplayEx(Point=node_prop_4.PtM, Vector=expr("x*10", vec2pt_4.Vector), Colour=RGB(0, 0, 0), Width="3")
preview_6 = CustomPreview(Geometry=flatten(sph_2), Material=ColourSwatch(SwatchColor=RGB(0, 255, 21)))
cluster_18 = Cluster_10(F=Slider(0.13, range=0.01..1), B=node_prop_4.PtM)
tag_6 = TextTag(Location=cluster_18, Text=expression_3, Colour=swatch_2)

# ----
vec2pt_5 = Vector2Pt(PointA=pt_34, PointB=cluster_16, Unitize=False)  # -> Vector, Length
vec2pt_6 = Vector2Pt(PointA=pt_34, PointB=cluster_15, Unitize=False)  # -> Vector, Length
angle = Angle(VectorA=vec2pt_5.Vector, VectorB=vec2pt_6.Vector)  # -> Angle, Reflex
deg = Degrees(Radians=angle.Angle)
alpha = Panel(deg)

# ----
# DRAW MEASURED STRUCTURE
panel_19 = Panel("""0
-2049
1""")
panel_20 = Panel("""1.5
-5.5
1""")
panel_21 = Panel("""1771
-1028
2.5""")
panel_22 = Panel("""603
-2208.7
1946.5""")
panel_23 = Panel("""-438
-449.7
1947""")
panel_24 = Panel("""1602
-424.7
1948""")
bang_8 = ExplodeTree(Data=graft(panel_19))  # -> Branch0, Branch1, Branch2
bang_9 = ExplodeTree(Data=graft(panel_20))  # -> Branch0, Branch1, Branch2
bang_10 = ExplodeTree(Data=graft(panel_21))  # -> Branch0, Branch1, Branch2
bang_11 = ExplodeTree(Data=graft(panel_22))  # -> Branch0, Branch1, Branch2
bang_12 = ExplodeTree(Data=graft(panel_23))  # -> Branch0, Branch1, Branch2
bang_13 = ExplodeTree(Data=graft(panel_24))  # -> Branch0, Branch1, Branch2
pt_35 = ConstructPoint(XCoordinate=bang_8.Branch0, YCoordinate=bang_8.Branch1, ZCoordinate=bang_8.Branch2)
pt_36 = ConstructPoint(XCoordinate=bang_9.Branch0, YCoordinate=bang_9.Branch1, ZCoordinate=bang_9.Branch2)
pt_37 = ConstructPoint(XCoordinate=bang_10.Branch0, YCoordinate=bang_10.Branch1, ZCoordinate=bang_10.Branch2)
pt_38 = ConstructPoint(XCoordinate=bang_11.Branch0, YCoordinate=bang_11.Branch1, ZCoordinate=bang_11.Branch2)
pt_39 = ConstructPoint(XCoordinate=bang_12.Branch0, YCoordinate=bang_12.Branch1, ZCoordinate=bang_12.Branch2)
pt_40 = ConstructPoint(XCoordinate=bang_13.Branch0, YCoordinate=bang_13.Branch1, ZCoordinate=bang_13.Branch2)
division_13 = Division(A=pt_35, B=1000)
division_14 = Division(A=pt_36, B=1000)
division_15 = Division(A=pt_37, B=1000)
division_16 = Division(A=pt_38, B=1000)
division_17 = Division(A=pt_39, B=1000)
division_18 = Division(A=pt_40, B=1000)
measured_forces_2 = Panel("""-1.583
-1.444
-1.499
0.595
0.582
0.608
0.608
0.598
0.581
1.007
0.987
0.959""")

# ---- group: Pt 0
pt_41 = Point(division_13)

# ---- group: Pt 1
pt_42 = Point(division_14)

# ---- group: Pt 2
pt_43 = Point(division_15)

# ---- group: Pt 4
pt_44 = Point(division_17)

# ---- group: Pt 3
pt_45 = Point(division_16)

# ---- group: Pt 5
pt_46 = Point(division_18)

# ---- group: Barres / 05B
ln_14 = Line(StartPoint=pt_41, EndPoint=pt_46)

# ---- group: Barres / 13B
ln_15 = Line(StartPoint=pt_42, EndPoint=pt_45)

# ---- group: Barres / 24B
ln_16 = Line(StartPoint=pt_43, EndPoint=pt_44)

# ---- group: Cables Hor Bas / 01C
ln_17 = Line(StartPoint=pt_41, EndPoint=pt_42)

# ---- group: Cables Hor Bas / 02C
ln_18 = Line(StartPoint=pt_41, EndPoint=pt_43)

# ---- group: Cables Hor Bas / 12C
ln_19 = Line(StartPoint=pt_42, EndPoint=pt_43)

# ---- group: Cables Hor Haut / 34C
ln_20 = Line(StartPoint=pt_45, EndPoint=pt_44)

# ---- group: Cables Hor Haut / 35C
ln_21 = Line(StartPoint=pt_45, EndPoint=pt_46)

# ---- group: Cables Hor Haut / 45C
ln_22 = Line(StartPoint=pt_44, EndPoint=pt_46)

# ---- group: Cables Long / 03C
ln_23 = Line(StartPoint=pt_41, EndPoint=pt_45)

# ---- group: Cables Long / 14C
ln_24 = Line(StartPoint=pt_42, EndPoint=pt_44)

# ---- group: Cables Long / 25C
# STEP 3: Create struts and cables
ln_25 = Line(StartPoint=pt_43, EndPoint=pt_46)

# ----
merge_3 = Merge(Data1=pt_41, Data2=pt_42, Data3=pt_43, Data4=pt_45, Data5=pt_44, Data6=pt_46)
merge_4 = Merge(
    Data1=ln_16,
    Data2=ln_15,
    Data3=ln_14,
    Data4=ln_19,
    Data5=ln_17,
    Data6=ln_18,
    Data7=ln_22,
    Data8=ln_20,
    Data9=ln_21,
    Data10=ln_25,
    Data11=ln_24,
    Data12=ln_23)
line_18 = Line(merge_4)
pt_47 = Point(merge_3)
preview_7 = CustomPreview(Geometry=flatten(line_18), Material=ColourSwatch(SwatchColor=RGB(210, 230, 207)))  # disabled
showf_5 = ShowForces(Lines=line_18, Forces=measured_forces_2, Thickness=2, ValueSettings=2, TextSize=0.1)

# ---- group: Self-Weight loads
external_load_n_node = Panel("""0.0
112.3
210.4
308.5
406.6
504.7
602.8
700.9
799.0
897.1
995.2
1093.3
1191.4
1289.5
1389.5
1489.5
1589.5
1689.5
1789.5
1887.6
1985.7
2083.8""")
item_17 = ListItem(List=external_load_n_node, Index=Slider(21, range=0..21), Wrap=False)
# APPLY external load
disassemble_6 = StructureDisassemble(Structure=dr.Structure)  # -> Nodes, Elements
node_prop_5 = NodeProperties(Node=disassemble_6.Nodes)  # -> PtM, FixationsCount, IsFree, LoadKN, UnbalancedLoad, ReactKN, ReactKN_2
division_19 = Division(A=number_slider_5, B=1000)
neg_4 = Negative(Value=division_19)
Z_14 = UnitZ(Factor=neg_4)

# ----
item_18 = ListItem(List=node_prop_5.PtM, Index="3", Wrap=True)
load_2 = PointLoad(Point=item_18, Vector=neg)  # disabled
item_19 = ListItem(List=node_prop_5.PtM, Index=panel_4, Wrap=True)
vdisex_6 = VectorDisplayEx(Point=item_18, Vector=expr("x", neg), Colour=swatch_2, Width="3")

# ---- group: Self-Weight loads (continued)
load_3 = PointLoad(Point=item_19, Vector=Z_14)

# ----
dr_2 = SolverNonLinearDynamicRelaxationMethod(
    Structure=dr.Structure,
    ExternalPointLoads=[load_3, load_2],
    Tolerance0=0.0001,
    DeltaT=0.01,
    MaxTimeStep=10000,
    MaxPeakReset=1000,
    MassAmplification=1,
    MinimumMass=0.005)  # -> Structure, IsInEquilibrium, TimeStep, PeakReset
division_20 = Division(A=Z_14, B=Slider(4, range=1..5))
rec = DataRecorder(item_17, DataLimit=-10, RecordData=True)  # disabled
panel_25 = Panel(rec)

# ---- group: Displacements and Forces Results
disassemble_7 = StructureDisassemble(Structure=dr_2.Structure)  # -> Nodes, Elements
devec_3 = DeconstructVector(Vector=node_prop_4.LoadKN)  # -> XComponent, YComponent, ZComponent
expression_4 = Expression(x=devec_3.ZComponent, Expression="Format(\"{0:0.000}\", x)")
swatch_3 = ColourSwatch(SwatchColor=RGB(0, 178, 15))

# ----
elem_results_3 = ElementsResults(Element=disassemble_7.Elements)  # -> Line, FreeLength, IsValid, UnityCheck, Xsi, Tension, TensionAllowable

# ---- group: Draw elements length
line_19 = Line(flatten(elem_results_3.Line))
# DISPLAY GEOMETRY INFO
translation_z_6 = Slider(-0.02, range=-1..1.1)
len_4 = Length(Curve=line_19)
eval_12 = EvaluateCurve(Curve=line_19, Parameter="0.5")  # -> Point, Tangent, Angle
multiplication_5 = Multiplication(A=len_4, B=1000)
Z_15 = UnitZ(Factor=translation_z_6)
expression_5 = Expression(x=multiplication_5, Expression="Format(\"{0:0.0}\", x)")
addition_10 = Addition(A=Z_15, B=eval_12.Point)
tag_7 = TextTag(Location=addition_10, Text=expression_5, Colour=ColourSwatch(SwatchColor=RGB(153, 0, 0)))

# ----
node_prop_6 = NodeProperties(Node=disassemble_7.Nodes)  # -> PtM, FixationsCount, IsFree, LoadKN, UnbalancedLoad, ReactKN, ReactKN_2

# ---- group: Display Angles / All Nodes
pt_48 = Point(node_prop_6.PtM)

# ---- group: Display Angles
height_3 = GenePool(Decimals=2, Maximum=0, Minimum=-1, Value=[-0.24, -0.24, -0.34])
cluster_19 = Cluster_8(pt=pt_48)  # -> am, bottom_nodes, G
amplify_factor_3 = Slider(1.44, range=0.75..2)
cluster_20 = Cluster_9(L=pt_48)
panel_26 = Panel("""0
1
2""")
item_20 = ListItem(List=cluster_20, Index=panel_26, Wrap=True)
item_21 = ListItem(List=cluster_19.G, Index=panel_26, Wrap=True)
item_22 = ListItem(List=cluster_19.bottom_nodes, Index=panel_26, Wrap=True)
item_23 = ListItem(List=height_3, Index=panel_26, Wrap=True)
subtraction_3 = Subtraction(A=item_20, B=item_22)
pt_49 = Point(cluster_19.am)
Z_16 = UnitZ(Factor=item_23)
eval_13 = Evaluate(F="Format(\"{0:0.0}[mm]\", x.z*1000)", x=subtraction_3)
Z_17 = UnitZ(Factor=1)
cluster_21 = Cluster_12(A_2=pt_49, A=pt_49, B=item_21, B_2=amplify_factor_3)
cluster_22 = Cluster_12(A_2=pt_49, A=pt_49, B=item_22, B_2=amplify_factor_3)
vec2pt_7 = Vector2Pt(PointA=item_20, PointB=item_21, Unitize=False)  # -> Vector, Length
addition_11 = Addition(A=item_20, B=Z_16)
pl_3 = ConstructPlane(Origin=addition_11, XAxis=Z_17, YAxis=Vector(0, 1, 0))
cluster_23 = Cluster_11(num="0.10", L_5=pl_3, L_6=eval_13, L_3=pl_3, L_4=eval_13, L=pl_3, L_2=eval_13)
vdis_7 = VectorDisplay(Anchor=item_21, Vector=expr("-x", vec2pt_7.Vector))
vdis_8 = VectorDisplay(Anchor=item_20, Vector=vec2pt_7.Vector)
angledim_3 = AngularDimension(Center=pt_49, PointA=cluster_22, PointB=cluster_21, Reflex=False, Text="{0:0.0}°", Size="0.10")

# ----
elem_prop_4 = ElementProperties(Element=disassemble_7.Elements)  # -> Type, ElementIndex, NodesIndexes, Line, FreeLength, MainCrossSection, CrossSectionsList, MainMaterial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
subtraction_4 = Subtraction(A=node_prop_6.LoadKN, B=node_prop_4.LoadKN)
devec_4 = DeconstructVector(Vector=subtraction_4)  # -> XComponent, YComponent, ZComponent
item_24 = ListItem(List=node_prop_6.PtM, Index=panel_5, Wrap=True)
item_25 = ListItem(List=devec_4.ZComponent, Index=panel_6, Wrap=True)
expression_6 = Expression(x=item_25, Expression="Format(\"{0:0.0}\", x)")
subtraction_5 = Subtraction(A=item_24, B=division_20)

# ---- group: Displacements and Forces Results (continued)
vec2pt_8 = Vector2Pt(PointA=node_prop.PtM, PointB=node_prop_6.PtM, Unitize=False)  # -> Vector, Length
eval_14 = Evaluate(F="Format(\"{0:0.00} {1:0.00} {2:0.00}\", x.x*1000, x.y*1000, x.z*1000)", x=node_prop_6.PtM)
showf_6 = ShowForces(Lines=elem_results_3.Line, Forces=elem_results_3.Tension, Thickness=number_slider_4, ValueSettings="2", TextSize=0.1)
eval_15 = Evaluate(F=elem_results_3.Tension)
coord_in_mm_2 = Panel(eval_14)
forces_in_kn_2 = Panel(eval_15)
sph_3 = Sphere(Base=node_prop_6.PtM, Radius=expr("-x*1.5", devec_3.ZComponent))
preview_8 = CustomPreview(Geometry=flatten(sph_3), Material=ColourSwatch(SwatchColor=RGB(0, 255, 21)))
cluster_24 = Cluster_10(F=Slider(0.13, range=0.01..1), B=node_prop_6.PtM)
vdisex_7 = VectorDisplayEx(Point=subtraction_5, Vector=division_20, Colour=swatch_3, Width="3")
tag_8 = TextTag(Location=cluster_24, Text=expression_4, Colour=swatch_3)

# ----
cluster_25 = Cluster_10(F=Slider(0.06, range=0.01..1), B=subtraction_5)
devec_5 = DeconstructVector(Vector=node_prop_6.PtM)  # -> XComponent, YComponent, expr("x*1000", ZComponent)
item_26 = ListItem(List=elem_results_3.Line, Index=panel_7, Wrap=True)
item_27 = ListItem(List=elem_results_3.Tension, Index=panel_7, Wrap=True)
tag_9 = TextTag(Location=cluster_25, Text=expression_6, Colour=ColourSwatch(SwatchColor=RGB(0, 178, 15)))
vec2pt_9 = Vector2Pt(PointA=pt_49, PointB=cluster_22, Unitize=False)  # -> Vector, Length
vec2pt_10 = Vector2Pt(PointA=pt_49, PointB=cluster_21, Unitize=False)  # -> Vector, Length
item_28 = ListItem(List=devec_5.ZComponent, Index=5, Wrap=True)
showf_7 = ShowForces(Lines=item_26, Forces=item_27, Thickness="10", ValueSettings="2", TextSize=0.1)
angle_2 = Angle(VectorA=vec2pt_9.Vector, VectorB=vec2pt_10.Vector)  # -> Angle, Reflex
rec_2 = DataRecorder(item_28, DataLimit=-10, RecordData=True)  # disabled
panel_27 = Panel(item_28)
item_29 = ListItem(List=angle_2.Angle, Index=0, Wrap=True)
item_30 = ListItem(List=elem_results_3.Tension, Index=0, Wrap=True)
item_31 = ListItem(List=elem_results_3.Tension, Index=9, Wrap=True)
panel_28 = Panel(rec_2)
deg_2 = Degrees(Radians=item_29)
subtraction_6 = Subtraction(A=limit, B=item_30)
panel_29 = Panel(item_30)
panel_30 = Panel(item_31)
alpha_2 = Panel(deg_2)
sqr = Square(Value=subtraction_6)
rec_3 = DataRecorder(deg_2, DataLimit=-10, RecordData=True)  # disabled
# STEP 5: Final geometry
# Nodes
# Bases cables
# Cells cables
# Cells struts
# BONUS STEP: Sinusoidal struts
panel_31 = Panel(rec_3)

# ==== cluster CreateStructure
C = ClusterInput()
A = ClusterInput()
N = ClusterInput()
pframes = PerpFrames(Curve=C, Count=N, Align=True)  # -> Frames, Parameters
rotate = Rotate(Geometry=pframes.Frames, Angle=A, Plane=pframes.Frames)  # -> Geometry, Transform
planes = ClusterOutput(rotate.Geometry)

# ==== cluster RotateBasePlanes
relay = ClusterInput()
angle_rad = ClusterInput()

# ---- group: nbr of planes
lng = ListLength(List=relay)

# ---- group: 0 Alterned angles
repeat = RepeatData(Data=flatten(["0", angle_rad]), Length=lng)  # -> flatten(Data)
plane_angles_rad = Panel(repeat)

# ----
_0_alterned_1_spiral = ClusterInput()

# ---- group: 1 Spiral angles
series = Series(Start=0, Step=angle_rad, Count=lng)  # -> flatten(Series)
plane_angles_rad_2 = Panel(series)

# ---- group: Chosen Angles
filter = StreamFilter(Gate=_0_alterned_1_spiral, Stream0=plane_angles_rad, Stream1=plane_angles_rad_2)

# ----
rotate = Rotate(Geometry=relay, Angle=filter, Plane=relay)  # -> Geometry, Transform
G = ClusterOutput(rotate.Geometry)

# ==== cluster Cluster
C = ClusterInput()
explode = Explode(Curve=C, Recursive=True)  # -> simplify(Segments), simplify(Vertices)
cset = CreateSet(List=explode.Vertices)  # -> Set, Map
S = ClusterOutput(explode.Segments)
S_2 = ClusterOutput(cset.Set)

# ==== cluster LongCables
T = ClusterInput()
viewer = ParamViewer(T)
points = PointList(Points=T, Size="0.5")
shift = ShiftList(List=viewer, Shift=-1, Wrap=False)
shift_2 = ShiftList(List=viewer, Shift=1, Wrap=False)
panel = Panel(shift_2)
panel_2 = Panel(shift)
branch = TreeBranch(Tree=T, Path=panel_2, MaintainPaths=True)
branch_2 = TreeBranch(Tree=T, Path=panel, MaintainPaths=True)
ln = Line(StartPoint=branch, EndPoint=branch_2)
L = ClusterOutput(ln)

# ==== cluster Cluster_2
nodes = ClusterInput()
planes = ClusterInput()
bool = ClusterInput()
deplane = DeconstructPlane(Plane=planes)  # -> Origin, XAxis, YAxis, ZAxis

# ---- group: nbr of points per plane
lng = ListLength(List=nodes)

# ---- group: Points on initial curve
pt = Point(simplify(graft(deplane.Origin)))

# ----
repeat = RepeatData(Data=pt, Length=lng)  # -> simplify(Data)

# ---- group: Additional transversal cables
ln = Line(StartPoint=nodes, EndPoint=repeat)

# ---- group: Draw add transv. cables ?
filter = StreamFilter(Gate=bool, Stream1=ln)  # -> simplify(Stream)

# ---- group: Draw add center points ?
filter_2 = StreamFilter(Gate=bool, Stream1=pt)  # -> simplify(Stream)

# ----
cables = ClusterOutput(filter)
points = ClusterOutput(filter_2)

# ==== cluster Cluster_3
alterned_spiral = ClusterInput()
nodes = ClusterInput()
gate = StreamGate(Stream=nodes, Gate=alterned_spiral)  # -> Target0, Target1
nbr_add_cables = ClusterInput()
points = PointList(Points=gate.Target0, Size="0.5")

# ---- group: Spiral
points_2 = PointList(Points=gate.Target1, Size="0.5")
viewer = ParamViewer(gate.Target1)
shift = ShiftList(List=viewer, Shift=-1, Wrap=False)
shift_2 = ShiftList(List=viewer, Shift=1, Wrap=False)
panel = Panel(shift_2)
panel_2 = Panel(shift)
panel_3 = Panel("-1")

# ---- group: Spiral / Top Points not shifted
branch = TreeBranch(Tree=gate.Target1, Path=panel, MaintainPaths=True)

# ---- group: Spiral / Top Points
shift_3 = ShiftList(List=branch, Shift=panel_3, Wrap=True)  # -> simplify(List)

# ---- group: Spiral / Bottom Points
branch_2 = TreeBranch(Tree=gate.Target1, Path=panel_2, MaintainPaths=True)

# ---- group: cables to draw
series = Series(Start=0, Step=1, Count=nbr_add_cables)

# ---- group: Alterned
# Description: The nodes index of one branch over two must be shifted due to alterned configuration
viewer_2 = ParamViewer(gate.Target0)
panel_4 = Panel("""True
False""")
panel_5 = Panel("""False
True""")
cull = CullPattern(List=viewer_2, CullPattern=panel_4)
cull_2 = CullPattern(List=viewer_2, CullPattern=panel_5)
panel_6 = Panel(cull)
panel_7 = Panel(cull_2)
branch_3 = TreeBranch(Tree=gate.Target0, Path=panel_7, MaintainPaths=True)
panel_8 = Panel("-1")

# ---- group: Alterned / Regular Branch
branch_4 = TreeBranch(Tree=gate.Target0, Path=panel_6, MaintainPaths=True)

# ---- group: Alterned / Alterned Branch
bot = ShiftList(List=branch_3, Shift=panel_8, Wrap=True)  # -> simplify(List)

# ---- group: Alterned / Nodes tree with alterned branch
merge = Merge(Data1=branch_4, Data2=bot)  # -> simplify(Result)

# ---- group: Alterned (continued)
viewer_3 = ParamViewer(merge)
shift_4 = ShiftList(List=viewer_3, Shift=-1, Wrap=False)
shift_5 = ShiftList(List=viewer_3, Shift=1, Wrap=False)
panel_9 = Panel(shift_5)
panel_10 = Panel(shift_4)

# ----
points_3 = PointList(Points=merge, Size="0.5")

# ---- group: Alterned / Bottom Points
branch_5 = TreeBranch(Tree=merge, Path=panel_10, MaintainPaths=True)

# ---- group: Alterned / Top Points
branch_6 = TreeBranch(Tree=merge, Path=panel_9, MaintainPaths=True)

# ---- group: Bottom Points - Alterned or Spiral ?
filter = StreamFilter(Gate=alterned_spiral, Stream0=branch_5, Stream1=branch_2)

# ---- group: Top Points - Alterned or Spiral ?
filter_2 = StreamFilter(Gate=alterned_spiral, Stream0=branch_6, Stream1=shift_3)

# ---- group: Bottom points to draw
selection_of_start_points = ListItem(List=filter, Index=series, Wrap=True)

# ---- group: Top Points to draw
item = ListItem(List=filter_2, Index=series, Wrap=True)

# ---- group: Additional long cables
ln = Line(StartPoint=selection_of_start_points, EndPoint=item)

# ----
L = ClusterOutput(ln)

# ==== cluster Cluster_4
nodes = ClusterInput()
alterned_spiral = ClusterInput()
viewer = ParamViewer(nodes)
points = PointList(Points=nodes, Size="0.5")
panel = Panel("""1
-1""")
shift = ShiftList(List=viewer, Shift=-1, Wrap=False)
shift_2 = ShiftList(List=viewer, Shift=1, Wrap=False)
lng = ListLength(List=shift_2)
repeat = RepeatData(Data=panel, Length=lng)  # -> simplify(graft(Data))
panel_2 = Panel(shift_2)
panel_3 = Panel(shift)
panel_4 = Panel(repeat)

# ---- group: Alterned or Spiral ?
filter = StreamFilter(Gate=alterned_spiral, Stream0=panel_4, Stream1="1")

# ---- group: Bottom points
branch = TreeBranch(Tree=nodes, Path=panel_3, MaintainPaths=True)

# ---- group: Top Points
branch_2 = TreeBranch(Tree=nodes, Path=panel_2, MaintainPaths=True)

# ---- group: Top Points Shifted
shift_3 = ShiftList(List=branch_2, Shift=filter, Wrap=True)  # -> simplify(List)

# ----
points_2 = PointList(Points=branch, Size="0.5")
points_3 = PointList(Points=shift_3, Size="0.5")
ln = Line(StartPoint=branch, EndPoint=shift_3)
L = ClusterOutput(ln)

# ==== cluster Cluster_5
P = ClusterInput()
A = ClusterInput()
B = ClusterInput()
pdecon = Deconstruct(Point=P)  # -> XComponent, YComponent, ZComponent
B_2 = ClusterInput()
N = ClusterInput()
multiplication = Multiplication(A=A, B=B)
dom = ConstructDomain(DomainStart=pdecon.ZComponent, DomainEnd=B_2)
range = Range(Domain=dom, Steps=N)
addition = Addition(A=pdecon.XComponent, B=multiplication)
panel = Panel(multiplication)
pt = ConstructPoint(XCoordinate=addition, YCoordinate=pdecon.YComponent, ZCoordinate=range)
pline = PolyLine(Vertices=pt, Closed=False)
pl = ClusterOutput(pline)

# ==== cluster Cluster_6
pt = ClusterInput()
pt_2 = Point(pt)
item = ListItem(List=pt_2, Index="0", Wrap=True)
item_2 = ListItem(List=pt_2, Index="1", Wrap=True)
item_3 = ListItem(List=pt_2, Index="2", Wrap=True)
merge = Merge(Data1=item_3, Data2=item_2, Data3=item)
pt_3 = Point(flatten(merge))
pt_4 = ClusterOutput(pt_3)

# ==== cluster Cluster_7
num = ClusterInput()
num_2 = Number(num)
panel = Panel("""false
true
false""")
panel_2 = Panel("""true
false
false""")
panel_3 = Panel("""false
false
true""")
cull = CullPattern(List=num_2, CullPattern=panel_2)
cull_2 = CullPattern(List=num_2, CullPattern=panel_3)
cull_3 = CullPattern(List=num_2, CullPattern=panel)
vec = VectorXYZ(XComponent=cull, YComponent=cull_3, ZComponent=cull_2)  # -> Vector, Length
V = ClusterOutput(vec.Vector)

# ==== cluster Cluster_8
pt = ClusterInput()

# ---- group: All Nodes
pt_2 = Point(pt)

# ----
panel = Panel("""3
4
5""")
panel_2 = Panel("""0
1
2""")
item = ListItem(List=pt_2, Index=panel, Wrap=True)
item_2 = ListItem(List=pt_2, Index=panel_2, Wrap=True)

# ---- group: Bottom Nodes
pt_3 = Point(flatten(item_2))

# ---- group: Top Nodes
pt_4 = Point(item)

# ----
bang = ExplodeTree(Data=graft(pt_3))  # -> Branch0, Branch1, Branch2
pl_3pt = Plane3Pt(PointA=bang.Branch1, PointB=bang.Branch0, PointC=bang.Branch2)
pln = Plane(pl_3pt)
avr = Average(Input=pt_3)
project = Project(Geometry=pt_4, Plane=pln)  # -> Geometry, Transform
am = ClusterOutput(avr)
G = ClusterOutput(project.Geometry)
bottom_nodes = ClusterOutput(pt_3)

# ==== cluster Cluster_9
L = ClusterInput()
panel = Panel("""3
4
5""")
item = ListItem(List=L, Index=panel, Wrap=True)
pt = Point(item)
top_points = ClusterOutput(pt)

# ==== cluster Cluster_10
F = ClusterInput()
B = ClusterInput()
Z = UnitZ(Factor=F)
addition = Addition(A=Z, B=B)
R = ClusterOutput(addition)

# ==== cluster Cluster_11
L = ClusterInput()
L_2 = ClusterInput()
L_3 = ClusterInput()
L_4 = ClusterInput()
L_5 = ClusterInput()
L_6 = ClusterInput()
num = ClusterInput()
item = ListItem(List=L, Index="2", Wrap=True)
item_2 = ListItem(List=L_2, Index="2", Wrap=True)
item_3 = ListItem(List=L_3, Index="1", Wrap=True)
item_4 = ListItem(List=L_4, Index="1", Wrap=True)
item_5 = ListItem(List=L_5, Index="0", Wrap=True)
item_6 = ListItem(List=L_6, Index="0", Wrap=True)
num_2 = Number(num)
tag = TextTag3D(Location=item, Text=item_2, Size=num_2, Justification=6)
tag_2 = TextTag3D(Location=item_3, Text=item_4, Size=num_2, Justification=9)
tag_3 = TextTag3D(Location=item_5, Text=item_6, Size=num_2, Justification=3)

# ==== cluster Cluster_12
A = ClusterInput()
B = ClusterInput()
B_2 = ClusterInput()
vec2pt = Vector2Pt(PointA=A, PointB=B, Unitize=False)  # -> Vector, Length
A_2 = ClusterInput()
multiplication = Multiplication(A=vec2pt.Vector, B=B_2)
addition = Addition(A=A_2, B=multiplication)
R = ClusterOutput(addition)
