# Grasshopper definition Linear Truss Examples and Background MI.gh (Grasshopper 1.0.7)
# plug-ins: Muscle, Muscles

span = Slider(1, range=0..10)
number_slider = Slider(1, range=0.1..6)
number_slider_2 = Slider(2, range=1..6)
span_2 = Slider(1, range=0..10)
number_slider_3 = Slider(0.5, range=0.1..6)
n = Slider(9, range=3..10)
number_slider_4 = Slider(2, range=2..6)
span_3 = Slider(1, range=0..10)
startpy = StartPythonComponent(
    StartPython=<missing>,
    UserMode=False,
    Level=30000,
    TimeOut=15,
    CondaEnvironmentName="base",
    AnacondaDirectory="C:\Users\Jonas\Anaconda3")
n_2 = Slider(7, range=3..10)
number_slider_5 = Slider(3.5, range=2..6)
span_4 = Slider(1, range=0..10)
startpy_2 = StartPythonNET(
    StartPython=Toggle(True),
    UserMode=False,
    AnacondaDirectory="C:\Users\Jonas\Anaconda3",
    CondaEnvironmentName="base",
    Python3xxDllFile="python312.dll")
division = Division(A=span, B=number_slider)
division_2 = Division(A=span_2, B=number_slider_2)
division_3 = Division(A=span_2, B=number_slider_3)
division_4 = Division(A=span_3, B=number_slider_4)
construct_point = ConstructPoint(XCoordinate=expr("x/2", span), YCoordinate="0", ZCoordinate=division)
construct_point_2 = ConstructPoint(XCoordinate=expr("x/2", span), YCoordinate="0", ZCoordinate=0)
division_5 = Division(A=span_4, B=number_slider_5)
construct_point_3 = ConstructPoint(XCoordinate=span, YCoordinate="0", ZCoordinate=0)
construct_point_4 = ConstructPoint(XCoordinate=0, YCoordinate="0", ZCoordinate=0)
construct_point_5 = ConstructPoint(XCoordinate=expr("x/2", span_2), YCoordinate="10", ZCoordinate=0)
construct_point_6 = ConstructPoint(XCoordinate=span_2, YCoordinate="10", ZCoordinate=0)
construct_point_7 = ConstructPoint(XCoordinate=0, YCoordinate="10", ZCoordinate=0)
construct_point_8 = ConstructPoint(XCoordinate=expr("x/2", span_3), YCoordinate="10", ZCoordinate=division_4)
construct_point_9 = ConstructPoint(XCoordinate=expr("x/2", span_3), YCoordinate="10", ZCoordinate=0)
vec = VectorXYZ(XComponent=expr("-x/2", division_2), YComponent=0, ZComponent=division_3)  # -> Vector, Length
vec_2 = VectorXYZ(XComponent=expr("x/2", division_2), YComponent=0, ZComponent=division_3)  # -> Vector, Length
construct_point_10 = ConstructPoint(XCoordinate=span_3, YCoordinate="10", ZCoordinate=0)
construct_point_11 = ConstructPoint(XCoordinate=0, YCoordinate="10", ZCoordinate=0)
construct_point_12 = ConstructPoint(XCoordinate=expr("x/2", span_4), YCoordinate="10", ZCoordinate=division_5)
construct_point_13 = ConstructPoint(XCoordinate=expr("x/2", span_4), YCoordinate="10", ZCoordinate=0)
construct_point_14 = ConstructPoint(XCoordinate=span_4, YCoordinate="10", ZCoordinate=0)
construct_point_15 = ConstructPoint(XCoordinate=0, YCoordinate="10", ZCoordinate=0)
ln = Line(StartPoint=construct_point_2, EndPoint=construct_point)
ln_2 = Line(StartPoint=construct_point_3, EndPoint=construct_point)
ln_3 = Line(StartPoint=construct_point_4, EndPoint=construct_point)
ln_4 = Line(StartPoint=construct_point_2, EndPoint=construct_point_3)
ln_5 = Line(StartPoint=construct_point_4, EndPoint=construct_point_2)
xz = XZPlane(Origin=Point(0, 0, 0))
ln_6 = Line(StartPoint=construct_point_9, EndPoint=construct_point_10)  # disabled
ln_7 = Line(StartPoint=construct_point_11, EndPoint=construct_point_9)  # disabled
xz_2 = XZPlane(Origin=Point(0, 0, 0))
addition = Addition(A=construct_point_5, B=vec.Vector)
addition_2 = Addition(A=construct_point_5, B=vec_2.Vector)
circle = CircleCNR(Center=construct_point_9, Normal=xz, Radius=division_4)
ln_8 = Line(StartPoint=construct_point_13, EndPoint=construct_point_14)
ln_9 = Line(StartPoint=construct_point_15, EndPoint=construct_point_13)
circle_2 = CircleCNR(Center=construct_point_13, Normal=xz_2, Radius=division_5)
pt = Point(addition)
pt_2 = Point(addition_2)

# ---- group: All elements
merge = Merge(Data1=ln_5, Data2=ln_4, Data3=ln_3, Data4=ln, Data5=ln_2)

# ---- group: All nodes
merge_2 = Merge(Data1=construct_point_4, Data2=construct_point_2, Data3=construct_point_3, Data4=construct_point)

# ----
tan = TangentLines(Point=construct_point_14, Circle=circle_2)  # -> Tangent1, Tangent2
tan_2 = TangentLines(Point=construct_point_15, Circle=circle_2)  # -> Tangent1, Tangent2
ln_10 = Line(StartPoint=construct_point_5, EndPoint=construct_point_6)
ln_11 = Line(StartPoint=construct_point_7, EndPoint=construct_point_5)
ln_12 = Line(StartPoint=construct_point_6, EndPoint=pt_2)
ln_13 = Line(StartPoint=construct_point_7, EndPoint=pt)
ln_14 = Line(StartPoint=construct_point_5, EndPoint=pt)
ln_15 = Line(StartPoint=construct_point_5, EndPoint=pt_2)
ln_16 = Line(StartPoint=pt, EndPoint=pt_2)
line = Line(tan.Tangent1)
line_2 = Line(tan_2.Tangent2)

# ---- group: All elements
merge_3 = Merge(Data1=ln_11, Data2=ln_10, Data3=ln_13, Data4=ln_12, Data5=ln_14, Data6=ln_15, Data7=ln_16)

# ----
end = EndPoints(Curve=line)  # -> Start, End

# ---- group: All nodes
merge_4 = Merge(Data1=construct_point_7, Data2=construct_point_5, Data3=construct_point_6, Data4=pt, Data5=pt_2)

# ----
end_2 = EndPoints(Curve=line_2)  # -> Start, End
pt_3 = Point(construct_point_11)
pt_4 = Point(construct_point_10)
pt_5 = Point(end_2.End)
pt_6 = Point(end.End)
arc = Arc3Pt(PointA=pt_3, PointB=construct_point_8, PointC=pt_4)  # -> Arc, Plane, Radius
arc_2 = Arc3Pt(PointA=pt_5, PointB=construct_point_12, PointC=pt_6)  # -> Arc, Plane, Radius
divide = DivideCurve(Curve=arc.Arc, Count=expr("x-1", n), Kinks=False)  # -> Points, Tangents, Parameters
divide_2 = DivideCurve(Curve=arc_2.Arc, Count=expr("x-1", n_2), Kinks=False)  # -> Points, Tangents, Parameters
pline = PolyLine(Vertices=divide.Points, Closed=False)
pline_2 = PolyLine(Vertices=divide_2.Points, Closed=False)
explode = Explode(Curve=pline, Recursive=True)  # -> Segments, Vertices
explode_2 = Explode(Curve=pline_2, Recursive=True)  # -> Segments, Vertices
merge_5 = Merge()
ln_17 = Line(StartPoint=explode.Vertices, EndPoint=circle)
line_3 = Line(explode.Segments)
end_3 = EndPoints(Curve=ln_17)  # -> Start, End
merge_6 = Merge(Data1=line_2, Data2=line)
ln_18 = Line(StartPoint=explode_2.Vertices, EndPoint=circle_2)
end_4 = EndPoints(Curve=ln_18)  # -> Start, End
line_4 = Line(explode_2.Segments)
pipe = Pipe(Curve=line_3, Radius=expr("x/2000", Slider(15, range=0.1..100)), Caps=0)
pipe_2 = Pipe(Curve=ln_17, Radius=expr("x/2000", Slider(5, range=0.1..100)), Caps=0)
pipe_3 = Pipe(Curve=[line_4, line_2, line], Radius=expr("x/2000", Slider(15, range=0.1..100)), Caps=0)
pipe_4 = Pipe(Curve=[ln_18, ln_9, ln_8], Radius=expr("x/2000", Slider(5, range=0.1..100)), Caps=0)
sph = Sphere(Base=[end_3.Start, end_3.End], Radius=expr("x/2000", Slider(20, range=0.1..100)))
sph_2 = Sphere(Base=[end_4.Start, end_4.End], Radius=expr("x/2000", Slider(20, range=0.1..100)))

# ---- group: All nodes
merge_7 = Merge(Data1=construct_point_11, Data2=construct_point_9, Data3=construct_point_10, Data4=explode.Vertices)  # -> flatten(Result)

# ---- group: All elements
merge_8 = Merge(Data1=ln_7, Data2=ln_6, Data3=line_3, Data4=ln_17, Data5=merge_5)  # -> flatten(Result)

# ----
preview = CustomPreview(Geometry=pipe, Material=ColourSwatch(SwatchColor=RGB(0, 0, 0)))
preview_2 = CustomPreview(Geometry=pipe_2, Material=ColourSwatch(SwatchColor=RGB(0, 64, 255)))
preview_3 = CustomPreview(Geometry=sph, Material=ColourSwatch(SwatchColor=RGB(0, 0, 0)))
preview_4 = CustomPreview(Geometry=pipe_3, Material=ColourSwatch(SwatchColor=RGB(0, 0, 0)))
preview_5 = CustomPreview(Geometry=pipe_4, Material=ColourSwatch(SwatchColor=RGB(0, 64, 255)))

# ---- group: All nodes
merge_9 = Merge(Data1=construct_point_15, Data2=construct_point_13, Data3=construct_point_14, Data4=explode_2.Vertices)  # -> flatten(Result)

# ---- group: All elements
merge_10 = Merge(Data1=ln_9, Data2=ln_8, Data3=line_4, Data4=ln_18, Data5=merge_6)  # -> flatten(Result)

# ----
preview_6 = CustomPreview(Geometry=sph_2, Material=ColourSwatch(SwatchColor=RGB(0, 0, 0)))

# ---- group: elements
number_slider_6 = Slider(20, range=0.1..100)
line_5 = Line(merge)
M = Material(Name="elem", YoungModulus="10000", YieldStrength="100", SpecificMass="0")
circular = CrossSectionCircular(Diameter=number_slider_6, Thickness=0)
pipe_5 = Pipe(Curve=line_5, Radius=expr("x/2000", number_slider_6), Caps=0)

number_slider_7 = Slider(20, range=0.1..100)
line_6 = Line(merge_3)
M_2 = Material(Name="elem", YoungModulus="10000", YieldStrength="100", SpecificMass="0")
circular_2 = CrossSectionCircular(Diameter=number_slider_7, Thickness=0)
pipe_6 = Pipe(Curve=line_6, Radius=expr("x/2000", number_slider_7), Caps=0)

# ----
pt_7 = Point(merge_2)
pt_8 = Point(merge_4)

# ---- group: elements
number_slider_8 = Slider(20, range=0.1..100)
line_7 = Line(merge_8)
M_3 = Material(Name="elem", YoungModulus="10000", YieldStrength="100", SpecificMass="0")
circular_3 = CrossSectionCircular(Diameter=number_slider_8, Thickness=0)
pipe_7 = Pipe(Curve=line_7, Radius=expr("x/2000", number_slider_8), Caps=0)

number_slider_9 = Slider(20, range=0.1..100)
line_8 = Line(merge_10)
M_4 = Material(Name="elem", YoungModulus="10000", YieldStrength="100", SpecificMass="0")
circular_4 = CrossSectionCircular(Diameter=number_slider_9, Thickness=0)
pipe_8 = Pipe(Curve=line_8, Radius=expr("x/2000", number_slider_9), Caps=0)

# ----
C = ElementCable(Line=line_5, FreeLength=-1, CrossSection=circular, Material=M, CanResistCompression=Toggle(True))
C_2 = ElementCable(Line=line_6, FreeLength=-1, CrossSection=circular_2, Material=M_2, CanResistCompression=Toggle(True))
pt_9 = Point(merge_7)
pt_10 = Point(merge_9)
C_3 = ElementCable(Line=line_7, FreeLength=-1, CrossSection=circular_3, Material=M_3, CanResistCompression=Toggle(True))
C_4 = ElementCable(Line=line_8, FreeLength=-1, CrossSection=circular_4, Material=M_4, CanResistCompression=Toggle(True))
neg = Negative(Value="1")
neg_2 = Negative(Value="1")
Z = UnitZ(Factor=neg)
Z_2 = UnitZ(Factor=neg_2)
load = PointLoad(Point=construct_point_2, Vector=Z)
load_2 = PointLoad(Point=construct_point_5, Vector=Z_2)
neg_3 = Negative(Value="1")
neg_4 = Negative(Value="1")
Z_3 = UnitZ(Factor=neg_3)
Z_4 = UnitZ(Factor=neg_4)
load_3 = PointLoad(Point=construct_point_9, Vector=Z_3)
load_4 = PointLoad(Point=construct_point_13, Vector=Z_4)

# ---- group: FL (kNm)
multiplication = Multiplication(A="1", B=span)

multiplication_2 = Multiplication(A="1", B=span_2)

# ----
# Curve Tensegrity
# Regular cell
# Cell height
# Assembly length
# Node on node
# Node on cable
# Alterned rotation
# Regular rotation
# Custom profile
# Linear profile
# 2 cells
# 4 cells
# Triangle
# Pentagon
panel = Panel("0.03")
rec = DataRecorder(number_slider, DataLimit=-10, RecordData=False)
rec_2 = DataRecorder(number_slider_3, DataLimit=-10, RecordData=True)
panel_2 = Panel(rec)

# ---- group: FL (kNm)
multiplication_3 = Multiplication(A="1", B=span_3)

# ----
panel_3 = Panel(rec_2)

# ---- group: FL (kNm)
multiplication_4 = Multiplication(A="1", B=span_4)

# ----
rec_3 = DataRecorder(number_slider_4, DataLimit=-10, RecordData=True)
rec_4 = DataRecorder(number_slider_5, DataLimit=-10, RecordData=True)
# 1D assembly
# Custom profile
# Linear profile
# 2 cells
# 4 cells
# Triangle
# Pentagon
panel_4 = Panel(rec_3)
# INFO
# STEP 1: Choose parameters
# STEP 2: Create bases
# Geometric parameters
# Regular cell
# Cell height
# Assembly length
# STEP 5: Final geometry
# Nodes
# Bases cables
# Cells cables
# Cells struts
# BONUS STEP: Sinusoidal struts
panel_5 = Panel(rec_4)

# ---- group: Supports
pt_11 = Point(construct_point_3)
pt_12 = Point(construct_point_4)
pt_13 = Point(merge_2)
spt = Support(Point=pt_12, IsXFree=False, IsYFree=False, IsZFree=False)

# ---- group: Supports / Block Z
sptz = SupportZ(Point=pt_11)

# ---- group: Supports / Block Y
spty = SupportY(Point=pt_13)

# ---- group: Supports (continued)
spt_2 = Support([spt, spty, sptz])

# ----
structure = StructureAssemble(Elements=C, Points=pt_7, Supports=spt_2)
disassemble = StructureDisassemble(Structure=structure)  # -> Nodes, Elements
node_prop = NodeProperties(Node=disassemble.Nodes)  # -> PtM, FixationsCount, IsFree, LoadKN, UnbalancedLoad, ReactKN, ReactKN_2
svd = SolverSelfstressAndMechanismsAnalysisBySingularValueDecomposition(Structure=structure, ZeroTol=0.001)  # -> Structure, Rank, S, A, StaticDeg, SelfStress, KinematicDeg, Mechanisms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; disabled
linear_d = SolverLinearDisplacementsMeth(Structure=structure, ExternalPointLoads=load)
disassemble_2 = StructureDisassemble(Structure=linear_d)  # -> Nodes, Elements
elem_results = ElementsResults(Element=disassemble_2.Elements)  # -> Line, FreeLength, IsValid, UnityCheck, Xsi, Tension, TensionAllowable
node_prop_2 = NodeProperties(Node=disassemble_2.Nodes)  # -> PtM, FixationsCount, IsFree, LoadKN, UnbalancedLoad, ReactKN, ReactKN_2
showf = ShowForces(Lines=elem_results.Line, Forces=elem_results.Tension, Thickness=2, ValueSettings=2, TextSize="0.03")
subtraction = Subtraction(A=node_prop_2.PtM, B=node_prop.PtM)
multiplication_5 = Multiplication(A=elem_results.FreeLength, B=elem_results.Tension)
abs = Absolute(Value=multiplication_5)
ma = MassAddition(Input=abs)  # -> Result, PartialResults
vdis = VectorDisplay(Anchor=node_prop.PtM, Vector=subtraction)

# ---- group: Total Load Path (kNm)
num = Number(ma.Result)

# ---- group: ind. Volume W (-)
division_6 = Division(A=num, B=multiplication)

# ----
rec_5 = DataRecorder(division_6, DataLimit=-10, RecordData=True)
panel_6 = Panel(rec_5)

# ---- group: Supports
pt_14 = Point(construct_point_6)
pt_15 = Point(construct_point_7)
pt_16 = Point(merge_4)
spt_3 = Support(Point=pt_15, IsXFree=False, IsYFree=False, IsZFree=False)

# ---- group: Supports / Block Z
sptz_2 = SupportZ(Point=pt_14)

# ---- group: Supports / Block Y
spty_2 = SupportY(Point=pt_16)

# ---- group: Supports (continued)
spt_4 = Support([spt_3, spty_2, sptz_2])

# ----
structure_2 = StructureAssemble(Elements=C_2, Points=pt_8, Supports=spt_4)  # disabled
disassemble_3 = StructureDisassemble(Structure=structure_2)  # -> Nodes, Elements
node_prop_3 = NodeProperties(Node=disassemble_3.Nodes)  # -> PtM, FixationsCount, IsFree, LoadKN, UnbalancedLoad, ReactKN, ReactKN_2
svd_2 = SolverSelfstressAndMechanismsAnalysisBySingularValueDecomposition(Structure=structure_2, ZeroTol=0.001)  # -> Structure, Rank, S, A, StaticDeg, SelfStress, KinematicDeg, Mechanisms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; disabled
linear_d_2 = SolverLinearDisplacementsMeth(Structure=structure_2, ExternalPointLoads=load_2)
disassemble_4 = StructureDisassemble(Structure=linear_d_2)  # -> Nodes, Elements
elem_results_2 = ElementsResults(Element=disassemble_4.Elements)  # -> Line, FreeLength, IsValid, UnityCheck, Xsi, Tension, TensionAllowable
node_prop_4 = NodeProperties(Node=disassemble_4.Nodes)  # -> PtM, FixationsCount, IsFree, LoadKN, UnbalancedLoad, ReactKN, ReactKN_2
showf_2 = ShowForces(Lines=elem_results_2.Line, Forces=elem_results_2.Tension, Thickness=2, ValueSettings=2, TextSize="0.03")
subtraction_2 = Subtraction(A=node_prop_4.PtM, B=node_prop_3.PtM)
multiplication_6 = Multiplication(A=elem_results_2.FreeLength, B=elem_results_2.Tension)
abs_2 = Absolute(Value=multiplication_6)
ma_2 = MassAddition(Input=abs_2)  # -> Result, PartialResults
vdis_2 = VectorDisplay(Anchor=node_prop_3.PtM, Vector=subtraction_2)

# ---- group: Total Load Path (kNm)
num_2 = Number(ma_2.Result)

# ---- group: ind. Volume W (-)
division_7 = Division(A=num_2, B=multiplication_2)

# ----
rec_6 = DataRecorder(division_7, DataLimit=-10, RecordData=True)
panel_7 = Panel(rec_6)

# ---- group: Supports
pt_17 = Point(construct_point_10)
pt_18 = Point(construct_point_11)
pt_19 = Point(merge_7)
spt_5 = Support(Point=pt_18, IsXFree=False, IsYFree=False, IsZFree=False)

# ---- group: Supports / Block Z
sptz_3 = SupportZ(Point=pt_17)

# ---- group: Supports / Block Y
spty_3 = SupportY(Point=pt_19)

# ---- group: Supports (continued)
spt_6 = Support([spt_5, spty_3, sptz_3])

# ----
structure_3 = StructureAssemble(Elements=C_3, Points=pt_9, Supports=spt_6)  # disabled
disassemble_5 = StructureDisassemble(Structure=structure_3)  # -> Nodes, Elements
node_prop_5 = NodeProperties(Node=disassemble_5.Nodes)  # -> PtM, FixationsCount, IsFree, LoadKN, UnbalancedLoad, ReactKN, ReactKN_2
svd_3 = SolverSelfstressAndMechanismsAnalysisBySingularValueDecomposition(Structure=structure_3, ZeroTol=0.001)  # -> Structure, Rank, S, A, StaticDeg, SelfStress, KinematicDeg, Mechanisms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; disabled
linear_d_3 = SolverLinearDisplacementsMeth(Structure=structure_3, ExternalPointLoads=load_3)
disassemble_6 = StructureDisassemble(Structure=linear_d_3)  # -> Nodes, Elements
elem_results_3 = ElementsResults(Element=disassemble_6.Elements)  # -> Line, FreeLength, IsValid, UnityCheck, Xsi, Tension, TensionAllowable
node_prop_6 = NodeProperties(Node=disassemble_6.Nodes)  # -> PtM, FixationsCount, IsFree, LoadKN, UnbalancedLoad, ReactKN, ReactKN_2
showf_3 = ShowForces(Lines=elem_results_3.Line, Forces=elem_results_3.Tension, Thickness=2, ValueSettings="0", TextSize=panel)
subtraction_3 = Subtraction(A=node_prop_6.PtM, B=node_prop_5.PtM)
multiplication_7 = Multiplication(A=elem_results_3.FreeLength, B=elem_results_3.Tension)
abs_3 = Absolute(Value=multiplication_7)
ma_3 = MassAddition(Input=abs_3)  # -> Result, PartialResults
vdis_3 = VectorDisplay(Anchor=node_prop_5.PtM, Vector=subtraction_3)

# ---- group: Total Load Path (kNm)
num_3 = Number(ma_3.Result)

# ---- group: ind. Volume W (-)
division_8 = Division(A=num_3, B=multiplication_3)

# ----
rec_7 = DataRecorder(division_8, DataLimit=-10, RecordData=True)
# Assembly
# Curve
# Node on node
# Node on cable
# Alterned rotation
# Regular rotation
# 5 cells
# 3 cells
# Triangle
# Pentagon
# STEP 5: Final geometry
# Nodes
# Bases cables
# Cells cables
# Cells struts
# STEP 3: Create struts and cables
# BONUS STEP: Sinusoidal struts
panel_8 = Panel(rec_7)

# ---- group: Supports
pt_20 = Point(construct_point_14)
pt_21 = Point(construct_point_15)
pt_22 = Point(merge_9)
spt_7 = Support(Point=pt_21, IsXFree=False, IsYFree=False, IsZFree=False)

# ---- group: Supports / Block Z
sptz_4 = SupportZ(Point=pt_20)

# ---- group: Supports / Block Y
spty_4 = SupportY(Point=pt_22)

# ---- group: Supports (continued)
spt_8 = Support([spt_7, spty_4, sptz_4])

# ----
structure_4 = StructureAssemble(Elements=C_4, Points=pt_10, Supports=spt_8)  # disabled
disassemble_7 = StructureDisassemble(Structure=structure_4)  # -> Nodes, Elements
node_prop_7 = NodeProperties(Node=disassemble_7.Nodes)  # -> PtM, FixationsCount, IsFree, LoadKN, UnbalancedLoad, ReactKN, ReactKN_2
svd_4 = SolverSelfstressAndMechanismsAnalysisBySingularValueDecomposition(Structure=structure_4, ZeroTol=0.001)  # -> Structure, Rank, S, A, StaticDeg, SelfStress, KinematicDeg, Mechanisms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; disabled
linear_d_4 = SolverLinearDisplacementsMeth(Structure=structure_4, ExternalPointLoads=load_4)
disassemble_8 = StructureDisassemble(Structure=linear_d_4)  # -> Nodes, Elements
elem_results_4 = ElementsResults(Element=disassemble_8.Elements)  # -> Line, FreeLength, IsValid, UnityCheck, Xsi, Tension, TensionAllowable
node_prop_8 = NodeProperties(Node=disassemble_8.Nodes)  # -> PtM, FixationsCount, IsFree, LoadKN, UnbalancedLoad, ReactKN, ReactKN_2
showf_4 = ShowForces(Lines=elem_results_4.Line, Forces=elem_results_4.Tension, Thickness=2, ValueSettings=2, TextSize="0.03")
subtraction_4 = Subtraction(A=node_prop_8.PtM, B=node_prop_7.PtM)
multiplication_8 = Multiplication(A=elem_results_4.FreeLength, B=elem_results_4.Tension)
abs_4 = Absolute(Value=multiplication_8)
ma_4 = MassAddition(Input=abs_4)  # -> Result, PartialResults
vdis_4 = VectorDisplay(Anchor=node_prop_7.PtM, Vector=subtraction_4)

# ---- group: Total Load Path (kNm)
num_4 = Number(ma_4.Result)

# ---- group: ind. Volume W (-)
division_9 = Division(A=num_4, B=multiplication_4)

# ----
rec_8 = DataRecorder(division_9, DataLimit=-10, RecordData=True)
# Node on node
# Node on cable
# STEP 3: Create struts and cables
# Alterned rotation
# Regular rotation
panel_9 = Panel(rec_8)
